# Grasshopper definition 00_FINAL CODE.gh (Grasshopper 1.0.8)
# plug-ins: RhinoCodePluginGH, Parakeet, LunchBox, LadybugGrasshopper, opennest_2, Kangaroo2 Components

choose = ValueList({"Scanned rubble only": 0, "Randomized rubble geometries": 1}, selected="Randomized rubble geometries")
grid_size = Slider(100, range=100..5000)
number_of_duplicates = Slider(4, range=1..10)

# ----
# Step 1: File SetUp
# INSTRUCTIONS for file setup: Rhino:
#  - Version: Rhino 8
#  - Units: mm
# 
# Grasshopper:
#  - Version: Grasshopper for Rhino 8
#  - Plug-ins:
#     - LadyBug
#     - Parakeet (not available for MAC)
#     - OpenNest
# Step 2: Rubble geometry
path_to_folder_containing_csv_files = Panel("C:\Users\anneb\Documents\TU Delft\03 Fall 2024\CORE\Algorithm\200_stones")
# Random Rubble Generator
# INSTRUCTIONS for running random rubble generator: 1) Adjust number of duplicates
# 2) Adjust grid size (for organization of curves)
# 3) Adjust lower bound and upper bound limits for vector scaling
# 4) Ensure that the CSV file units match the rhino file units (ie. mm)
# 5) Adjust lower bound and upper bound limits for geometry scaling
# 6) Select "Randomized rubble geometries" from list
# 7) Set "Push rubble geometries" to True
# 
# PROTOTYPE SETTINGS:
#    Number of Duplicates: 4
#    Grid Size: 100
#    Choose: Randomized rubble geometries
#    Vector domain:
#      Lower bound: 0.2
#      Upper bound: 1.8
#      Random Seed: 3
#    Scaling domain:
#      Scale for Pieces: 0.001
#      Lower Bound: 0.75
#      Upper Bound: 1.10
#      Random Seed: 3
number_of_scans = Slider(201, range=1..201)

# ----
# Vector domain
random_seed = Slider(3, range=0..10)
lower_bound = Slider(0.2, range=0..1)
upper_bound = Slider(1.8, range=0..10)

# ----
# CSV files
# INSTRUCTIONS for integration of CSV files: 1) Be sure to have CSV files downloaded
# 2) Ensure that the files are named incrementally
# 3) Paste path to folder in panel
# 4) Ensure that the number of scans is correct
# 5) Check that the output panel contains polyline curves
# 
# TROUBLE SHOOTING:
#  - enter the python in grasshopper component
#  - review how the file_path variable is completed with the i counter
#  - test different ways to write the file_path (use the examples for troubleshooting)
# 
# PROTOYPE SETTINGS:
#    Path to folder: C:\Users\anneb\Documents\TU Delft\03 Fall 2024\CORE\Algorithm\200_stones
#    Number of Scans: 201
python_3_script = Python3Script(x=path_to_folder_containing_csv_files, y=number_of_scans)  # -> out, a; inputs x: String, y: Int32
# ---------- python_3_script: Python ----------
import rhinoscriptsyntax as rs
import Rhino

a = []

nbr_img = y

folder_path = str(x)
# folder_path = r"C:\Users\anneb\Documents\TU Delft\03 Fall 2024\CORE\Algorithm\200_stones"

#loop for amount
for i in range(0,(nbr_img+1)):
    # mauritz_path = (f"/Users/mvk/github2/reimagine/00_Scanning/prototype01/contour_csv/contour_points_stativ02_{i}.csv")
    # laila_path = (r"C:\Users\laila\Downloads\200_stones\contour_points_stativ02_" + f"{i}.csv")
    # tamara_path = (r"C:\Users\Tamara Lalyko\OneDrive - Delft University of Technology\CORE\01 Scripts\data\200_stones\contour_points_stativ02_" + f"{i}.csv")
    # annebel_path = (r"C:\Users\anneb\Documents\TU Delft\03 Fall 2024\CORE\Algorithm\200_stones\contour_points_stativ02_"+ str(i)+ ".csv")

    file_path = folder_path + r"\contour_points_stativ02_"+ str(i)+ ".csv"

    points_list = []

    # Read the points from the CSV file
    with open(file_path, 'r') as csvfile:
        for line in csvfile:
            x_str, y_str = line.strip().split(',')
            x = float(x_str)
            y = -float(y_str)
            z = 0.0  # Assuming a flat contour in the XY plane
            point = Rhino.Geometry.Point3d(x, y, z)
            points_list.append(point)

    # Close the polyline if necessary
    if not points_list[0].Equals(points_list[-1]):
        points_list.append(points_list[0])

    # Create the polyline
    polyline = Rhino.Geometry.Polyline(points_list)

    # Output the polyline curve
    a.append (polyline)
# ---------- end python_3_script ----------
panel = Panel(python_3_script.a)

# ----
# Scaling domain
scale_for_pieces = Slider(0.001, range=0..1)
lower_bound_2 = Slider(0.75, range=0..1)
upper_bound_2 = Slider(1.1, range=0..10)
random_seed_2 = Slider(3, range=0..10)

# ----
# keep at 4 for all variations to work, can change a bit for some
number_slider = Slider(4, range=1..5)

push_left_buttress_geometry = LBFalseStartToggle(True)
push_right_buttress_geometry = LBFalseStartToggle(True)
push_main_wall_geometry = LBFalseStartToggle(True)

# ----
# Step 3: Sort rubble
# INSTRUCTIONS for sorting rubble: 1) Set "Sort rubble?" to True
# Step 4: Create wall, buttress, and cell geometries
sort_rubble = LBFalseStartToggle(True)

# ----
# Wall and Grid
# Wall Dimensions
# INSTRUCTIONS: 1) Adjust wall dimesnions
# 
# 2) Adjust grid divisions
#    NOTE:
#    - minimize division in Y to zero for more square cells
#    - X and Y divisions have limits applied to them
# 
# PROTOTYPE SETTINGS:
#    thickness: 50 mm
#    width: 800 mm
#    height: 600 mm
#    Divisions in X: 14
#    Divisions in Y: 0
thickness_mm = Slider(50, range=0..1500)
width_mm = Slider(800, range=0..6000)
# Pattern Type
# INSTRUCTIONS: 1) Choose Pattern Type
# 
# 2) Choose Cell Widths
# 
# PROTOTYPE SETTINGS:
#    Pattern Type: Randomized Heights
#    Cell Widths: Randomized Cell Widths
height_mm = Slider(600, range=0..6000)

max_percentage_of_cell_width = Slider(0.33, range=0..0.5)
random_seed_3 = Slider(41, range=0..100)

# ----
# Randomized Cell Widths INPUT
# INSTRUCTIONS: 1) Change MAX percentage of cell width
#    - keep close to 0.25, don't go beyond 0.5
# 
# 2) Change random seed to get different variations
# 
# PROTOTYPE SETTINGS:
#    MAX percentage of cell width: 0.330
#    Random seed: 41
cell_widths = ValueList({"Standardize cell widths": 0, "Randomize cell widths": 1}, selected="Randomize cell widths")
pattern_type = ValueList({"Normal brick laying": 0, "Randomized heights": 1, "Alternating heights": 2, "Gradient heights": 3}, selected="Randomized heights")

divisions_in_y = Slider(0, range=0..30)
divisions_in_x = Slider(14, range=0..30)

factor_for_max_y = Slider(0.25, range=0..0.4)
upper_end_for_y = Slider(1, range=0..1)
lower_end_for_y = Slider(-1, range=-1..0)
random_seed_4 = Slider(11, range=0..100)

gradient_direction = ValueList({"Big on top": 0, "Big on bottom": 1}, selected="Big on bottom")
gradient_scale_a = Slider(1.1, range=1.0001..1.25)

type_of_rubble = ValueList({"Ellipses": 0, "Remaining rubble": 1, "Scaled down rubble": 2}, selected="Scaled down rubble")
scale_for_scaled_down_rubble_pieces = Slider(0.45, range=0.25..0.75)

# ----
# Main Wall Packing
general_tolerance = Slider(4310, range=0..10000)
area_tolerance = Slider(0.25, range=0..0.5)
pack_main_wall = LBFalseStartToggle(True)
cell_changing = BooleanToggle(True)

# ----
# Buttress Packing
general_tolerance_2 = Slider(4320, range=0..10000)
area_tolerance_2 = Slider(0.25, range=0..0.5)
pack_buttresses = LBFalseStartToggle(True)
cell_changing_2 = BooleanToggle(True)

divisions_between_rows = Slider(5, range=1..5)
shortest_path_to_test = Slider(4, range=0..40)

# ----
# OUTPUT CURVES and POINTS
# (ORGANIZED ROW BY ROW)
# top right
# top left
# bottom left
# bottom right
# top right
# top left
# bottom left
# bottom right
# top right
# top left
# bottom left
# bottom right
panel_2 = Panel("""bottom right
top right
top left
bottom left""")
panel_3 = Panel("""bottom right
top right
top left
bottom left""")
panel_4 = Panel("""bottom right
top right
top left
bottom left""")
stream_filter = StreamFilter(Gate=pattern_type, Stream0=panel_2, Stream1=panel_2, Stream2=panel_2, Stream3=panel_2)
stream_filter_2 = StreamFilter(Gate=pattern_type, Stream0=panel_3, Stream1=panel_3, Stream2=panel_3, Stream3=panel_3)
stream_filter_3 = StreamFilter(Gate=pattern_type, Stream0=panel_4, Stream1=panel_4, Stream2=panel_4, Stream3=panel_4)

# ----
# Sorting and Packing
# Unavailable stones
number_slider_2 = Slider(0, range=0..10)
series = Series(Start="1", Step=1, Count=number_slider_2)

# ----
# Display
text_size = Slider(19, range=0..100)
rubble_color = ColourSwatch(SwatchColor=RGB(0, 0, 0))
text_color = ColourSwatch(SwatchColor=RGB(255, 255, 255))

# ---- group: Ellipse version
ellipse = Ellipse(Plane=PlaneXY(0, 0, 0), Radius1=Slider(20, range=0..100), Radius2=Slider(15, range=0..100))  # -> Ellipse, Focus1, Focus2
duplicate_data = DuplicateData(Data=ellipse.Ellipse, Number=Slider(200, range=0..200), Order=True)

# ---- group: OPENNEST
options = Options(
    Rotations=Slider(180, range=0..360),
    Wiggle=Slider(5, range=0..5.01),
    PlacementType=Slider(2, range=0..2),
    Spacing=Slider(0, range=0..100),
    Seed=Slider(30, range=0..100),
    SimplifyTolerance=Slider(0.01, range=0.01..10),
    Mutation=Slider(10, range=1..100),
    Population=Slider(10000, range=1..100000),
    Time=Slider(0, range=0..120),
    SheetFont="MecSoft_Font-1 -10")

# ----
# Rubble pieces
push_rubble_geometries = LBFalseStartToggle(True)

# ----
# Contours from Scan
duplicate_data_2 = DuplicateData(Data=python_3_script.a, Number=number_of_duplicates, Order=True)
stream_filter_4 = StreamFilter(ScannedOrRandomized=choose, Stream0=python_3_script.a, Stream1=duplicate_data_2)
stream_filter_5 = StreamFilter(Push=push_rubble_geometries, Stream1=stream_filter_4)
curve = Curve(stream_filter_5)
length = Length(Curve=curve)
list_length = ListLength(List=curve)
list_item = ListItem(List=length, Index="0", Wrap=True)
series_2 = Series(Start=0, Step=list_item, Count=list_length)
unit_x = UnitX(Factor=series_2)
move = Move(Geometry=curve, Motion=unit_x)  # -> Geometry, Transform
boundary_surfaces = BoundarySurfaces(Edges=move.Geometry)

# ----
# Polyline Simplification
toggle = BooleanToggle(True)
crv = Curve(move.Geometry)
nest_geo = Nest_geo(Outlines=crv, Simplify=-100, Hull=toggle, Copies="1")  # -> Nest_geo, Borders
curve_2 = Curve(nest_geo.Borders)
reduce = Reduce(Polyline=curve_2, Tolerance=Slider(5, range=0..100))  # -> Polyline, Reduction
control_points = ControlPoints(Curve=graft(reduce.Polyline))  # -> Points, Weights, Knots
custom_preview = CustomPreview(Geometry=reduce.Polyline, Material=ColourSwatch(SwatchColor=RGB(50, 33, 235)))

# ----
# Image to real size
area = Area(Geometry=boundary_surfaces)  # -> Area, Centroid
point = Point(graft(area.Centroid))
vector_2pt = Vector2Pt(PointA=point, PointB=control_points.Points, Unitize=False)  # -> Vector, Length
line = Line(StartPoint=point, EndPoint=control_points.Points)
camera_distance = Slider(357, range=0..1000)
length_2 = Length(Curve=line)
stone_thickness = Panel("50")
division = Division(A=length_2, B=camera_distance)
subtraction = Subtraction(A=camera_distance, B=stone_thickness)
multiplication = Multiplication(A=division, B=subtraction)
amplitude = Amplitude(Vector=vector_2pt.Vector, Amplitude=multiplication)
move_2 = Move(Geometry=point, Motion=amplitude)  # -> Geometry, Transform
polyline = PolyLine(Vertices=move_2.Geometry, Closed=False)

# ----
# Limits
# Code Limits for Wall Dimensions
# Cell Dimensions: The cell height should not exceed 1/2 of the cell width
slenderness_limit = Panel("h / t < 27")
plan_area_limit = Panel("l x t > 0.04 m2")
multiplication_2 = Multiplication(A=".04", B="1000000")
multiplication_3 = Multiplication(A=thickness_mm, B="27")
division_2 = Division(A=multiplication_2, B=thickness_mm)
merge = Merge(Data1=multiplication_3, Data2=height_mm)
merge_2 = Merge(Data1=division_2, Data2=width_mm)
pick_minimum = Panel(merge)
pick_maximum = Panel(merge_2)
sort_list = SortList(Keys=pick_maximum)  # -> Keys, ValuesValuesA
sort_list_2 = SortList(Keys=pick_minimum)  # -> Keys, ValuesValuesA
list_item_2 = ListItem(List=sort_list.Keys, Index="1", Wrap=True)
list_item_3 = ListItem(List=sort_list_2.Keys, Index="0", Wrap=True)

# ----
# Script Limits
# NOTE: Wall is not feasible if buttruss thickness is less than the width of a half cell.
# 
# t > 1/2 cell width
# 
# AND
# 
# The buttruss thickness should not be greater than the full cell width
# 
# t < cell width
division_3 = Division(A=list_item_2, B=divisions_in_x)
tolerance = Slider(10, range=0..100)
round = Round(Number=expr("x/10", division_3))  # -> expr("x*10", Nearest), Floor, Ceiling
multiplication_4 = Multiplication(A=round.Nearest, B="2")
addition = Addition(A=round.Nearest, B=tolerance)
addition_2 = Addition(A=multiplication_4, B=tolerance)
merge_3 = Merge(Data1=addition, Data2=thickness_mm, Data3=addition_2)
pick_middle = Panel(merge_3)
sort_list_3 = SortList(Keys=pick_middle)  # -> Keys, ValuesValuesA
list_item_4 = ListItem(List=sort_list_3.Keys, Index="1", Wrap=True)

# ----
# Buttress Geometry
# INSTRUCTIONS: 1) Change Top width
#    - will take max between set value and wall thickness
# 
# 2) Change Bottom width
#    - will be 25% wider than top width
# 
# PROTYPE SETTINGS:
#    Top width: 0 mm
#    Bottom width: 250 mm
bottom_width_mm = Slider(250, range=0..2000)
top_width_mm = Slider(0, range=0..2000)
maximum = Maximum(A=list_item_4, B=top_width_mm)
multiplication_5 = Multiplication(A=maximum, B="1.25")
maximum_2 = Maximum(A=multiplication_5, B=bottom_width_mm)

# ---- group: Randomize cell widths
# Randomized Cell Widths
panel_5 = Panel("2")
multiplication_6 = Multiplication(A=panel_5, B=number_slider)

# ----
# Rubble Geometry Limits
# Cell Dimensions: Cell width dimension limits based on rubble geometry input
# Cell Dimensions: Cell height dimension limits based on rubble geometry input
panel_6 = Panel("2")

# ---- group: Construct Buttress Outlines
number = Number(maximum_2)
unit_x_2 = UnitX(Factor=expr("-x", maximum_2))
unit_x_3 = UnitX(Factor=expr("-x", maximum))
unit_x_4 = UnitX(Factor=expr("-x", number))

# ---- group: Rows sorted
# Sorting Cells by Rows
panel_7 = Panel("10000")

# ----
# Alternating Row Heights INPUT
# INSTRUCTIONS: 1) Change Factor for max_y
#    - keep close to 0.25, don't go beyond 0.4
# Gradient Row Heights INPUT
# INSTRUCTIONS: 1) Change Gradient scale factor
#    - closer to 1.0 is less dramatic of a gradient
# 
# 2) Choose Gradient direction
#    - NOTE: Big on bottom has a bug, ran out of time to fix it
factor_for_max_y_2 = Slider(0.1, range=0..0.4)

# ----
# Pattern INPUT
# Randomized Row Heights INPUT
# INSTRUCTIONS: 1) Change Factor for max_y
#    - keep close to 0.25, don't go beyond 0.4
# 
# 2) Change Lower end and Upper end for y (factor mulitplier)
# 
# 3) Change random seed to get different variations
# 
# PROTOTYPE SETTINGS:
#    Factor for max_y: 0.25
#    Lower end for y: -1.00
#    Upper end for y:  1.00
#    Random seed: 11
construct_domain = ConstructDomain(DomainStart=lower_end_for_y, DomainEnd=upper_end_for_y)

# ----
# Comparing rubble geometry and cells
number_slider_3 = Slider(0.1, range=0..1)
subtraction_2 = Subtraction(A="1", B=number_slider_3)
addition_3 = Addition(A="1", B=number_slider_3)
subtraction_3 = Subtraction(A="1", B=number_slider_3)
addition_4 = Addition(A="1", B=number_slider_3)

# ---- group: Relay
number_2 = Number(list_item_4)

# ----
# Find Holes for Buttresses
panel_8 = Panel("-1")

# ----
# Vectors for Array of Vertical Divisions
number_slider_4 = Slider(2, range=0..10)
subtraction_4 = Subtraction(A=number_2, B=addition)

# ----
# Vectors for Array of Vertical Divisions
number_3 = Number(list_item_4)
subtraction_5 = Subtraction(A=number_3, B=addition)

# ----
# Structural Parameter Limits
# Cell Dimensions: The cell height should not exceed 1/2 of the cell width
# PROTOTYPE: True
plan_area_limit_2 = Panel("""l x t > 0.04 m2
PROTOTYPE: False""")
# Limits
slenderness_limit_2 = Panel("""h / t < 27
PROTOTYPE: True""")
stream_filter_6 = StreamFilter(UseThisLimit=Toggle(True), Stream0=height_mm, Stream1=list_item_3)
stream_filter_7 = StreamFilter(UseThisLimit=Toggle(False), Stream0=width_mm, Stream1=list_item_2)

# ----
# Horizontal Divisions
panel_9 = Panel("0")
subtraction_6 = Subtraction(A=panel_9, B=maximum_2)
merge_4 = Merge(Data1=panel_9, Data2=subtraction_6)

# ----
# Rubble Geometry Limits
# Cell Dimensions: Cell width dimension limits based on rubble geometry input
# PROTOTYPE: True
# Cell Dimensions: Cell height dimension limits based on rubble geometry input
# PROTOTYPE: True
boolean_toggle = BooleanToggle(True)

# ----
# Horizontal Lines
boolean_toggle_2 = BooleanToggle(False)

# ----
# Vertical Divisions
number_slider_5 = Slider(0, range=0..100)

# ---- group: Defining Grid
# Wall Outline and Grid
number_4 = Number(divisions_in_x)

# ---- group: Brick-laying Alternating Heights / Alternating Pattern / Remove top and bottom edge
panel_10 = Panel("""0
-1""")

# ----
# Randomized Cell Widths
panel_11 = Panel("1")

# ----
# Randomized Cell Widths
panel_12 = Panel("1")

# ---- group: Brick-laying Alternating Heights / Alternating Pattern / Move middle rows
alternating = Panel("""1
-1""")

# ----
# Step 6: Pack voids
# INSTRUCTIONS for packing voids: 1) Select Type of rubble
#    - Ellipses: small representations of rubble such that the pick and place
#      program can estimate the location of rubble
#    - Remaining rubble: uses the remaining rubble pieces to finish packing the
#      wall, this should only be used if there is a sufficient amount of small
#      rubble scanned and/or produced
#    - Scaled down rubble: ideal representation to be used for visual
#      representation and the structural verification check
# 
# 2) If scaled down rubble is selected, adjust the scale factor as wanted
# 
# PROTOTYPE SETTINGS:
#    Type of rubble: Scaled down rubble
#    Scale factor: 0.45
# Resulting geometries
# Options
pack_voids = LBFalseStartToggle(True)

# ----
# Step 7: Structural Verification
# INSTRUCTIONS for structural verification: 1) Push the Data Dam
# 
# 2) Decide how many divisions between the rows (2-4 is ideal)
# 
# 3) Choose which path to test
# 
# 4) Choose maximum movement as percentage of cell width (1.5 is ideal)
# 
# 5) Check if the number of fitness sliders matches the number required
#    - If it does not, double click on the Gene Pool and set the number of sliders accordingly
# 
# 6) Slide the fitness sliders until there is an ideal path which goes through the the wall (this will reduce the algorithm time)
# 
# 7) Double click on the Evolutionary Solver and set the Fitness to Minimize
# 
# 8) Run the Evolutionary Solver until the fitness is minimized to your satisfaction
# 
# 9) Check shortest path length is within the acceptable range
# 
# PROTOTYPE SETTINGS:
#    Divisions: 5
#    Shortest path to test: 4
#    Percentage of cell width: 1.50
#    Number of fitness sliders: 52
percentage_of_cell_width_that_points_can = Slider(1.5, range=1..3)  # "Percentage of cell width that points can move"
prototype_solution = Panel("""0.1
-0.12
0.14
0.23
0.19
-0.06
-0.05
-0.13
-0.22
-0.34
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""")

# ---- group: Gradient brick row heights / Big on bottom option
xz_plane = XZPlane(Origin=Point(0, 0, 0))

# ----
# Adjusting Holes for Buttresses
panel_13 = Panel("1")

gene_pool = GenePool(Decimals=2, Maximum=1, Minimum=-1, Value=[0.1, -0.12, 0.14, 0.23, 0.19, -0.06, -0.05, -0.13, -0.22, -0.34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])
galapagos = Galapagos(fitness=addition_21, gene=gene_pool)

list_length_2 = ListLength(List=gene_pool)
number_of_fitness_sliders = Panel(list_length_2)

# ----
# Rebuilding Cells in Wall
panel_14 = Panel("""0
1""")
panel_15 = Panel("""-2
-1""")

# ----
# Construct Cell Surfaces
panel_16 = Panel("-1")

# ----
# Construct Cell Surfaces
panel_17 = Panel("-1")

# ---- group: Rows sorted
# Sorting Cells by Rows
number_slider_6 = Slider(0, range=0..100)
multiplication_7 = Multiplication(A=number_2, B=Slider(2, range=0..10))
unit_x_5 = UnitX(Factor=expr("-x", multiplication_7))

# ----
# RANDOM RUBBLE GENERATOR
panel_18 = Panel("1")
stream_filter_8 = StreamFilter(ScannedOrRandomized=choose, Stream0=panel_18, Stream1=number_of_duplicates)
rectangular = Rectangular(Plane=PlaneXY(0, 0, 0), SizeX=grid_size, SizeY=grid_size, ExtentX=expr("x+1", number_of_scans), ExtentY=stream_filter_8)  # -> Cells, Points
multiplication_8 = Multiplication(A=number_of_duplicates, B=grid_size)
unit_y = UnitY(Factor=expr("-(x+100)", multiplication_8))
move_3 = Move(Geometry=rectangular.Cells, Motion=unit_y)  # -> Geometry, Transform

# ---- group: Points sorted
# Sorting Points in Cells
panel_19 = Panel("-1")
unit_y_2 = UnitY(Factor="-100")
xy_plane = XYPlane(Origin=Point(0, 0, 0))

# ----
vector = Vector(vector_2pt.Vector)

# ---- group: create random vectors
construct_domain_2 = ConstructDomain(DomainStart=lower_bound, DomainEnd=upper_bound)
list_length_3 = ListLength(List=vector)
random = Random(Range=construct_domain_2, Number=list_length_3, Seed=random_seed)
number_5 = Number(multiplication)
multiplication_9 = Multiplication(A=number_5, B=random)
amplitude_2 = Amplitude(Vector=vector, Amplitude=multiplication_9)
point_2 = Point(control_points.Points)
move_4 = Move(Geometry=point_2, Motion=amplitude_2)  # -> Geometry, Transform
stream_filter_9 = StreamFilter(ScannedOrRandomized=choose, Stream0=point_2, Stream1=move_4.Geometry)
polyline_2 = PolyLine(Vertices=stream_filter_9, Closed="true")  # -> flatten(Polyline)
convex_hull = ConvexHull(Points=move_4.Geometry, Plane=PlaneXY(0, 0, 0))  # -> Hull, HullZ, Indices

# ----
construct_domain_3 = ConstructDomain(DomainStart=lower_bound_2, DomainEnd=upper_bound_2)
tree_statistics = TreeStatistics(Tree=vector)  # -> Paths, Length, Count
random_2 = Random(Range=construct_domain_3, Number=tree_statistics.Count, Seed=random_seed_2)

# ---- group: simplify and scale
curve_3 = Curve(flatten(convex_hull.Hull))
multiplication_10 = Multiplication(A=random_2, B=scale_for_pieces)
area_2 = Area(Geometry=curve_3)  # -> Area, Centroid
scale = Scale(Geometry=curve_3, Center=area_2.Centroid, Factor=multiplication_10)  # -> flatten(Geometry), Transform
list_item_5 = ListItem(List=flatten(scale.Geometry), Index=0, Wrap=True)

# ----
scale_2 = Scale(Geometry=polyline_2, Center=area_2.Centroid, Factor=multiplication_10)  # -> flatten(Geometry), Transform

area_3 = Area(Geometry=scale.Geometry)  # -> Area, Centroid
area_4 = Area(Geometry=move_3.Geometry)  # -> Area, Centroid
flip_matrix = FlipMatrix(Data=area_4.Centroid)
vector_2pt_2 = Vector2Pt(PointA=area_3.Centroid, PointB=flatten(flip_matrix), Unitize=False)  # -> Vector, Length
move_5 = Move(Geometry=scale.Geometry, Motion=vector_2pt_2.Vector)  # -> Geometry, Transform
move_6 = Move(Geometry=scale_2.Geometry, Motion=vector_2pt_2.Vector)  # -> Geometry, Transform

area_5 = Area(Geometry=move_5.Geometry)  # -> Area, Centroid
panel_20 = Panel(area_5.Area)
scale_3 = Scale(Geometry=flatten(move_5.Geometry), Center=area_5.Centroid, Factor="50")  # -> Geometry, Transform
scale_4 = Scale(Geometry=flatten(move_6.Geometry), Center=area_5.Centroid, Factor="50")  # -> Geometry, Transform

boundary_curve = Curve(scale_3.Geometry)

# ---- group: OUTPUT / Boundary Curves
# OUTPUT FROM RANDOM RUBBLE GENERATOR
boundary_curve_2 = Curve(scale_3.Geometry)

# ---- group: OUTPUT / Actual Curves
boundary_curve_3 = Curve(scale_4.Geometry)

# ----
# Sorting
grouping = Python3Script(curves=boundary_curve_2, sort=sort_rubble)  # -> out, a, flatten(min_max_dimensions); inputs curves: list
# ---------- grouping: Python ----------
import  rhinoscriptsyntax as rs
import scriptcontext as sc

def calculate_area(curve):
    #curve = rs.coercecurve(curve)
    if curve:
        area_result = rs.CurveArea(curve)
        return area_result[0] if area_result else 0
    return 0



def calculate_aspect_ratio(curve):
    """Calculate the aspect ratio of the curve after aligning the longest segment to the x-axis."""
    # Calculate aspect ratio using the bounding box of the oriented curve
    bounding_box = rs.BoundingBox(oriented_curve)
    if bounding_box:
        width = rs.Distance(bounding_box[0], bounding_box[1])
        height = rs.Distance(bounding_box[0], bounding_box[3])
        return width / height if height != 0 else width
    
    return 1  # Return a default aspect ratio if no bounding box exists

def calculate_max_seg(curve):
    """Calculate the aspect ratio of the curve after aligning the longest segment to the x-axis."""
    max_length = -1
    max_seg = None
    
    # Explode the curve and find the longest segment
    exploded_curves = rs.ExplodeCurves(curve)
    for seg in exploded_curves:
        seg_length = rs.CurveLength(seg)
        if seg_length > max_length:
            max_length = seg_length
            max_seg = seg
    return max_seg

if sort:
    # [area, aspect ratio, min angle, sides]


    matrix_list = []
    curve_matrix_list = []
    xsmall = []
    small = []
    medium = []
    large = []


    sorted_curves = sorted(curves, key=calculate_area)
    # Get the minimum and maximum area values
    min_area = calculate_area(sorted_curves[0])   # First item after sorting has the smallest area
    max_area = calculate_area(sorted_curves[-1])  # Last item has the largest area


    for find in range (0, len(sorted_curves)):

        curve = sorted_curves[find]


    for find in range (0, len(sorted_curves)):

        curve = sorted_curves[find]
    
        curve_area = rs.CurveArea(curve)[0]

        maximum_segment = calculate_max_seg(curve)

        seg_length = rs.CurveLength(maximum_segment)

        # Define orientation target points on the x-axis
        start_point = rs.CurveStartPoint(maximum_segment)
        end_point = rs.CurveEndPoint(maximum_segment)
        x_axis_points_1 = [0, 0, 0]
        x_axis_points_2 = [1, 0, 0]  # Target alignment points along the x-axis

        # Orient the curve copy so its longest segment aligns with the x-axis

        oriented_curve = rs.OrientObject(sc.doc.Objects.AddCurve(curve), [start_point, end_point], [x_axis_points_1, x_axis_points_2])
        aspect_ratio = calculate_aspect_ratio(oriented_curve)

        if curve_area <= 0.25 * max_area:
            xsmall.append([curve_area, curve, aspect_ratio, seg_length, rs.coercecurve(maximum_segment), find])
            

        elif 0.25 * max_area < curve_area <= 0.5 * max_area:
            small.append([curve_area, curve, aspect_ratio, seg_length, rs.coercecurve(maximum_segment), find])
            
        elif 0.5 * max_area < curve_area <= 0.75 * max_area:
            medium.append([curve_area, curve, aspect_ratio, seg_length, rs.coercecurve(maximum_segment), find])
        
        else:
            large.append([curve_area, curve, aspect_ratio, seg_length, rs.coercecurve(maximum_segment),find])
        

    sorted_xsmall_curves = sorted(xsmall, key=lambda x:x[3])
    #print(sorted_xsmall_curves)
    sorted_small_curves = sorted(small, key=lambda x:x[3])
    #print(sorted_small_curves)
    sorted_medium_curves = sorted(medium, key=lambda x:x[3])
    #print(sorted_medium_curves)
    sorted_large_curves = sorted(large, key=lambda x:x[3])
    #print(sorted_large_curves)

    final_matrix = [sorted_xsmall_curves, sorted_small_curves, sorted_medium_curves, sorted_large_curves]
    #print(final_matrix)
    a = final_matrix
    #print(sorted_xsmall_curves)

    curves_list = []
    for cur in range(0, len(final_matrix)):
        for i in range (0, len(final_matrix[cur])):
            curves_list.append(final_matrix[cur][i][1])

    sorted_curves_2 = sorted(curves_list, key=calculate_area)

    curves_list = []
    for cur in range(0, len(final_matrix)):
        for i in range (0, len(final_matrix[cur])):
            curves_list.append(final_matrix[cur][i][1])


    bounding_box_min = rs.BoundingBox(curves_list[0])
    bounding_box_max = rs.BoundingBox(curves_list[-1])

    min_width = rs.Distance(bounding_box_min[0], bounding_box_min[1])
    min_height = rs.Distance(bounding_box_min[0], bounding_box_min[3])
    max_width = rs.Distance(bounding_box_max[0], bounding_box_max[1])
    max_height = rs.Distance(bounding_box_max[0], bounding_box_max[3])

    b = [min_width, min_height, max_width, max_height]

    print(b)

    min_max_dimensions = b
# ---------- end grouping ----------

# ----
# Rubble Dimensions
panel_21 = Panel("0")
list_item_6 = ListItem(List=grouping.min_max_dimensions, Index=panel_21, Wrap=True)
list_item_7 = ListItem(List=grouping.min_max_dimensions, Index="1", Wrap=True)
list_item_8 = ListItem(List=grouping.min_max_dimensions, Index="2", Wrap=True)
list_item_9 = ListItem(List=grouping.min_max_dimensions, Index="3", Wrap=True)
min_width = Panel(list_item_6)
min_height = Panel(list_item_7)
max_width = Panel(list_item_8)
max_height = Panel(list_item_9)

# ----
# Rubble Geometry
max_width_2 = Panel(max_width)
min_height_2 = Panel(min_height)
max_height_2 = Panel(max_height)
# Resulting Geometry and Data
min_width_2 = Panel(min_width)

division_4 = Division(A=max_width_2, B=panel_6)
division_5 = Division(A=min_width_2, B=panel_6)
division_6 = Division(A=stream_filter_6, B=min_height_2)
division_7 = Division(A=stream_filter_6, B=max_height_2)
division_8 = Division(A=stream_filter_7, B=division_5)
division_9 = Division(A=stream_filter_7, B=division_4)
round_2 = Round(Number=division_6)  # -> Nearest, Floor, Ceiling
round_3 = Round(Number=division_7)  # -> Nearest, Floor, Ceiling
round_4 = Round(Number=division_9)  # -> Nearest, Floor, Ceiling
round_5 = Round(Number=division_8)  # -> Nearest, Floor, Ceiling
merge_5 = Merge(Data1=round_3.Ceiling, Data2=divisions_in_y, Data3=round_2.Floor)
merge_6 = Merge(Data1=round_4.Ceiling, Data2=divisions_in_x, Data3=round_5.Floor)
pick_middle_2 = Panel(merge_5)
pick_middle_3 = Panel(merge_6)
sort_list_4 = SortList(Keys=pick_middle_2)  # -> Keys, ValuesValuesA
sort_list_5 = SortList(Keys=pick_middle_3)  # -> Keys, ValuesValuesA
list_item_10 = ListItem(List=sort_list_4.Keys, Index="1", Wrap=True)
list_item_11 = ListItem(List=sort_list_5.Keys, Index="1", Wrap=True)

stream_filter_10 = StreamFilter(UseThisLimit=boolean_toggle, Stream0=divisions_in_x, Stream1=list_item_11)
stream_filter_11 = StreamFilter(UseThisLimit=Toggle(True), Stream0=divisions_in_y, Stream1=list_item_10)

division_10 = Division(A=stream_filter_7, B=stream_filter_10)
multiplication_11 = Multiplication(A=division_10, B="2")
multiplication_12 = Multiplication(A=multiplication_11, B=Slider(0.75, range=0.5..0.75))
division_11 = Division(A=stream_filter_6, B=multiplication_12)
round_6 = Round(Number=division_11)  # -> Nearest, Floor, Ceiling
merge_7 = Merge(Data1=stream_filter_11, Data2=round_6.Ceiling)
pick_maximum_2 = Panel(merge_7)
sort_list_6 = SortList(Keys=pick_maximum_2)  # -> Keys, ValuesValuesA
list_item_12 = ListItem(List=sort_list_6.Keys, Index="1", Wrap=True)

stream_filter_12 = StreamFilter(UseThisLimit=Toggle(True), Stream0=stream_filter_11, Stream1=list_item_12)

# ---- group: Gradient brick row heights / Gradient
number_6 = Number(stream_filter_12)
number_of_rows = Panel(number_6)
construct_domain_4 = ConstructDomain(DomainStart="1", DomainEnd=expr("x-1", number_6))
range = Range(Domain=construct_domain_4, Steps=number_6)
expression = Expression(a=gradient_scale_a, x=range, Expression="a^x")
list_item_13 = ListItem(List=expression, Index="-1", Wrap=True)
list_item_14 = ListItem(List=expression, Index=0, Wrap=True)
construct_domain_5 = ConstructDomain(DomainStart=list_item_14, DomainEnd=list_item_13)
remap_numbers = RemapNumbers(Value=expression, Source=construct_domain_5, Target=Domain(0, 1))  # -> Mapped, Clipped

# ---- group: Defining Grid (continued)
division_12 = Division(A=stream_filter_7, B=stream_filter_10)
division_13 = Division(A=stream_filter_6, B=stream_filter_12)
number_7 = Number(stream_filter_12)
multiplication_13 = Multiplication(A=division_13, B=number_7)
multiplication_14 = Multiplication(A=division_12, B=number_4)
rectangle = Rectangle(Plane=PlaneXY(0, 0, 0), XSize=multiplication_14, YSize=multiplication_13, Radius=0)  # -> Rectangle, Length
rectangular_2 = Rectangular(Plane=PlaneXY(0, 0, 0), SizeX=division_12, SizeY=division_13, ExtentX=number_4, ExtentY=number_7)  # -> Cells, Points

# ---- group: Construct Buttress Outlines (continued)
deconstuct_rectangle = DeconstuctRectangle(Rectangle=rectangle.Rectangle)  # -> BasePlane, XInterval, YInterval
deconstruct_domain = DeconstructDomain(Domain=deconstuct_rectangle.YInterval)  # -> Start, End
deconstruct_domain_2 = DeconstructDomain(Domain=deconstuct_rectangle.XInterval)  # -> Start, End
construct_point = ConstructPoint(XCoordinate=deconstruct_domain_2.Start, YCoordinate=deconstruct_domain.End, ZCoordinate=0)
# Buttress Geometry
construct_point_2 = ConstructPoint(XCoordinate=deconstruct_domain_2.Start, YCoordinate=deconstruct_domain.Start, ZCoordinate=0)
construct_point_3 = ConstructPoint(XCoordinate=expr("x/2", deconstruct_domain_2.End), YCoordinate=deconstruct_domain.Start, ZCoordinate=0)
yz_plane = YZPlane(Origin=construct_point_3)
rectangle_2 = Rectangle(Plane=PlaneXY(0, 0, 0), XSize=number, YSize=deconstruct_domain.End, Radius=0)  # -> Rectangle, Length
move_7 = Move(Geometry=construct_point_2, Motion=unit_x_2)  # -> Geometry, Transform
move_8 = Move(Geometry=construct_point, Motion=unit_x_3)  # -> Geometry, Transform
move_9 = Move(Geometry=rectangle_2.Rectangle, Motion=unit_x_4)  # -> Geometry, Transform
merge_8 = Merge(Data1=construct_point_2, Data2=construct_point, Data3=move_8.Geometry, Data4=move_7.Geometry)
polyline_3 = PolyLine(Vertices=merge_8, Closed=Toggle(True))
mirror = Mirror(Geometry=move_9.Geometry, Plane=yz_plane)  # -> Geometry, Transform
mirror_2 = Mirror(Geometry=polyline_3, Plane=yz_plane)  # -> Geometry, Transform

# ----
number_8 = Number(division_13)
multiplication_15 = Multiplication(A=number_8, B=factor_for_max_y)

number_9 = Number(division_13)
multiplication_16 = Multiplication(A=number_9, B=factor_for_max_y_2)

# ---- group: Relay (continued)
number_10 = Number(division_12)

# ----
number_11 = Number(division_12)
multiplication_17 = Multiplication(A=number_11, B=Slider(2, range=0..10))
subtraction_7 = Subtraction(A=multiplication_17, B=subtraction_5)
division_14 = Division(A=subtraction_7, B="2")
addition_5 = Addition(A=number_11, B=division_14)
addition_6 = Addition(A=number_3, B=division_14)
unit_x_6 = UnitX(Factor=addition_6)
unit_x_7 = UnitX(Factor=subtraction_7)
unit_x_8 = UnitX(Factor=multiplication_17)
unit_x_9 = UnitX(Factor=addition_5)

multiplication_18 = Multiplication(A=number_10, B=number_slider_4)
subtraction_8 = Subtraction(A=multiplication_18, B=subtraction_4)
division_15 = Division(A=subtraction_8, B="2")
addition_7 = Addition(A=number_10, B=division_15)
addition_8 = Addition(A=number_2, B=division_15)
unit_x_10 = UnitX(Factor=expr("-x", addition_8))
unit_x_11 = UnitX(Factor=expr("-x", subtraction_8))
unit_x_12 = UnitX(Factor=expr("-x", multiplication_18))
unit_x_13 = UnitX(Factor=expr("-x", addition_7))

# ----
# Tessellation Options
point_3 = Point(flatten(rectangular_2.Points))
sort_points = SortPoints(Points=point_3)  # -> Points, Indices
stream_filter_13 = StreamFilter(
    Gate=pattern_type,
    Stream0=flatten(sort_points.Points),
    Stream1=flatten(sort_points.Points),
    Stream2=flatten(sort_points.Points),
    Stream3=flatten(sort_points.Points))

# ----
# Determine Ideal Shortest Path
number_slider_7 = Slider(0.5, range=0.25..0.5)
number_of_rows_2 = Panel(number_7)
height = Panel(division_13)
width = Panel(division_12)
merge_9 = Merge(Data1=Slider(0.25, range=0.25..0.5), Data2=number_slider_7)
subtraction_9 = Subtraction(A=number_of_rows_2, B="1")
multiplication_19 = Multiplication(A=width, B=merge_9)
multiplication_20 = Multiplication(A=number_of_rows_2, B=height)
multiplication_21 = Multiplication(A=subtraction_9, B=multiplication_19)
addition_9 = Addition(A=multiplication_20, B=multiplication_21)
shortest_path_ideal_zone = Panel(addition_9)

list_length_4 = ListLength(List=boundary_curve)
rubble_count = Panel(list_length_4)
multiplication_22 = Multiplication(A=Slider(0.33, range=0..0.33), B=rubble_count)
multiplication_23 = Multiplication(A=min_height_2, B=subtraction_2)
multiplication_24 = Multiplication(A=max_height_2, B=addition_3)
multiplication_25 = Multiplication(A=min_width_2, B=subtraction_3)
multiplication_26 = Multiplication(A=max_width_2, B=addition_4)
construct_domain_6 = ConstructDomain(DomainStart=multiplication_23, DomainEnd=multiplication_24)
construct_domain_7 = ConstructDomain(DomainStart=multiplication_25, DomainEnd=multiplication_26)

number_12 = Number(multiplication_14)
addition_10 = Addition(A=number_12, B=maximum_2)
merge_10 = Merge(Data1=number_12, Data2=addition_10)

# ----
# Vertical Lines
subtraction_10 = Subtraction(A=number_12, B=number_3)
construct_domain_8 = ConstructDomain(DomainStart=expr("x-5", subtraction_10), DomainEnd=expr("x+5", subtraction_10))
construct_domain_9 = ConstructDomain(DomainStart=expr("x-5", number_12), DomainEnd=expr("x+5", number_12))
range_2 = Range(Domain=construct_domain_8, Steps=10)
range_3 = Range(Domain=construct_domain_9, Steps=10)
division_16 = Division(A=maximum_2, B=multiplication_17)
round_7 = Round(Number=division_16)  # -> Nearest, Floor, Ceiling

# ---- group: Randomize cell widths
multiplication_27 = Multiplication(A=max_percentage_of_cell_width, B=division_12)
construct_domain_10 = ConstructDomain(DomainStart=expr("-x", multiplication_27), DomainEnd=multiplication_27)

# ----
# Compare Cell and Rubble Count
rubble_count_2 = Panel(list_length_4)

# ---- group: Constructing regions
# Normal Brick Laying
partition_list = PartitionList(List=stream_filter_13, Size=expr("x+1", number_7))
flip_matrix_2 = FlipMatrix(Data=partition_list)
polyline_4 = PolyLine(Vertices=flip_matrix_2, Closed=False)
polyline_5 = PolyLine(Vertices=partition_list, Closed=False)
surface = Surface(rectangle.Rectangle)

# ---- group: Randomize cell widths (continued)
point_4 = Point(partition_list)
tree_statistics_2 = TreeStatistics(Tree=point_4)  # -> Paths, Length, Count
subtraction_11 = Subtraction(A=tree_statistics_2.Count, B=multiplication_6)
merge_11 = Merge(Data1=flatten(number_slider), Data2=flatten(subtraction_11), Data3=flatten(number_slider))  # -> flatten(Result)
partition_list_2 = PartitionList(List=tree_statistics_2.Paths, Size=merge_11)
number_13 = Number(number_7)

tree_statistics_3 = TreeStatistics(Tree=partition_list_2)  # -> Paths, Length, Count
list_item_15 = ListItem(List=tree_statistics_3.Paths, Index=Slider(1, range=0..2), Wrap=True)
tree_branch = TreeBranch(Tree=partition_list_2, Path=list_item_15, MaintainPaths=True)
tree_branch_2 = TreeBranch(Tree=point_4, Path=tree_branch, MaintainPaths=True)
shift_list = ShiftList(List=tree_branch_2, Shift=1, Wrap=Toggle(False))
cull_index = CullIndex(List=tree_branch_2, Indices="-1", Wrap=True)
line_2 = Line(StartPoint=cull_index, EndPoint=shift_list)  # -> flatten(Line)

tree_statistics_4 = TreeStatistics(Tree=partition_list_2)  # -> Paths, Length, Count
list_item_16 = ListItem(List=tree_statistics_4.Paths, Index=Slider(2, range=0..2), Wrap=True)
tree_branch_3 = TreeBranch(Tree=partition_list_2, Path=list_item_16, MaintainPaths=True)
tree_branch_4 = TreeBranch(Tree=point_4, Path=tree_branch_3, MaintainPaths=True)
shift_list_2 = ShiftList(List=tree_branch_4, Shift=1, Wrap=Toggle(False))
cull_index_2 = CullIndex(List=tree_branch_4, Indices="-1", Wrap=True)
line_3 = Line(StartPoint=cull_index_2, EndPoint=shift_list_2)  # -> flatten(Line)

tree_statistics_5 = TreeStatistics(Tree=partition_list_2)  # -> Paths, Length, Count
list_item_17 = ListItem(List=tree_statistics_5.Paths, Index=Slider(0, range=0..2), Wrap=True)
tree_branch_5 = TreeBranch(Tree=partition_list_2, Path=list_item_17, MaintainPaths=True)
tree_branch_6 = TreeBranch(Tree=point_4, Path=tree_branch_5, MaintainPaths=True)
cull_index_3 = CullIndex(List=tree_branch_6, Indices="-1", Wrap=True)
shift_list_3 = ShiftList(List=tree_branch_6, Shift=1, Wrap=Toggle(False))
line_4 = Line(StartPoint=cull_index_3, EndPoint=shift_list_3)  # -> flatten(Line)

list_length_5 = ListLength(List=flatten(line_2))
random_3 = Random(Range=construct_domain_10, Number=list_length_5, Seed=random_seed_3)
unit_x_14 = UnitX(Factor=random_3)
move_10 = Move(Geometry=line_2, Motion=unit_x_14)  # -> Geometry, Transform

merge_12 = Merge(Data1=flatten(line_4), Data2=flatten(move_10.Geometry), Data3=flatten(line_3))
partition_list_3 = PartitionList(List=merge_12, Size=number_13)

# ---- group: Constructing regions (continued)
merge_13 = Merge(Data1=flatten(merge_12), Data2=flatten(polyline_4))  # -> flatten(Result)
surface_split = SurfaceSplit(Surface=surface, Curves=flatten(merge_13))

# ---- group: Brick laying pattern
explode = Explode(Curve=polyline_5, Recursive=True)  # -> Segments, Vertices
python_3_script_2 = Python3Script(dim_x=number_4, dim_y=number_7)  # -> out, dispatch; inputs dim_x: Int32, dim_y: Int32
# ---------- python_3_script_2: Python ----------
import ghpythonlib.treehelpers as th

dim_x = dim_x + 1
dim_y = dim_y + 1


dispatch = []

for i in range(dim_x):
    row = []
    for j in range(dim_y):
        if i % 2 == 0:
            row.append(0 + j % 2)
        else:
            row.append(1 - j % 2)
    dispatch.append(row)

dispatch = th.list_to_tree(dispatch, source=[0,0])
# ---------- end python_3_script_2 ----------
stream_filter_14 = StreamFilter(Gate=cell_widths, Stream0=explode.Segments, Stream1=partition_list_3)
dispatch = Dispatch(List=stream_filter_14, DispatchPattern=python_3_script_2.dispatch)  # -> ListA, ListB
line_5 = Line(dispatch.ListA)
merge_14 = Merge(Data1=flatten(line_5), Data2=flatten(polyline_4), Data3=rectangle.Rectangle)  # -> flatten(Result)
surface_split_2 = SurfaceSplit(Surface=surface, Curves=flatten(merge_14))
network_regions = NetworkRegions(Curves=merge_14)

# ---- group: Sort by row
curve_4 = Curve(network_regions)
area_6 = Area(Geometry=curve_4)  # -> Area, Centroid
deconstruct = Deconstruct(Point=area_6.Centroid)  # -> XComponent, YComponent, ZComponent
multiplication_28 = Multiplication(A=deconstruct.YComponent, B="10000")
addition_11 = Addition(A=deconstruct.XComponent, B=multiplication_28)
sort_list_7 = SortList(Keys=addition_11, ValuesValuesA=curve_4)  # -> Keys, ValuesValuesA
curve_5 = Curve(sort_list_7.ValuesValuesA)

# ---- group: Brick-laying Alternating Heights / deconstruct into points
# Alternating Heights
curve_6 = Curve(curve_5)
explode_2 = Explode(Curve=curve_6, Recursive=True)  # -> Segments, Vertices
sort_duplicate_points = SortDuplicatePoints(Points=flatten(explode_2.Vertices))  # -> UniquePoints, Indices

# ---- group: Brick-laying Alternating Heights / Sort by y-components
deconstruct_2 = Deconstruct(Point=sort_duplicate_points.UniquePoints)  # -> XComponent, YComponent, ZComponent
tree_statistics_6 = TreeStatistics(Tree=sort_duplicate_points.Indices)  # -> Paths, Length, Count
multiplication_29 = Multiplication(A=deconstruct_2.YComponent, B="10000")
addition_12 = Addition(A=deconstruct_2.XComponent, B=multiplication_29)
sort_list_8 = SortList(
    Keys=addition_12,
    ValuesUniquePoints=sort_duplicate_points.UniquePoints,
    ValuesAmountOfPoints=tree_statistics_6.Length,
    ValuesOriginalPathsForIndices=tree_statistics_6.Paths)  # -> Keys, ValuesUniquePoints, ValuesAmountOfPoints, ValuesOriginalPathsForIndices
deconstruct_3 = Deconstruct(Point=sort_list_8.ValuesUniquePoints)  # -> XComponent, YComponent, ZComponent
round_8 = Round(Number=expr("x/50", deconstruct_3.YComponent))  # -> Nearest, Floor, Ceiling
sort_duplicate_values = SortDuplicateValues(ValueList=round_8.Ceiling)  # -> UniqueYValues, PointIndices
tree_statistics_7 = TreeStatistics(Tree=sort_duplicate_values.PointIndices)  # -> Paths, Length, Count
sort_list_9 = SortList(Keys=sort_duplicate_values.UniqueYValues, ValuesValuesA=tree_statistics_7.Paths)  # -> Keys, ValuesValuesA
tree_branch_7 = TreeBranch(Tree=sort_duplicate_values.PointIndices, Path=sort_list_9.ValuesValuesA, MaintainPaths=False)
tree_statistics_8 = TreeStatistics(Tree=tree_branch_7)  # -> Paths, Length, Count

# ---- group: Brick-laying Alternating Heights / Sort by y-components / restructure tree containing original indices
tree_branch_8 = TreeBranch(Tree=sort_duplicate_points.Indices, Path=sort_list_8.ValuesOriginalPathsForIndices, MaintainPaths=False)

# ---- group: Brick-laying Alternating Heights / Sort by y-components / Unique points split by rows in Y-direction
partition_list_4 = PartitionList(List=sort_list_8.ValuesUniquePoints, Size=tree_statistics_8.Length)

# ---- group: Brick-laying Alternating Heights / Alternating Pattern / Remove top and bottom edge (continued)
flip_matrix_3 = FlipMatrix(Data=partition_list_4)
cull_index_4 = CullIndex(List=flip_matrix_3, Indices=panel_10, Wrap=True)
flip_matrix_4 = FlipMatrix(Data=cull_index_4)

# ---- group: Gradient brick row heights / Merge with top and bottom edges
list_item_18 = ListItem(List=flip_matrix_3, Index="0", Wrap=True)
list_item_19 = ListItem(List=flip_matrix_3, Index="-1", Wrap=True)

# ---- group: Gradient brick row heights / Points list divided by rows
point_5 = Point(list_item_18)
point_6 = Point(flip_matrix_4)
point_7 = Point(list_item_19)
clean_tree = CleanTree(RemoveNulls=True, RemoveInvalid=True, RemoveEmpty=False, Tree=point_5)
clean_tree_2 = CleanTree(RemoveNulls=True, RemoveInvalid=True, RemoveEmpty=False, Tree=point_6)
clean_tree_3 = CleanTree(RemoveNulls=True, RemoveInvalid=True, RemoveEmpty=False, Tree=point_7)
tree_statistics_9 = TreeStatistics(Tree=flatten(clean_tree))  # -> Paths, Length, Count
tree_statistics_10 = TreeStatistics(Tree=flatten(clean_tree_3))  # -> Paths, Length, Count
tree_statistics_11 = TreeStatistics(Tree=clean_tree_2)  # -> Paths, Length, Count
merge_15 = Merge(Data1=flatten(clean_tree), Data2=flatten(clean_tree_2), Data3=flatten(clean_tree_3))
merge_16 = Merge(
    Data1=flatten(tree_statistics_9.Length),
    Data2=flatten(tree_statistics_11.Length),
    Data3=flatten(tree_statistics_10.Length))
partition_list_5 = PartitionList(List=merge_15, Size=merge_16)

# ---- group: Brick-laying Alternating Heights / Alternating Pattern / Move middle rows (continued)
list_length_6 = ListLength(List=cull_index_4)  # -> flatten(Length)
list_item_20 = ListItem(List=list_length_6, Index=0, Wrap=True)
duplicate_data_3 = DuplicateData(Data=multiplication_16, Number=list_item_20, Order=True)
repeat_data = RepeatData(Data=alternating, Length=list_item_20)
multiplication_30 = Multiplication(A=duplicate_data_3, B=repeat_data)
unit_y_3 = UnitY(Factor=multiplication_30)
move_11 = Move(Geometry=flip_matrix_4, Motion=graft(unit_y_3))  # -> Geometry, Transform

# ---- group: Randomized heights
# Randomized Heights
point_8 = Point(flip_matrix_4)
tree_statistics_12 = TreeStatistics(Tree=point_8)  # -> Paths, Length, Count
python_3_script_3 = Python3Script(n=tree_statistics_12.Count, max_y=multiplication_15, dom_y=construct_domain, r_seed=random_seed_4)  # -> out, x_comp, y_comp; inputs r_seed: Int32
# ---------- python_3_script_3: Python ----------
import numpy as np

# construct random vectors to move points

# n         = amount of vectors
# max_x     = maximum movement in x
# max_y     = maximum movement in y
# dom_x     = domain of factors for x
# dom_y     = domain of factors for y
# r_seed    = random seed

np.random.seed(r_seed)

i = 0
#x_comp = []
y_comp = []
for i in range(n):
#    a = round(np.random.uniform(dom_x[0], dom_x[1]), 3)
    b = round(np.random.uniform(dom_y[0], dom_y[1]), 3)
#    x_comp.append(a*max_x)
    y_comp.append(b*max_y)
    i =+ 1
#print(x_comp)
print(y_comp)
# ---------- end python_3_script_3 ----------
unit_y_4 = UnitY(Factor=python_3_script_3.y_comp)
move_12 = Move(Geometry=point_8, Motion=graft(unit_y_4))  # -> Geometry, Transform

# ---- group: Randomized heights / Merge with top and bottom edges
list_item_21 = ListItem(List=flip_matrix_3, Index="0", Wrap=True)
list_item_22 = ListItem(List=flip_matrix_3, Index="-1", Wrap=True)
merge_17 = Merge(Data1=flatten(list_item_21), Data2=flatten(move_12.Geometry), Data3=flatten(list_item_22))
clean_tree_4 = CleanTree(RemoveNulls=True, RemoveInvalid=True, RemoveEmpty=False, Tree=merge_17)

# ---- group: Brick-laying Alternating Heights / Alternating Pattern / Merge with top and bottom edges
list_item_23 = ListItem(List=flip_matrix_3, Index="0", Wrap=True)
list_item_24 = ListItem(List=flip_matrix_3, Index="-1", Wrap=True)
merge_18 = Merge(Data1=flatten(list_item_23), Data2=flatten(move_11.Geometry), Data3=flatten(list_item_24))
clean_tree_5 = CleanTree(RemoveNulls=True, RemoveInvalid=True, RemoveEmpty=False, Tree=merge_18)

# ---- group: Randomized heights / Constructing Regions
duplicate_data_4 = DuplicateData(Data=graft(clean_tree_4), Number=graft(sort_list_8.ValuesAmountOfPoints), Order=True)
replace_items = ReplaceItems(List=flatten(explode_2.Vertices), Item=flatten(duplicate_data_4), Indices=flatten(tree_branch_8), Wrap=False)
list_length_7 = ListLength(List=explode_2.Vertices)
partition_list_6 = PartitionList(List=replace_items, Size=flatten(list_length_7))
polyline_6 = PolyLine(Vertices=partition_list_6, Closed=False)
curve_7 = Curve(polyline_6)

# ---- group: Brick-laying Alternating Heights / Constructing Regions
duplicate_data_5 = DuplicateData(Data=graft(clean_tree_5), Number=graft(sort_list_8.ValuesAmountOfPoints), Order=True)
replace_items_2 = ReplaceItems(List=flatten(explode_2.Vertices), Item=flatten(duplicate_data_5), Indices=flatten(tree_branch_8), Wrap=False)
list_length_8 = ListLength(List=explode_2.Vertices)
partition_list_7 = PartitionList(List=replace_items_2, Size=flatten(list_length_8))
polyline_7 = PolyLine(Vertices=partition_list_7, Closed=False)
curve_8 = Curve(polyline_7)

# ----
division_17 = Division(A=maximum_2, B=multiplication_18)
round_9 = Round(Number=division_17)  # -> Nearest, Floor, Ceiling

# ----
# Main Wall Cells
wall_height_mm = Panel(multiplication_13)
wall_width_mm = Panel(multiplication_14)

# ---- group: Gradient brick row heights / New y-values
deconstruct_4 = Deconstruct(Point=partition_list_5)  # -> XComponent, YComponent, ZComponent
tree_statistics_13 = TreeStatistics(Tree=partition_list_5)  # -> Paths, Length, Count
list_item_25 = ListItem(List=flatten(deconstruct_4.YComponent), Index="-1", Wrap=True)
wall_height_mm_2 = Panel(list_item_25)

# ---- group: Gradient brick row heights
# Gradient Heights
simplify_tree = SimplifyTree(Tree=remap_numbers.Mapped, Front=False)
simplify_tree_2 = SimplifyTree(Tree=tree_statistics_13.Length, Front=False)

# ---- group: Gradient brick row heights / New y-values (continued)
duplicate_data_6 = DuplicateData(Data=graft(simplify_tree), Number=graft(simplify_tree_2), Order=True)
multiplication_31 = Multiplication(A=duplicate_data_6, B=wall_height_mm_2)
construct_point_4 = ConstructPoint(XCoordinate=deconstruct_4.XComponent, YCoordinate=multiplication_31, ZCoordinate=0)  # -> flatten(Point)

# ---- group: Gradient brick row heights / Big on bottom option (continued)
mirror_3 = Mirror(Geometry=construct_point_4, Plane=xz_plane)  # -> Geometry, Transform
unit_y_5 = UnitY(Factor=wall_height_mm_2)
move_13 = Move(Geometry=mirror_3.Geometry, Motion=unit_y_5)  # -> Geometry, Transform
stream_filter_15 = StreamFilter(Gate=gradient_direction, Stream0=construct_point_4, Stream1=move_13.Geometry)

# ---- group: Gradient brick row heights / Constructing Regions
duplicate_data_7 = DuplicateData(Data=graft(stream_filter_15), Number=graft(sort_list_8.ValuesAmountOfPoints), Order=True)
replace_items_3 = ReplaceItems(List=flatten(explode_2.Vertices), Item=flatten(duplicate_data_7), Indices=flatten(tree_branch_8), Wrap=False)
list_length_9 = ListLength(List=explode_2.Vertices)
partition_list_8 = PartitionList(List=replace_items_3, Size=flatten(list_length_9))
polyline_8 = PolyLine(Vertices=partition_list_8, Closed=False)
curve_9 = Curve(flatten(polyline_8))

# ---- group: OUTPUT
# OUTPUT CURVES
# (UNORGANIZED)
curve_10 = Curve(curve_5)
curve_11 = Curve(curve_7)
curve_12 = Curve(curve_8)
curve_13 = Curve(curve_9)
stream_filter_16 = StreamFilter(
    Gate=pattern_type,
    Stream0=flatten(curve_10),
    Stream1=flatten(curve_11),
    Stream2=flatten(curve_12),
    Stream3=flatten(curve_13))
boundary_surfaces_2 = BoundarySurfaces(Edges=stream_filter_16)

# ---- group: Rows sorted (continued)
# Preparing Geometry for Packing
surface_2 = Surface(boundary_surfaces_2)
area_7 = Area(Geometry=flatten(surface_2))  # -> Area, Centroid
deconstruct_5 = Deconstruct(Point=area_7.Centroid)  # -> XComponent, YComponent, ZComponent
round_10 = Round(Number=expr("x/50", deconstruct_5.YComponent))  # -> Nearest, Floor, Ceiling
multiplication_32 = Multiplication(A=deconstruct_5.YComponent, B=panel_7)
sort_duplicate_values_2 = SortDuplicateValues(ValueList=round_10.Ceiling)  # -> UniqueYValues, PointIndices
addition_13 = Addition(A=deconstruct_5.XComponent, B=multiplication_32)
sort_list_10 = SortList(Keys=addition_13, ValuesValuesA=flatten(surface_2))  # -> Keys, ValuesValuesA
tree_statistics_14 = TreeStatistics(Tree=sort_duplicate_values_2.PointIndices)  # -> Paths, Length, Count
sort_list_11 = SortList(Keys=sort_duplicate_values_2.UniqueYValues, ValuesValuesA=tree_statistics_14.Paths)  # -> Keys, ValuesValuesA
tree_branch_9 = TreeBranch(Tree=sort_duplicate_values_2.PointIndices, Path=sort_list_11.ValuesValuesA, MaintainPaths=False)
tree_statistics_15 = TreeStatistics(Tree=tree_branch_9)  # -> Paths, Length, Count
partition_list_9 = PartitionList(List=sort_list_10.ValuesValuesA, Size=tree_statistics_15.Length)

# ----
# Adjusting Wall for Buttress Geometry
curve_14 = Curve(partition_list_9)
list_item_26 = ListItem(List=curve_14, Index=0, Wrap=True)
list_item_27 = ListItem(List=curve_14, Index=panel_8, Wrap=True)
deconstruct_brep = DeconstructBrep(Brep=list_item_26)  # -> Faces, Edges, Vertices
deconstruct_brep_2 = DeconstructBrep(Brep=list_item_27)  # -> Faces, Edges, Vertices
deconstruct_6 = Deconstruct(Point=deconstruct_brep.Vertices)  # -> XComponent, YComponent, ZComponent
deconstruct_7 = Deconstruct(Point=deconstruct_brep_2.Vertices)  # -> XComponent, YComponent, ZComponent
sort_duplicate_values_3 = SortDuplicateValues(ValueList=deconstruct_6.YComponent)  # -> UniqueValues, Indices
sort_duplicate_values_4 = SortDuplicateValues(ValueList=deconstruct_6.XComponent)  # -> UniqueValues, Indices
sort_duplicate_values_5 = SortDuplicateValues(ValueList=deconstruct_7.XComponent)  # -> UniqueValues, Indices
list_item_28 = ListItem(List=sort_duplicate_values_3.UniqueValues, Index=0, Wrap=True)
list_item_29 = ListItem(List=sort_duplicate_values_3.UniqueValues, Index="1", Wrap=True)
list_item_30 = ListItem(List=sort_duplicate_values_4.UniqueValues, Index=0, Wrap=True)
list_item_31 = ListItem(List=sort_duplicate_values_4.UniqueValues, Index="-1", Wrap=True)
list_item_32 = ListItem(List=sort_duplicate_values_5.UniqueValues, Index=0, Wrap=True)
list_item_33 = ListItem(List=sort_duplicate_values_5.UniqueValues, Index="-1", Wrap=True)
subtraction_12 = Subtraction(A=list_item_28, B=list_item_29)
subtraction_13 = Subtraction(A=list_item_30, B=list_item_31)
subtraction_14 = Subtraction(A=list_item_32, B=list_item_33)
absolute = Absolute(Value=subtraction_12)
absolute_2 = Absolute(Value=subtraction_13)
absolute_3 = Absolute(Value=subtraction_14)
rectangle_3 = Rectangle(Plane=PlaneXY(0, 0, 0), XSize=list_item_4, YSize=absolute, Radius=0)  # -> Rectangle, Length
sort_duplicate_values_6 = SortDuplicateValues(ValueList=flatten(absolute_2))  # -> UniqueValues, Indices
sort_duplicate_values_7 = SortDuplicateValues(ValueList=flatten(absolute_3))  # -> UniqueValues, Indices
area_8 = Area(Geometry=list_item_26)  # -> Area, Centroid
area_9 = Area(Geometry=rectangle_3.Rectangle)  # -> Area, Centroid
sort_list_12 = SortList(Keys=sort_duplicate_values_6.UniqueValues)  # -> Keys, ValuesValuesA
sort_list_13 = SortList(Keys=sort_duplicate_values_7.UniqueValues)  # -> Keys, ValuesValuesA
vector_2pt_3 = Vector2Pt(PointA=area_9.Centroid, PointB=area_8.Centroid, Unitize=False)  # -> Vector, Length
list_item_34 = ListItem(List=sort_list_12.Keys, Index=0, Wrap=True)
deconstruct_vector = DeconstructVector(Vector=vector_2pt_3.Vector)  # -> XComponent, YComponent, ZComponent
list_item_35 = ListItem(List=sort_list_13.Keys, Index=0, Wrap=True)
round_11 = Round(Number=absolute_2)  # -> Nearest, Floor, Ceiling
round_12 = Round(Number=list_item_34)  # -> Nearest, Floor, Ceiling
panel_22 = Panel(list_item_34)
panel_23 = Panel(list_item_35)
round_13 = Round(Number=absolute_3)  # -> Nearest, Floor, Ceiling
round_14 = Round(Number=list_item_35)  # -> Nearest, Floor, Ceiling
unit_y_6 = UnitY(Factor=deconstruct_vector.YComponent)
equality = Equality(FirstNumber=round_12.Nearest, SecondNumber=round_11.Nearest)  # -> Equality, Inequality
subtraction_15 = Subtraction(A=multiplication_14, B=list_item_4)
move_14 = Move(Geometry=rectangle_3.Rectangle, Motion=unit_y_6)  # -> Geometry, Transform
equality_2 = Equality(FirstNumber=round_14.Nearest, SecondNumber=round_13.Nearest)  # -> Equality, Inequality
unit_x_15 = UnitX(Factor=subtraction_15)
panel_24 = Panel(equality.Equality)
panel_25 = Panel(equality_2.Equality)
move_15 = Move(Geometry=move_14.Geometry, Motion=unit_x_15)  # -> Geometry, Transform
dispatch_2 = Dispatch(List=move_14.Geometry, DispatchPattern=equality.Equality)  # -> ListA, ListB
dispatch_3 = Dispatch(List=move_15.Geometry, DispatchPattern=equality_2.Equality)  # -> ListA, ListB

curve_15 = Curve(dispatch_2.ListA)
curve_16 = Curve(dispatch_3.ListA)
merge_19 = Merge(Data1=curve_15, Data2=polyline_3)  # -> flatten(Result)
merge_20 = Merge(Data1=curve_16, Data2=mirror_2.Geometry)  # -> flatten(Result)
region_union = RegionUnion(Curves=merge_20)
region_union_2 = RegionUnion(Curves=merge_19)

explode_3 = Explode(Curve=flatten(curve_16), Recursive=True)  # -> Segments, Vertices
deconstruct_8 = Deconstruct(Point=explode_3.Vertices)  # -> XComponent, YComponent, ZComponent
sort_duplicate_values_8 = SortDuplicateValues(ValueList=deconstruct_8.YComponent)  # -> flatten(UniqueValues), Indices
sort_list_14 = SortList(Keys=sort_duplicate_values_8.UniqueValues)  # -> Keys, ValuesValuesA
list_length_10 = ListLength(List=sort_list_14.Keys)
duplicate_data_8 = DuplicateData(Data=sort_list_14.Keys, Number=2, Order=True)
duplicate_data_9 = DuplicateData(Data=merge_10, Number=list_length_10, Order=boolean_toggle_2)
construct_point_5 = ConstructPoint(XCoordinate=duplicate_data_9, YCoordinate=duplicate_data_8, ZCoordinate=0)
split_list = SplitList(List=construct_point_5, Index=list_length_10)  # -> ListA, ListB
line_6 = Line(StartPoint=split_list.ListA, EndPoint=split_list.ListB)

explode_4 = Explode(Curve=flatten(curve_15), Recursive=True)  # -> Segments, Vertices
deconstruct_9 = Deconstruct(Point=explode_4.Vertices)  # -> XComponent, YComponent, ZComponent
sort_duplicate_values_9 = SortDuplicateValues(ValueList=deconstruct_9.YComponent)  # -> flatten(UniqueValues), Indices
sort_list_15 = SortList(Keys=sort_duplicate_values_9.UniqueValues)  # -> Keys, ValuesValuesA
list_length_11 = ListLength(List=sort_list_15.Keys)
duplicate_data_10 = DuplicateData(Data=merge_4, Number=list_length_11, Order=Toggle(False))
duplicate_data_11 = DuplicateData(Data=sort_list_15.Keys, Number=2, Order=True)
construct_point_6 = ConstructPoint(XCoordinate=duplicate_data_10, YCoordinate=duplicate_data_11, ZCoordinate=0)
split_list_2 = SplitList(List=construct_point_6, Index=list_length_11)  # -> ListA, ListB
line_7 = Line(StartPoint=split_list_2.ListA, EndPoint=split_list_2.ListB)

curve_17 = Curve(region_union)
explode_5 = Explode(Curve=curve_17, Recursive=True)  # -> Segments, Vertices
curve_middle = CurveMiddle(Curve=explode_5.Segments)
deconstruct_10 = Deconstruct(Point=curve_middle)  # -> XComponent, YComponent, ZComponent
member_index = MemberIndex(Set=deconstruct_10.XComponent, Member=range_2)  # -> flatten(Index), Count
member_index_2 = MemberIndex(Set=deconstruct_10.XComponent, Member=range_3)  # -> flatten(Index), Count
list_item_36 = ListItem(List=explode_5.Segments, Index=member_index.Index, Wrap=True)
list_item_37 = ListItem(List=explode_5.Segments, Index=member_index_2.Index, Wrap=True)
move_16 = Move(Geometry=list_item_36, Motion=unit_x_6)  # -> Geometry, Transform
move_17 = Move(Geometry=list_item_37, Motion=unit_x_7)  # -> Geometry, Transform
move_18 = Move(Geometry=move_16.Geometry, Motion=unit_x_9)  # -> Geometry, Transform
merge_21 = Merge(Data1=move_18.Geometry, Data2=move_17.Geometry)
linear_array = LinearArray(Geometry=merge_21, Direction=unit_x_8, Count=round_7.Ceiling)  # -> Geometry, Transform

curve_18 = Curve(region_union_2)
explode_6 = Explode(Curve=curve_18, Recursive=True)  # -> Segments, Vertices
curve_middle_2 = CurveMiddle(Curve=explode_6.Segments)
deconstruct_11 = Deconstruct(Point=curve_middle_2)  # -> XComponent, YComponent, ZComponent
member_index_3 = MemberIndex(Set=deconstruct_11.XComponent, Member=number_slider_5)  # -> Index, Count
member_index_4 = MemberIndex(Set=deconstruct_11.XComponent, Member=list_item_4)  # -> Index, Count
list_item_38 = ListItem(List=explode_6.Segments, Index=member_index_3.Index, Wrap=True)
list_item_39 = ListItem(List=explode_6.Segments, Index=member_index_4.Index, Wrap=True)
move_19 = Move(Geometry=list_item_38, Motion=unit_x_11)  # -> Geometry, Transform
move_20 = Move(Geometry=list_item_39, Motion=unit_x_10)  # -> Geometry, Transform
move_21 = Move(Geometry=move_20.Geometry, Motion=unit_x_13)  # -> Geometry, Transform
merge_22 = Merge(Data1=move_21.Geometry, Data2=move_19.Geometry)
linear_array_2 = LinearArray(Geometry=merge_22, Direction=unit_x_12, Count=round_9.Ceiling)  # -> Geometry, Transform

multiplication_33 = Multiplication(A=max_percentage_of_cell_width, B=division_12)
construct_domain_11 = ConstructDomain(DomainStart=expr("-x", multiplication_33), DomainEnd=multiplication_33)
split_list_3 = SplitList(List=linear_array.Geometry, Index=panel_11)  # -> ListA, ListB
list_length_12 = ListLength(List=flatten(split_list_3.ListB))
random_4 = Random(Range=construct_domain_11, Number=list_length_12, Seed=random_seed_3)
unit_x_16 = UnitX(Factor=random_4)
move_22 = Move(Geometry=flatten(split_list_3.ListB), Motion=unit_x_16)  # -> Geometry, Transform
stream_filter_17 = StreamFilter(Gate=cell_widths, Stream0=linear_array.Geometry, Stream1=move_22.Geometry)

multiplication_34 = Multiplication(A=max_percentage_of_cell_width, B=division_12)
construct_domain_12 = ConstructDomain(DomainStart=expr("-x", multiplication_34), DomainEnd=multiplication_34)
split_list_4 = SplitList(List=linear_array_2.Geometry, Index=panel_12)  # -> ListA, ListB
list_length_13 = ListLength(List=flatten(split_list_4.ListB))
random_5 = Random(Range=construct_domain_12, Number=list_length_13, Seed=random_seed_3)
unit_x_17 = UnitX(Factor=random_5)
move_23 = Move(Geometry=flatten(split_list_4.ListB), Motion=unit_x_17)  # -> Geometry, Transform
stream_filter_18 = StreamFilter(Gate=cell_widths, Stream0=linear_array_2.Geometry, Stream1=move_23.Geometry)

# ----
# Creating Cells in Right Buttress
merge_23 = Merge(
    Data1=flatten(line_6),
    Data2=flatten(stream_filter_17),
    Data3=flatten(split_list_3.ListA),
    Data4=flatten(move_16.Geometry))  # -> flatten(Result)

dispatch_pattern = Panel(equality.Equality)
dispatch_pattern_2 = Panel(equality_2.Equality)
curve_19 = Curve(curve_14)
trim_tree = TrimTree(Tree=dispatch_pattern, Depth=1)
trim_tree_2 = TrimTree(Tree=dispatch_pattern_2, Depth=1)
list_item_40 = ListItem(List=curve_19, Index=panel_13, Wrap=True)
list_item_41 = ListItem(List=curve_19, Index="-2", Wrap=True)
dispatch_pattern_3 = Panel(equality.Inequality)
dispatch_pattern_4 = Panel(equality_2.Inequality)
dispatch_4 = Dispatch(List=list_item_40, DispatchPattern=trim_tree)  # -> ListA, ListB
dispatch_5 = Dispatch(List=list_item_41, DispatchPattern=trim_tree_2)  # -> ListA, ListB
curve_20 = Curve(list_item_26)
curve_21 = Curve(list_item_27)
dispatch_6 = Dispatch(List=curve_20, DispatchPattern=dispatch_pattern_3)  # -> ListA, ListB
dispatch_7 = Dispatch(List=curve_21, DispatchPattern=dispatch_pattern_4)  # -> ListA, ListB
curve_22 = Curve(dispatch_2.ListA)
curve_23 = Curve(dispatch_3.ListA)
split_brep = SplitBrep(Brep=dispatch_4.ListA, Cutter=curve_22)
split_brep_2 = SplitBrep(Brep=dispatch_5.ListA, Cutter=curve_23)
cull_index_5 = CullIndex(List=split_brep, Indices="0", Wrap=True)
cull_index_6 = CullIndex(List=split_brep_2, Indices="0", Wrap=True)
list_item_42 = ListItem(List=split_brep, Index="0", Wrap=True)
list_item_43 = ListItem(List=split_brep_2, Index="0", Wrap=True)
deconstuct_rectangle_2 = DeconstuctRectangle(Rectangle=list_item_42)  # -> BasePlane, XInterval, YInterval
deconstuct_rectangle_3 = DeconstuctRectangle(Rectangle=dispatch_6.ListA)  # -> BasePlane, XInterval, YInterval
deconstuct_rectangle_4 = DeconstuctRectangle(Rectangle=list_item_43)  # -> BasePlane, XInterval, YInterval
deconstuct_rectangle_5 = DeconstuctRectangle(Rectangle=dispatch_7.ListA)  # -> BasePlane, XInterval, YInterval
deconstruct_domain_3 = DeconstructDomain(Domain=deconstuct_rectangle_3.XInterval)  # -> Start, End
deconstruct_domain_4 = DeconstructDomain(Domain=deconstuct_rectangle_2.XInterval)  # -> Start, End
deconstruct_domain_5 = DeconstructDomain(Domain=deconstuct_rectangle_5.XInterval)  # -> Start, End
deconstruct_domain_6 = DeconstructDomain(Domain=deconstuct_rectangle_4.XInterval)  # -> Start, End
deconstruct_brep_3 = DeconstructBrep(Brep=dispatch_7.ListA)  # -> Faces, Edges, Vertices
subtraction_16 = Subtraction(A=deconstruct_domain_3.End, B=deconstruct_domain_3.Start)
subtraction_17 = Subtraction(A=deconstruct_domain_4.End, B=deconstruct_domain_4.Start)
subtraction_18 = Subtraction(A=deconstruct_domain_5.End, B=deconstruct_domain_5.Start)
subtraction_19 = Subtraction(A=deconstruct_domain_6.End, B=deconstruct_domain_6.Start)
simplify_tree_3 = SimplifyTree(Tree=subtraction_16, Front=False)
simplify_tree_4 = SimplifyTree(Tree=subtraction_17, Front=False)
deconstruct_12 = Deconstruct(Point=deconstruct_brep_3.Vertices)  # -> XComponent, YComponent, ZComponent
simplify_tree_5 = SimplifyTree(Tree=subtraction_18, Front=False)
simplify_tree_6 = SimplifyTree(Tree=subtraction_19, Front=False)
sort_duplicate_values_10 = SortDuplicateValues(ValueList=deconstruct_12.XComponent)  # -> UniqueValues, Indices
division_18 = Division(A=simplify_tree_4, B="4")
division_19 = Division(A=simplify_tree_6, B="4")
sort_list_16 = SortList(Keys=sort_duplicate_values_10.UniqueValues)  # -> Keys, ValuesValuesA
addition_14 = Addition(A=flatten(simplify_tree_3), B=flatten(division_18))
addition_15 = Addition(A=flatten(simplify_tree_5), B=flatten(division_19))
list_item_44 = ListItem(List=sort_list_16.Keys, Index="-1", Wrap=True)
division_20 = Division(A=flatten(addition_14), B=flatten(simplify_tree_3))
division_21 = Division(A=flatten(addition_15), B=flatten(simplify_tree_5))
construct_point_7 = ConstructPoint(XCoordinate=list_item_44, YCoordinate=0, ZCoordinate=0)
sort_duplicate_values_11 = SortDuplicateValues(ValueList=division_20)  # -> UniqueValues, Indices
sort_duplicate_values_12 = SortDuplicateValues(ValueList=division_21)  # -> UniqueValues, Indices
xy_plane_2 = XYPlane(Origin=construct_point_7)
list_item_45 = ListItem(List=sort_duplicate_values_12.Indices, Index=0, Wrap=True)  # -> flatten(Item)
list_item_46 = ListItem(List=sort_duplicate_values_11.Indices, Index=0, Wrap=True)  # -> flatten(Item)
sort_list_17 = SortList(Keys=list_item_45, ValuesValuesA=sort_duplicate_values_12.UniqueValues)  # -> Keys, ValuesValuesA
sort_list_18 = SortList(Keys=list_item_46, ValuesValuesA=sort_duplicate_values_11.UniqueValues)  # -> Keys, ValuesValuesA
unit_x_18 = UnitX(Factor=expr("-x", sort_list_17.ValuesValuesA))
unit_x_19 = UnitX(Factor=sort_list_18.ValuesValuesA)
scale_nu = ScaleNU(Geometry=flatten(dispatch_6.ListA), Plane=PlaneXY(0, 0, 0), ScaleX=unit_x_19, ScaleY=1, ScaleZ=1)  # -> Geometry, Transform
scale_nu_2 = ScaleNU(Geometry=flatten(dispatch_7.ListA), Plane=flatten(xy_plane_2), ScaleX=unit_x_18, ScaleY=1, ScaleZ=1)  # -> Geometry, Transform
split_brep_3 = SplitBrep(Brep=flatten(dispatch_4.ListB), Cutter=scale_nu.Geometry)
split_brep_4 = SplitBrep(Brep=flatten(dispatch_5.ListB), Cutter=scale_nu_2.Geometry)
cull_index_7 = CullIndex(List=split_brep_3, Indices="0", Wrap=True)
cull_index_8 = CullIndex(List=split_brep_4, Indices="0", Wrap=True)
curve_24 = Curve(flatten(scale_nu.Geometry))
curve_25 = Curve(flatten(cull_index_8))
curve_26 = Curve(flatten(cull_index_5))
curve_27 = Curve(flatten(cull_index_6))
curve_28 = Curve(flatten(cull_index_7))
curve_29 = Curve(flatten(scale_nu_2.Geometry))

trim_tree_3 = TrimTree(Tree=dispatch_2.ListA, Depth=1)
trim_tree_4 = TrimTree(Tree=dispatch_3.ListA, Depth=1)
tree_statistics_16 = TreeStatistics(Tree=trim_tree_3)  # -> Paths, Length, Count
tree_statistics_17 = TreeStatistics(Tree=trim_tree_4)  # -> Paths, Length, Count
curve_30 = Curve(curve_14)
dispatch_8 = Dispatch(List=tree_statistics_16.Paths, DispatchPattern=tree_statistics_16.Length)  # -> ListA, ListB
dispatch_9 = Dispatch(List=tree_statistics_17.Paths, DispatchPattern=tree_statistics_17.Length)  # -> ListA, ListB
tree_branch_10 = TreeBranch(Tree=curve_30, Path=dispatch_8.ListB, MaintainPaths=True)
tree_branch_11 = TreeBranch(Tree=curve_30, Path=dispatch_8.ListA, MaintainPaths=True)
cull_index_9 = CullIndex(List=tree_branch_11, Indices=panel_14, Wrap=True)
cull_index_10 = CullIndex(List=tree_branch_10, Indices=panel_14, Wrap=True)
construct_tree_branch = ConstructTreeBranch(BranchPath=graft(dispatch_8.ListB), BranchItems=graft(curve_24))
construct_tree_branch_2 = ConstructTreeBranch(BranchPath=graft(dispatch_8.ListA), BranchItems=graft(curve_26))
construct_tree_branch_3 = ConstructTreeBranch(BranchPath=graft(dispatch_8.ListB), BranchItems=graft(curve_28))
construct_tree_branch_4 = ConstructTreeBranch(BranchPath=graft(dispatch_9.ListB), BranchItems=graft(curve_25))
construct_tree_branch_5 = ConstructTreeBranch(BranchPath=graft(dispatch_9.ListB), BranchItems=graft(curve_29))
construct_tree_branch_6 = ConstructTreeBranch(BranchPath=graft(dispatch_9.ListA), BranchItems=graft(curve_27))
merge_24 = Merge(Data1=graft(construct_tree_branch_2), Data2=cull_index_9)
merge_25 = Merge(Data1=graft(construct_tree_branch), Data2=graft(construct_tree_branch_3), Data3=cull_index_10)
trim_tree_5 = TrimTree(Tree=merge_24, Depth=1)
trim_tree_6 = TrimTree(Tree=merge_25, Depth=1)
merge_26 = Merge(Data1=trim_tree_5, Data2=trim_tree_6)
curve_31 = Curve(merge_26)
tree_branch_12 = TreeBranch(Tree=curve_31, Path=dispatch_9.ListA, MaintainPaths=True)
tree_branch_13 = TreeBranch(Tree=curve_31, Path=dispatch_9.ListB, MaintainPaths=True)
cull_index_11 = CullIndex(List=tree_branch_13, Indices=panel_15, Wrap=True)
cull_index_12 = CullIndex(List=tree_branch_12, Indices=panel_15, Wrap=True)
merge_27 = Merge(Data1=cull_index_12, Data2=graft(construct_tree_branch_6))
merge_28 = Merge(Data1=cull_index_11, Data2=graft(construct_tree_branch_4), Data3=graft(construct_tree_branch_5))
trim_tree_7 = TrimTree(Tree=merge_27, Depth=1)
trim_tree_8 = TrimTree(Tree=merge_28, Depth=1)
merge_29 = Merge(Data1=trim_tree_8, Data2=trim_tree_7)
boundary_surfaces_3 = BoundarySurfaces(Edges=merge_29)

# ----
# Creating Cells in Left Buttress
merge_30 = Merge(
    Data1=flatten(line_7),
    Data2=flatten(stream_filter_18),
    Data3=flatten(split_list_4.ListA),
    Data4=flatten(move_20.Geometry))  # -> flatten(Result)

line_8 = Line(StartPoint=move_7.Geometry, EndPoint=move_8.Geometry)
surface_3 = Surface(mirror.Geometry)
mirror_4 = Mirror(Geometry=line_8, Plane=yz_plane)  # -> Geometry, Transform
surface_split_3 = SurfaceSplit(Surface=surface_3, Curves=merge_23)
curve_curve = CurveCurve(CurveA=surface_split_3, CurveB=mirror_4.Geometry)  # -> Points, ParamsA, ParamsB
list_item_47 = ListItem(List=curve_curve.Points, Index=0, Wrap=True)  # -> flatten(Item)
null_item = NullItem(Item=list_item_47)  # -> NullFlags, InvalidFlags, Description
dispatch_10 = Dispatch(List=surface_split_3, DispatchPattern=null_item.NullFlags)  # -> ListA, ListB
clean_tree_6 = CleanTree(RemoveNulls=True, RemoveInvalid=True, RemoveEmpty=False, Tree=list_item_47)
deconstruct_brep_4 = DeconstructBrep(Brep=dispatch_10.ListB)  # -> Faces, Edges, Vertices
deconstruct_13 = Deconstruct(Point=deconstruct_brep_4.Vertices)  # -> XComponent, YComponent, ZComponent
sort_list_19 = SortList(Keys=deconstruct_13.YComponent)  # -> Keys, ValuesValuesA
list_item_48 = ListItem(List=sort_list_19.Keys, Index=panel_16, Wrap=True)  # -> flatten(Item)
list_item_49 = ListItem(List=sort_list_19.Keys, Index=0, Wrap=True)  # -> flatten(Item)
subtraction_20 = Subtraction(A=list_item_48, B=list_item_49)
unit_y_7 = UnitY(Factor=subtraction_20)
move_24 = Move(Geometry=clean_tree_6, Motion=unit_y_7)  # -> Geometry, Transform
surface_split_4 = SurfaceSplit(Surface=curve_17, Curves=merge_23)
line_9 = Line(StartPoint=clean_tree_6, EndPoint=move_24.Geometry)
curve_curve_2 = CurveCurve(CurveA=surface_split_4, CurveB=mirror_4.Geometry)  # -> Points, ParamsA, ParamsB
list_item_50 = ListItem(List=curve_curve_2.Points, Index=0, Wrap=True)  # -> flatten(Item)
match_tree = MatchTree(Tree=graft(dispatch_10.ListB), Guide=graft(line_9))
null_item_2 = NullItem(Item=list_item_50)  # -> NullFlags, InvalidFlags, Description
surface_split_5 = SurfaceSplit(Surface=match_tree, Curves=line_9)
dispatch_11 = Dispatch(List=surface_split_4, DispatchPattern=null_item_2.NullFlags)  # -> ListA, ListB
list_item_51 = ListItem(List=surface_split_5, Index="-1", Wrap=True)
merge_31 = Merge(Data1=flatten(list_item_51), Data2=flatten(dispatch_11.ListA))  # -> flatten(Result)
line_10 = Line(StartPoint=move_7.Geometry, EndPoint=move_8.Geometry)
area_10 = Area(Geometry=merge_31)  # -> Area, Centroid
mirror_5 = Mirror(Geometry=line_10, Plane=yz_plane)  # -> Geometry, Transform
deconstruct_14 = Deconstruct(Point=area_10.Centroid)  # -> XComponent, YComponent, ZComponent
curve_closest_point = CurveClosestPoint(Point=area_10.Centroid, Curve=mirror_5.Geometry)  # -> Point, Parameter, Distance
deconstruct_15 = Deconstruct(Point=curve_closest_point.Point)  # -> XComponent, YComponent, ZComponent
smaller_than = SmallerThan(FirstNumber=deconstruct_14.XComponent, SecondNumber=deconstruct_15.XComponent)  # -> SmallerThan, OrEqualTo
member_index_5 = MemberIndex(Set=smaller_than.OrEqualTo, Member=Toggle(True))  # -> Index, Count
list_item_52 = ListItem(List=merge_31, Index=member_index_5.Index, Wrap=True)

surface_4 = Surface(move_9.Geometry)
line_11 = Line(StartPoint=move_7.Geometry, EndPoint=move_8.Geometry)
surface_split_6 = SurfaceSplit(Surface=surface_4, Curves=merge_30)
curve_curve_3 = CurveCurve(CurveA=surface_split_6, CurveB=line_11)  # -> Points, ParamsA, ParamsB
list_item_53 = ListItem(List=curve_curve_3.Points, Index=0, Wrap=True)  # -> flatten(Item)
null_item_3 = NullItem(Item=list_item_53)  # -> NullFlags, InvalidFlags, Description
dispatch_12 = Dispatch(List=surface_split_6, DispatchPattern=null_item_3.NullFlags)  # -> ListA, ListB
clean_tree_7 = CleanTree(RemoveNulls=True, RemoveInvalid=True, RemoveEmpty=False, Tree=list_item_53)
deconstruct_brep_5 = DeconstructBrep(Brep=dispatch_12.ListB)  # -> Faces, Edges, Vertices
deconstruct_16 = Deconstruct(Point=deconstruct_brep_5.Vertices)  # -> XComponent, YComponent, ZComponent
sort_list_20 = SortList(Keys=deconstruct_16.YComponent)  # -> Keys, ValuesValuesA
list_item_54 = ListItem(List=sort_list_20.Keys, Index=0, Wrap=True)  # -> flatten(Item)
list_item_55 = ListItem(List=sort_list_20.Keys, Index=panel_17, Wrap=True)  # -> flatten(Item)
subtraction_21 = Subtraction(A=list_item_55, B=list_item_54)
unit_y_8 = UnitY(Factor=subtraction_21)
move_25 = Move(Geometry=clean_tree_7, Motion=unit_y_8)  # -> Geometry, Transform
line_12 = Line(StartPoint=clean_tree_7, EndPoint=move_25.Geometry)
match_tree_2 = MatchTree(Tree=graft(dispatch_12.ListB), Guide=graft(line_12))
surface_split_7 = SurfaceSplit(Surface=curve_18, Curves=merge_30)
surface_split_8 = SurfaceSplit(Surface=match_tree_2, Curves=line_12)
curve_curve_4 = CurveCurve(CurveA=surface_split_7, CurveB=line_11)  # -> Points, ParamsA, ParamsB
list_item_56 = ListItem(List=surface_split_8, Index="-1", Wrap=True)
list_item_57 = ListItem(List=curve_curve_4.Points, Index=0, Wrap=True)  # -> flatten(Item)
null_item_4 = NullItem(Item=list_item_57)  # -> NullFlags, InvalidFlags, Description
dispatch_13 = Dispatch(List=surface_split_7, DispatchPattern=null_item_4.NullFlags)  # -> ListA, ListB
merge_32 = Merge(Data1=flatten(list_item_56), Data2=flatten(dispatch_13.ListA))  # -> flatten(Result)
area_11 = Area(Geometry=merge_32)  # -> Area, Centroid
deconstruct_17 = Deconstruct(Point=area_11.Centroid)  # -> XComponent, YComponent, ZComponent
curve_closest_point_2 = CurveClosestPoint(Point=area_11.Centroid, Curve=line_11)  # -> Point, Parameter, Distance
deconstruct_18 = Deconstruct(Point=curve_closest_point_2.Point)  # -> XComponent, YComponent, ZComponent
smaller_than_2 = SmallerThan(FirstNumber=deconstruct_17.XComponent, SecondNumber=deconstruct_18.XComponent)  # -> SmallerThan, OrEqualTo
member_index_6 = MemberIndex(Set=smaller_than_2.OrEqualTo, Member=Toggle(False))  # -> Index, Count
list_item_58 = ListItem(List=merge_32, Index=member_index_6.Index, Wrap=True)

# ---- group: Rows sorted (continued)
number_14 = Number(sort_list_15.Keys)
merge_33 = Merge(Data1=number_14, Data2=multiplication_13)
surface_5 = Surface(list_item_58)
delete_consecutive = DeleteConsecutive(Set=merge_33, Wrap=False)  # -> Set, Count
area_12 = Area(Geometry=flatten(surface_5))  # -> Area, Centroid
cull_index_13 = CullIndex(List=delete_consecutive.Set, Indices="0", Wrap=True)
construct_domain_13 = ConstructDomain(DomainStart=number_slider_6, DomainEnd=cull_index_13)  # -> flatten(Domain)
deconstruct_19 = Deconstruct(Point=area_12.Centroid)  # -> XComponent, YComponent, ZComponent
find_domain = FindDomain(Domains=construct_domain_13, Number=deconstruct_19.YComponent, Strict=False)  # -> Index, Neighbour
sort_list_21 = SortList(Keys=find_domain.Index, ValuesValuesA=surface_5)  # -> Keys, ValuesValuesA
delete_consecutive_2 = DeleteConsecutive(Set=sort_list_21.Keys, Wrap=False)  # -> Set, Count
member_index_7 = MemberIndex(Set=sort_list_21.Keys, Member=delete_consecutive_2.Set)  # -> Index, Count
partition_list_10 = PartitionList(List=sort_list_21.ValuesValuesA, Size=member_index_7.Count)
area_13 = Area(Geometry=partition_list_10)  # -> Area, Centroid
deconstruct_20 = Deconstruct(Point=area_13.Centroid)  # -> XComponent, YComponent, ZComponent
sort_list_22 = SortList(Keys=deconstruct_20.XComponent, ValuesValuesA=partition_list_10)  # -> Keys, ValuesValuesA
reverse_list = ReverseList(List=sort_list_22.ValuesValuesA)
curve_32 = Curve(reverse_list)
move_26 = Move(Geometry=curve_32, Motion=unit_x_5)  # -> Geometry, Transform
surface_6 = Surface(move_26.Geometry)

# Sorting Cells by Rows
surface_7 = Surface(list_item_52)
area_14 = Area(Geometry=flatten(surface_7))  # -> Area, Centroid
deconstruct_21 = Deconstruct(Point=area_14.Centroid)  # -> XComponent, YComponent, ZComponent
find_domain_2 = FindDomain(Domains=construct_domain_13, Number=deconstruct_21.YComponent, Strict=False)  # -> Index, Neighbour
sort_list_23 = SortList(Keys=find_domain_2.Index, ValuesValuesA=surface_7)  # -> Keys, ValuesValuesA
delete_consecutive_3 = DeleteConsecutive(Set=sort_list_23.Keys, Wrap=False)  # -> Set, Count
member_index_8 = MemberIndex(Set=sort_list_23.Keys, Member=delete_consecutive_3.Set)  # -> Index, Count
partition_list_11 = PartitionList(List=sort_list_23.ValuesValuesA, Size=member_index_8.Count)
area_15 = Area(Geometry=partition_list_11)  # -> Area, Centroid
deconstruct_22 = Deconstruct(Point=area_15.Centroid)  # -> XComponent, YComponent, ZComponent
sort_list_24 = SortList(Keys=deconstruct_22.XComponent, ValuesValuesA=partition_list_11)  # -> Keys, ValuesValuesA
unit_x_20 = UnitX(Factor=multiplication_7)
curve_33 = Curve(sort_list_24.ValuesValuesA)
move_27 = Move(Geometry=curve_33, Motion=unit_x_20)  # -> Geometry, Transform
surface_8 = Surface(move_27.Geometry)

# ---- group: Points sorted
# Sorting Points in Cells
explode_7 = Explode(Curve=surface_8, Recursive=True)  # -> Segments, Vertices
tree_statistics_18 = TreeStatistics(Tree=surface_8)  # -> Paths, Length, Count
cull_index_14 = CullIndex(List=explode_7.Vertices, Indices="-1", Wrap=True)
area_16 = Area(Geometry=flatten(surface_8))  # -> Area, Centroid
tree_statistics_19 = TreeStatistics(Tree=cull_index_14)  # -> Paths, Length, Count
duplicate_data_12 = DuplicateData(Data=graft(area_16.Centroid), Number=graft(tree_statistics_19.Length), Order=True)  # -> flatten(Data)
vector_2pt_4 = Vector2Pt(PointA=flatten(duplicate_data_12), PointB=flatten(cull_index_14), Unitize=False)  # -> Vector, Length
unit_y_9 = UnitY(Factor="-100")
move_28 = Move(Geometry=unit_y_9, Motion=duplicate_data_12)  # -> Geometry, Transform
vector_2pt_5 = Vector2Pt(PointA=duplicate_data_12, PointB=move_28.Geometry, Unitize=False)  # -> Vector, Length
xy_plane_3 = XYPlane(Origin=Point(0, 0, 0))
angle = Angle(VectorA=vector_2pt_5.Vector, VectorB=vector_2pt_4.Vector, Plane=xy_plane_3)  # -> Angle, Reflex
partition_list_12 = PartitionList(List=angle.Angle, Size=tree_statistics_19.Length)
match_tree_3 = MatchTree(Tree=cull_index_14, Guide=partition_list_12)
sort_list_25 = SortList(Keys=partition_list_12, ValuesValuesA=match_tree_3)  # -> Keys, ValuesValuesA
polyline_9 = PolyLine(Vertices=sort_list_25.ValuesValuesA, Closed=Toggle(True))  # -> flatten(Polyline)

# Sorting Points in Cells
explode_8 = Explode(Curve=surface_6, Recursive=True)  # -> Segments, Vertices
tree_statistics_20 = TreeStatistics(Tree=surface_6)  # -> Paths, Length, Count
cull_index_15 = CullIndex(List=explode_8.Vertices, Indices="-1", Wrap=True)
area_17 = Area(Geometry=flatten(surface_6))  # -> Area, Centroid
tree_statistics_21 = TreeStatistics(Tree=cull_index_15)  # -> Paths, Length, Count
duplicate_data_13 = DuplicateData(Data=graft(area_17.Centroid), Number=graft(tree_statistics_21.Length), Order=True)  # -> flatten(Data)
vector_2pt_6 = Vector2Pt(PointA=flatten(duplicate_data_13), PointB=flatten(cull_index_15), Unitize=False)  # -> Vector, Length
unit_y_10 = UnitY(Factor="-100")
move_29 = Move(Geometry=unit_y_10, Motion=duplicate_data_13)  # -> Geometry, Transform
vector_2pt_7 = Vector2Pt(PointA=duplicate_data_13, PointB=move_29.Geometry, Unitize=False)  # -> Vector, Length
xy_plane_4 = XYPlane(Origin=Point(0, 0, 0))
angle_2 = Angle(VectorA=vector_2pt_7.Vector, VectorB=vector_2pt_6.Vector, Plane=xy_plane_4)  # -> Angle, Reflex
# Dividing curves into groups
partition_list_13 = PartitionList(List=angle_2.Angle, Size=tree_statistics_21.Length)
match_tree_4 = MatchTree(Tree=cull_index_15, Guide=partition_list_13)
sort_list_26 = SortList(Keys=partition_list_13, ValuesValuesA=match_tree_4)  # -> Keys, ValuesValuesA
# Getting curves for the tessellation
boolean_toggle_3 = BooleanToggle(True)
# Packing
polyline_10 = PolyLine(Vertices=sort_list_26.ValuesValuesA, Closed=boolean_toggle_3)  # -> flatten(Polyline)

# ----
# Mirror buttress
addition_16 = Addition(A=multiplication_14, B=maximum_2)
curve_34 = Curve(polyline_10)
unit_x_21 = UnitX(Factor=expr("x+150", addition_16))
mirror_6 = Mirror(Geometry=curve_34, Plane=PlaneYZ(0, 0, 0))  # -> Geometry, Transform
move_30 = Move(Geometry=mirror_6.Geometry, Motion=unit_x_21)  # -> Geometry, Transform
partition_list_14 = PartitionList(List=curve_34, Size=tree_statistics_20.Length)
area_18 = Area(Geometry=move_30.Geometry)  # -> Area, Centroid
yz_plane_2 = YZPlane(Origin=area_18.Centroid)
mirror_7 = Mirror(Geometry=move_30.Geometry, Plane=yz_plane_2)  # -> Geometry, Transform
stream_filter_19 = StreamFilter(Mirrored=Toggle(True), Stream0=curve_34, Stream1=mirror_7.Geometry)

# ---- group: Curves sorted by rows
partition_list_15 = PartitionList(List=stream_filter_19, Size=tree_statistics_20.Length)

partition_list_16 = PartitionList(List=polyline_9, Size=tree_statistics_18.Length)

# ----
# INSTRUCTIONS
curve_35 = Curve(curve_34)
curve_36 = Curve(partition_list_16)

# ----
# Right Buttress
surface_9 = Surface(partition_list_16)

# ----
# Left Buttress
surface_10 = Surface(partition_list_15)

# ----
# Buttresses
deconstuct_rectangle_6 = DeconstuctRectangle(Rectangle=[surface_10, surface_9])  # -> BasePlane, XInterval, YInterval
deconstruct_domain_7 = DeconstructDomain(Domain=flatten(deconstuct_rectangle_6.XInterval))  # -> Start, End
deconstruct_domain_8 = DeconstructDomain(Domain=flatten(deconstuct_rectangle_6.YInterval))  # -> Start, End
multiplication_35 = Multiplication(A=deconstruct_domain_7.End, B="2")
sort_list_27 = SortList(Keys=multiplication_35)  # -> Keys, ValuesValuesA
multiplication_36 = Multiplication(A=deconstruct_domain_8.End, B="2")
sort_list_28 = SortList(Keys=multiplication_36)  # -> Keys, ValuesValuesA
list_item_59 = ListItem(List=sort_list_27.Keys, Index=0, Wrap=True)
list_item_60 = ListItem(List=sort_list_27.Keys, Index="-1", Wrap=True)
list_item_61 = ListItem(List=sort_list_28.Keys, Index=0, Wrap=True)
list_item_62 = ListItem(List=sort_list_28.Keys, Index="-1", Wrap=True)
merge_34 = Merge(Data1=list_item_59, Data2=list_item_60)
merge_35 = Merge(Data1=list_item_61, Data2=list_item_62)
cell_width_range_mm = Panel(merge_34)
cell_height_range_mm = Panel(merge_35)
division_22 = Division(A=multiplication_36, B=multiplication_35)
sort_list_29 = SortList(Keys=division_22)  # -> Keys, ValuesValuesA
list_item_63 = ListItem(List=sort_list_29.Keys, Index=0, Wrap=True)
list_item_64 = ListItem(List=sort_list_29.Keys, Index="-1", Wrap=True)
merge_36 = Merge(Data1=list_item_63, Data2=list_item_64)
cell_aspect_ratios_h_b_range = Panel(merge_36)

# ----
# Buttress Cells
cell_height_range_mm_buttresses = Panel(merge_35)
cell_width_range_mm_buttresses = Panel(merge_34)

list_item_65 = ListItem(List=cell_height_range_mm_buttresses, Index="1", Wrap=True)
list_item_66 = ListItem(List=cell_width_range_mm_buttresses, Index="1", Wrap=True)
includes = Includes(Value=list_item_65, Domain=construct_domain_6)  # -> Includes, Deviation
includes_2 = Includes(Value=list_item_66, Domain=construct_domain_7)  # -> Includes, Deviation
within_range = Panel(includes.Includes)
within_range_2 = Panel(includes_2.Includes)

number_15 = Number(division_12)
multiplication_37 = Multiplication(A=number_15, B=percentage_of_cell_width_that_points_can)

# ---- group: Points sorted (continued)
surface_11 = Surface(boundary_surfaces_3)
explode_9 = Explode(Curve=surface_11, Recursive=True)  # -> Segments, Vertices
tree_statistics_22 = TreeStatistics(Tree=surface_11)  # -> Paths, Length, Count
area_19 = Area(Geometry=flatten(surface_11))  # -> Area, Centroid

# ---- group: Points sorted / Removing midpoints of cells
shift_list_4 = ShiftList(List=explode_9.Segments, Shift=1, Wrap=True)
angle_3 = Angle(VectorA=explode_9.Segments, VectorB=shift_list_4)  # -> Angle, Reflex
member_index_9 = MemberIndex(Set=angle_3.Angle, Member=Slider(0, range=0..100))  # -> Index, Count
cull_index_16 = CullIndex(List=explode_9.Segments, Indices=member_index_9.Index, Wrap=True)
partition_list_17 = PartitionList(List=flatten(cull_index_16), Size="4")
shift_list_5 = ShiftList(List=partition_list_17, Shift=1, Wrap=True)
trim_tree_9 = TrimTree(Tree=shift_list_5, Depth=1)
line_line = LineLine(Line1=partition_list_17, Line2=trim_tree_9)  # -> ParamA, ParamB, PointA, PointB
polyline_11 = PolyLine(Vertices=line_line.PointA, Closed=Toggle(True))
explode_10 = Explode(Curve=polyline_11, Recursive=True)  # -> Segments, Vertices

# ---- group: Points sorted (continued)
cull_index_17 = CullIndex(List=explode_10.Vertices, Indices=panel_19, Wrap=True)
tree_statistics_23 = TreeStatistics(Tree=cull_index_17)  # -> Paths, Length, Count
duplicate_data_14 = DuplicateData(Data=graft(area_19.Centroid), Number=graft(tree_statistics_23.Length), Order=True)  # -> flatten(Data)
vector_2pt_8 = Vector2Pt(PointA=flatten(duplicate_data_14), PointB=flatten(cull_index_17), Unitize=False)  # -> Vector, Length
move_31 = Move(Geometry=unit_y_2, Motion=duplicate_data_14)  # -> Geometry, Transform
vector_2pt_9 = Vector2Pt(PointA=duplicate_data_14, PointB=move_31.Geometry, Unitize=False)  # -> Vector, Length
angle_4 = Angle(VectorA=vector_2pt_9.Vector, VectorB=vector_2pt_8.Vector, Plane=xy_plane)  # -> Angle, Reflex
partition_list_18 = PartitionList(List=angle_4.Angle, Size=tree_statistics_23.Length)
match_tree_5 = MatchTree(Tree=cull_index_17, Guide=partition_list_18)
sort_list_30 = SortList(Keys=partition_list_18, ValuesValuesA=match_tree_5)  # -> Keys, ValuesValuesA
polyline_12 = PolyLine(Vertices=sort_list_30.ValuesValuesA, Closed=Toggle(True))  # -> flatten(Polyline)

# ---- group: Curves sorted by rows
partition_list_19 = PartitionList(List=polyline_12, Size=tree_statistics_22.Length)

# ----
# INSTRUCTIONS for wall, buttresses, and cells: 1) Adjust wall dimensions
# 
# 2) Select pattern type
# 
# 3) Adjust pattern factors
#    - see pattern input options
# 
# 4) Adjust buttress dimensions
# 
# 5) Select which limits will be implemented
# 
# 6) Compare available rubble geometry to resulting cell geometries
#    - Ensure that the number of cells < 1/3 the number of rubble pieces available
#    - Ensure that the cell dimensions are within 10% of rubble dimensions
# 
# 7) Push Tessellations and Geometry
# Tessellations and Geometry
curve_37 = Curve(partition_list_19)

# ----
# Main wall
surface_12 = Surface(partition_list_19)

# ----
# Resulting Geometry Data
# Main Wall
deconstuct_rectangle_7 = DeconstuctRectangle(Rectangle=surface_12)  # -> BasePlane, XInterval, YInterval
deconstruct_domain_9 = DeconstructDomain(Domain=flatten(deconstuct_rectangle_7.XInterval))  # -> Start, End
deconstruct_domain_10 = DeconstructDomain(Domain=flatten(deconstuct_rectangle_7.YInterval))  # -> Start, End
multiplication_38 = Multiplication(A=deconstruct_domain_9.End, B="2")
sort_list_31 = SortList(Keys=multiplication_38)  # -> Keys, ValuesValuesA
multiplication_39 = Multiplication(A=deconstruct_domain_10.End, B="2")
sort_list_32 = SortList(Keys=multiplication_39)  # -> Keys, ValuesValuesA
list_item_67 = ListItem(List=sort_list_31.Keys, Index=0, Wrap=True)
list_item_68 = ListItem(List=sort_list_31.Keys, Index="-1", Wrap=True)
list_item_69 = ListItem(List=sort_list_32.Keys, Index=0, Wrap=True)
list_item_70 = ListItem(List=sort_list_32.Keys, Index="-1", Wrap=True)
merge_37 = Merge(Data1=list_item_67, Data2=list_item_68)
merge_38 = Merge(Data1=list_item_69, Data2=list_item_70)
cell_width_range_mm_2 = Panel(merge_37)
division_23 = Division(A=multiplication_39, B=multiplication_38)
cell_height_range_mm_2 = Panel(merge_38)
sort_list_33 = SortList(Keys=division_23)  # -> Keys, ValuesValuesA
list_item_71 = ListItem(List=sort_list_33.Keys, Index=0, Wrap=True)
list_item_72 = ListItem(List=sort_list_33.Keys, Index="-1", Wrap=True)
merge_39 = Merge(Data1=list_item_71, Data2=list_item_72)
cell_aspect_ratios_h_b_range_2 = Panel(merge_39)

# ----
# Wall Geometry and Cell Tessellations
list_length_14 = ListLength(List=flatten(surface_12))
list_length_15 = ListLength(List=flatten([surface_10, surface_9]))

number_of_cells_in_buttresses = Panel(list_length_15)

# ---- group: Curves input for packing
# Tessellations
stream_filter_20 = StreamFilter(RunRightButtressGeometry=push_right_buttress_geometry, Stream1=partition_list_16)
stream_filter_21 = StreamFilter(RunLeftButtressGeometry=push_left_buttress_geometry, Stream1=partition_list_15)
stream_filter_22 = StreamFilter(RunMainWallGeometry=push_main_wall_geometry, Stream1=partition_list_19)
wall_curves = Curve(flatten(stream_filter_22))
right_b_curves = Curve(flatten(stream_filter_20))
left_b_curves = Curve(flatten(stream_filter_21))

# ----
# Main Wall
wall = Curve(wall_curves)
packing_code = Python3Script(
    unavailable_stones=series,
    matrices=grouping.a,
    cells=wall,
    area_tolerance=area_tolerance,
    tolerance=general_tolerance,
    cell_change=cell_changing,
    pack=pack_main_wall)  # -> output_curves, stones_left_geom, centre_points, output_curves_number, cells, unavailable_stones; inputs unavailable_stones: list of Int32, matrices: list, cells: list, pack: Boolean
# ---------- packing_code: Python ----------
import rhinoscriptsyntax as rs
import Rhino.Geometry as rg
import math
import scriptcontext as sc

print(len(matrices))

# Check if points are close within a tolerance
def points_are_close(pt1, pt2):
    return pt1.DistanceTo(pt2) < 30

# Calculate the area of the curve's bounding box
def calculate_area(cell):
    cell = rs.coercecurve(cell)
    area_result = rs.CurveArea(cell)
    return area_result[0]

# Calculate the aspect ratio of the curve using the bounding box
def calculate_aspect_ratio(cell):
    bounding_box = rs.BoundingBox(cell)
    if bounding_box:
        width = rs.Distance(bounding_box[0], bounding_box[1])
        height = rs.Distance(bounding_box[0], bounding_box[3])
        if height != 0:
            return width / height
        return width
    return 1

examined_matrix_indexes = []  # Track already used matrices
output_curves = []  # Store the final fitting curves
output_curves_number = []  # Store stone numbers for robot construction
centre_points = []  # Store center points for number tags
stones_left_geom = []  # Store the remaining stones

if pack:
    # Main loop to find a stone for each cell
    for cell_counter, cell in enumerate(cells):

        cell_area = calculate_area(cell)  # Area of the cell
        cell_aspect_ratio = calculate_aspect_ratio(cell)  # Aspect ratio of the cell
        surface_edges = rs.ExplodeCurves(cell)
        cell_segment_points = rs.PolylineVertices(surface_edges[3])

        # Iterate through all groups to find the best group for the current cell
        found_match = False
        for group in matrices:
            max_group_area = max(stone[0] for stone in group)  # Max area in the group

            # If the group can fit within the area tolerance, iterate through matrices within the group
            if max_group_area <= cell_area * (1 + area_tolerance):
                for matrix in group:
                    matrix_index = matrix[5]

                    # Skip stones already used or marked unavailable
                    if matrix_index in unavailable_stones or matrix_index in examined_matrix_indexes:
                        continue

                    matrix_area = matrix[0]
                    matrix_aspect_ratio = matrix[2]

                    # Calculate fitness (distance)
                    distance = math.sqrt((matrix_area - cell_area) ** 2 + (matrix_aspect_ratio - cell_aspect_ratio) ** 2)
                    if distance > tolerance:
                        continue

                    # Orientation and positioning based on aspect ratio
                    if cell_aspect_ratio < 1:
                        exploded_curves = rs.ExplodeCurves(sc.doc.Objects.AddCurve(matrix[1]))
                        closest_seg = min(exploded_curves, key=lambda seg: abs(rs.CurveLength(seg) - rs.CurveLength(surface_edges[3])))
                        curve_segment_points = rs.PolylineVertices(closest_seg)
                        oriented_curve = rs.OrientObject(sc.doc.Objects.AddCurve(matrix[1]), curve_segment_points, cell_segment_points, flags=0)
                    else:
                        maximum_segment = matrix[4]
                        curve_segment_points = rs.PolylineVertices(maximum_segment)
                        oriented_curve = rs.OrientObject(sc.doc.Objects.AddCurve(matrix[1]), curve_segment_points, cell_segment_points, flags=0)

                    # Fit check within the bounding box
                    cell_bbox = rs.BoundingBox(cell)
                    oriented_bbox = rs.BoundingBox(oriented_curve)
                    cell_width = rs.Distance(cell_bbox[0], cell_bbox[1])
                    cell_height = rs.Distance(cell_bbox[0], cell_bbox[3])
                    oriented_width = rs.Distance(oriented_bbox[0], oriented_bbox[1])
                    oriented_height = rs.Distance(oriented_bbox[0], oriented_bbox[3])

                    # Check if oriented stone fits within cell dimensions
                    if oriented_width <= cell_width and oriented_height <= cell_height:
                        # Position adjustment
                        curve_points = rs.CurvePoints(oriented_curve, 2)
                        min_distance = min((pt.X - cell_segment_points[0].X for pt in curve_points), default=0)
                        move_vector = [abs(min_distance), 0, 0]
                        moved_curve = rs.MoveObject(oriented_curve, move_vector)

                        # Collision detection with previous stone
                        if cell_counter > 0:
                            previous_stone = output_curves[-1]
                            intersection = rs.CurveCurveIntersection(previous_stone, moved_curve)
                            if intersection:
                                stone_points = rs.PolylineVertices(moved_curve)
                                leftmost_x_stone = min(point.X for point in stone_points)
                                cell_bottom_left_x = cell_segment_points[0].X
                                dx = cell_bottom_left_x - leftmost_x_stone
                                rs.MoveObject(moved_curve, [dx, 0, 0])

                        # Store results, mark matrix as used, and add stone number and center point
                        output_curves.append(moved_curve)
                        examined_matrix_indexes.append(matrix_index)
                        centre_points.append(rs.CurveAreaCentroid(moved_curve)[0])
                        output_curves_number.append(matrix_index)
                        unavailable_stones.append(matrix_index)
                        
                        # Modify the next cell if not the last one
                        if cell_change and cell_counter < len(cells) - 1:
                            next_cell = cells[cell_counter + 1]
                            top_left_next = rs.PolylineVertices(next_cell)[2]
                            top_right_cell = rs.PolylineVertices(cell)[1]
                            if points_are_close(top_left_next, top_right_cell):
                                curve_segments = rs.ExplodeCurves(moved_curve)
                                right_most_x = max(point.X for point in rs.PolylineVertices(moved_curve))
                                next_cell_points = list(rs.PolylineVertices(next_cell))
                                next_cell_points[2] = rg.Point3d(right_most_x, next_cell_points[2].Y, next_cell_points[2].Z)
                                next_cell_points[3] = rg.Point3d(right_most_x, next_cell_points[3].Y, next_cell_points[3].Z)
                                next_cell_points[-1] = next_cell_points[0]
                                new_polyline = rg.Polyline(next_cell_points)
                                cells[cell_counter + 1] = sc.doc.Objects.AddCurve(rg.PolylineCurve(new_polyline))
                            else:
                                rightmost_x_stone = max(pt.X for pt in rs.PolylineVertices(moved_curve))
                                dx = cell_segment_points[1].X - rightmost_x_stone
                                rs.MoveObject((moved_curve, centre_points[cell_counter]), [dx, 0, 0])

                        found_match = True  # Indicate match found
                        break  # Break from matrix loop

                if found_match:
                    break  # Break from group loop if match was found

    # Track remaining stones only once after the loop
    stones_left_geom.clear()  # Clear to prevent duplicates
    stones_left = [stone for group in matrices for stone in group if stone[5] not in examined_matrix_indexes]
    stones_left_geom.extend(stone[1] for stone in stones_left)
    print(len(output_curves))
    print(len(stones_left_geom))
# ---------- end packing_code ----------
geometry = Geometry(packing_code.output_curves)
geometry_2 = Geometry(packing_code.stones_left_geom)
geometry_3 = Geometry(packing_code.centre_points)
number_16 = Number(packing_code.output_curves_number)
geometry_4 = Geometry(packing_code.cells)
boundary_surfaces_4 = BoundarySurfaces(Edges=geometry)
text_tag_3d = TextTag3D(Location=geometry_3, Text=number_16, Size=text_size, Colour=text_color, Justification=5)
custom_preview_2 = CustomPreview(Geometry=boundary_surfaces_4, Material=rubble_color)

cell_height_range_mm_main_wall = Panel(merge_38)
cell_width_range_mm_main_wall = Panel(merge_37)
number_of_cells_in_main_wall = Panel(list_length_14)

addition_17 = Addition(A=number_of_cells_in_main_wall, B=number_of_cells_in_buttresses)
cell_count = Panel(addition_17)
smaller_than_3 = SmallerThan(FirstNumber=cell_count, SecondNumber=multiplication_22)  # -> SmallerThan, OrEqualTo
list_item_73 = ListItem(List=cell_height_range_mm_main_wall, Index=0, Wrap=True)
list_item_74 = ListItem(List=cell_width_range_mm_main_wall, Index=0, Wrap=True)
list_item_75 = ListItem(List=cell_height_range_mm_main_wall, Index="1", Wrap=True)
list_item_76 = ListItem(List=cell_width_range_mm_main_wall, Index="1", Wrap=True)
includes_3 = Includes(Value=list_item_75, Domain=construct_domain_6)  # -> Includes, Deviation
includes_4 = Includes(Value=list_item_73, Domain=construct_domain_6)  # -> Includes, Deviation
includes_5 = Includes(Value=list_item_76, Domain=construct_domain_7)  # -> Includes, Deviation
includes_6 = Includes(Value=list_item_74, Domain=construct_domain_7)  # -> Includes, Deviation
is_there_enough_rubble = Panel(smaller_than_3.OrEqualTo)
within_range_3 = Panel(includes_3.Includes)
within_range_4 = Panel(includes_5.Includes)
within_range_5 = Panel(includes_4.Includes)
within_range_6 = Panel(includes_6.Includes)

cell_count_2 = Panel(addition_17)

# ----
# Step 5: Packing
# INSTRUCTIONS for packing: SETTINGS:
#  - Area tolerance: how much voided cell area is acceptable
#  - General tolerance: how much difference in largest segment and base of cell
# 
# 1) Switch on Pack for main wall
#    - Start with Area toelrance at 0.25
#    - Find a General tolerance which successfully packs the wall
#    - Shift the slider down to minimize the General tolerance
# 
# 2) Switch on Pack for buttresses
#    - Start with Area toelrance at 0.25
#    - Find a General tolerance which successfully packs the buttresses
#    - Shift the slider down to minimize the General tolerance
# 
# PROTOTYPE SETTINGS:
#    MAIN WALL PACKING
#    - Area Tolerance: 0.25
#    - General Tolerance: 4310
#    - Cell changing: True
#    BUTTRESS PACKING
#    - Area Tolerance: 0.25
#    - General Tolerance: 4320
#    - Cell changing: True
# Resulting geometries
# Right Buttress
# Left Buttress
# Main Wall
surface_13 = Surface(boundary_surfaces_4)

# ---- group: Points sorted
explode_11 = Explode(Curve=partition_list_19, Recursive=True)  # -> Segments, Vertices
point_order = Panel(stream_filter_2)
panel_26 = Panel("-1")

# ---- group: Points sorted / Points in order
cull_index_18 = CullIndex(List=explode_11.Vertices, Indices=panel_26, Wrap=True)

# ---- group: Points sorted (continued)
panel_27 = Panel(cull_index_18)

explode_12 = Explode(Curve=partition_list_15, Recursive=True)  # -> Segments, Vertices
point_order_2 = Panel(stream_filter)
panel_28 = Panel("-1")

# ---- group: Points sorted / Points in order
cull_index_19 = CullIndex(List=explode_12.Vertices, Indices=panel_28, Wrap=True)

# ---- group: Points sorted (continued)
panel_29 = Panel(cull_index_19)

explode_13 = Explode(Curve=partition_list_16, Recursive=True)  # -> Segments, Vertices
point_order_3 = Panel(stream_filter_3)
panel_30 = Panel("-1")

# ---- group: Points sorted / Points in order
cull_index_20 = CullIndex(List=explode_13.Vertices, Indices=panel_30, Wrap=True)

# ---- group: Points sorted (continued)
panel_31 = Panel(cull_index_20)

# ----
# Left Buttress
left_buttress = Curve(left_b_curves)
packing_code_2 = Python3Script(
    unavailable_stones=packing_code.unavailable_stones,
    matrices=grouping.a,
    cells=left_buttress,
    area_tolerance=area_tolerance_2,
    tolerance=general_tolerance_2,
    cell_change=cell_changing_2,
    pack=pack_buttresses)  # -> output_curves, stones_left_geom, centre_points, output_curves_number, cells, unavailable_stones; inputs unavailable_stones: list of Int32, matrices: list, cells: list, pack: Boolean; same code as packing_code
geometry_5 = Geometry(packing_code_2.stones_left_geom)
geometry_6 = Geometry(packing_code_2.centre_points)
number_17 = Number(packing_code_2.output_curves_number)
geometry_7 = Geometry(packing_code_2.cells)
geometry_8 = Geometry(packing_code_2.output_curves)
boundary_surfaces_5 = BoundarySurfaces(Edges=geometry_8)
text_tag_3d_2 = TextTag3D(Location=geometry_6, Text=number_17, Size=text_size, Colour=text_color, Justification=5)

# ----
# Right Buttress
right_buttress = Curve(right_b_curves)
packing_code_3 = Python3Script(
    unavailable_stones=packing_code_2.unavailable_stones,
    matrices=grouping.a,
    cells=right_buttress,
    area_tolerance=area_tolerance_2,
    tolerance=general_tolerance_2,
    cell_change=cell_changing_2,
    pack=pack_buttresses)  # -> output_curves, stones_left_geom, centre_points, output_curves_number, cells, unavailable_stones; inputs unavailable_stones: list of Int32, matrices: list, cells: list, pack: Boolean; same code as packing_code
geometry_9 = Geometry(packing_code_3.cells)
geometry_10 = Geometry(packing_code_3.centre_points)
number_18 = Number(packing_code_3.output_curves_number)
geometry_11 = Geometry(packing_code_3.output_curves)
geometry_12 = Geometry(packing_code_3.stones_left_geom)
boundary_surfaces_6 = BoundarySurfaces(Edges=geometry_11)
custom_preview_3 = CustomPreview(Geometry=boundary_surfaces_6, Material=rubble_color)
text_tag_3d_3 = TextTag3D(Location=geometry_10, Text=number_18, Size=text_size, Colour=text_color, Justification=5)

mirror_8 = Mirror(Geometry=geometry_6, Plane=PlaneYZ(0, 0, 0))  # -> Geometry, Transform
move_32 = Move(Geometry=mirror_8.Geometry, Motion=unit_x_21)  # -> Geometry, Transform

mirror_9 = Mirror(Geometry=boundary_surfaces_5, Plane=PlaneYZ(0, 0, 0))  # -> Geometry, Transform
move_33 = Move(Geometry=mirror_9.Geometry, Motion=unit_x_21)  # -> Geometry, Transform

surface_14 = Surface(move_33.Geometry)
surface_15 = Surface(boundary_surfaces_6)

mirror_10 = Mirror(Geometry=geometry_7, Plane=PlaneYZ(0, 0, 0))  # -> Geometry, Transform
move_34 = Move(Geometry=mirror_10.Geometry, Motion=unit_x_21)  # -> Geometry, Transform
area_20 = Area(Geometry=move_34.Geometry)  # -> Area, Centroid
yz_plane_3 = YZPlane(Origin=area_20.Centroid)
mirror_11 = Mirror(Geometry=move_34.Geometry, Plane=yz_plane_3)  # -> Geometry, Transform

custom_preview_4 = CustomPreview(Geometry=move_33.Geometry, Material=rubble_color)

# ----
# Packing Voids
curve_38 = Curve(partition_list_19)
surface_16 = Surface(boundary_surfaces_6)
surface_17 = Surface(boundary_surfaces_4)
curve_39 = Curve(partition_list_16)
curve_40 = Curve(partition_list_14)
surface_18 = Surface(move_33.Geometry)
curve_41 = Curve(geometry_12)
list_item_77 = ListItem(List=boundary_surfaces_4, Index=0, Wrap=True)

# ---- group: Create rectangles to merge stones
list_item_78 = ListItem(List=curve_38, Index=0, Wrap=True)
explode_14 = Explode(Curve=list_item_78, Recursive=True)  # -> Segments, Vertices
deconstruct_23 = Deconstruct(Point=explode_14.Vertices)  # -> XComponent, YComponent, ZComponent
sort_list_34 = SortList(Keys=deconstruct_23.YComponent)  # -> Keys, ValuesValuesA
list_item_79 = ListItem(List=sort_list_34.Keys, Index=0, Wrap=True)
list_item_80 = ListItem(List=sort_list_34.Keys, Index="-1", Wrap=True)
subtraction_22 = Subtraction(A=list_item_79, B=list_item_80)
absolute_4 = Absolute(Value=subtraction_22)  # -> flatten(Result)
mass_addition = MassAddition(Input=absolute_4)  # -> Result, PartialResults
cull_index_21 = CullIndex(List=mass_addition.PartialResults, Indices="-1", Wrap=True)
merge_40 = Merge(Data1=flatten("0"), Data2=flatten(cull_index_21))  # -> flatten(Result)
list_item_81 = ListItem(List=flatten(list_item_79), Index=0, Wrap=True)
addition_18 = Addition(A=flatten(list_item_81), B=merge_40)
construct_point_8 = ConstructPoint(XCoordinate=0, YCoordinate=addition_18, ZCoordinate=0)
brep_join = BrepJoin(Breps=curve_38)  # -> flatten(Breps), Closed
xy_plane_5 = XYPlane(Origin=construct_point_8)
scale_nu_3 = ScaleNU(Geometry=brep_join.Breps, Plane=xy_plane_5, ScaleX=1, ScaleY=Slider(0.05, range=0..1), ScaleZ=1)  # -> Geometry, Transform
curve_42 = Curve(scale_nu_3.Geometry)

list_item_82 = ListItem(List=curve_40, Index=0, Wrap=True)
explode_15 = Explode(Curve=list_item_82, Recursive=True)  # -> Segments, Vertices
deconstruct_24 = Deconstruct(Point=explode_15.Vertices)  # -> XComponent, YComponent, ZComponent
sort_list_35 = SortList(Keys=deconstruct_24.YComponent)  # -> Keys, ValuesValuesA
list_item_83 = ListItem(List=sort_list_35.Keys, Index=0, Wrap=True)
list_item_84 = ListItem(List=sort_list_35.Keys, Index="-1", Wrap=True)
subtraction_23 = Subtraction(A=list_item_83, B=list_item_84)
absolute_5 = Absolute(Value=subtraction_23)  # -> flatten(Result)
mass_addition_2 = MassAddition(Input=absolute_5)  # -> Result, PartialResults
cull_index_22 = CullIndex(List=mass_addition_2.PartialResults, Indices="-1", Wrap=True)
merge_41 = Merge(Data1=flatten("0"), Data2=flatten(cull_index_22))  # -> flatten(Result)
list_item_85 = ListItem(List=flatten(list_item_83), Index=0, Wrap=True)
addition_19 = Addition(A=flatten(list_item_85), B=merge_41)
construct_point_9 = ConstructPoint(XCoordinate=0, YCoordinate=addition_19, ZCoordinate=0)
brep_join_2 = BrepJoin(Breps=curve_40)  # -> flatten(Breps), Closed
xy_plane_6 = XYPlane(Origin=construct_point_9)
scale_nu_4 = ScaleNU(Geometry=brep_join_2.Breps, Plane=xy_plane_6, ScaleX=1, ScaleY=Slider(0.05, range=0..1), ScaleZ=1)  # -> Geometry, Transform
curve_43 = Curve(scale_nu_4.Geometry)

list_item_86 = ListItem(List=curve_39, Index=0, Wrap=True)
explode_16 = Explode(Curve=list_item_86, Recursive=True)  # -> Segments, Vertices
deconstruct_25 = Deconstruct(Point=explode_16.Vertices)  # -> XComponent, YComponent, ZComponent
sort_list_36 = SortList(Keys=deconstruct_25.YComponent)  # -> Keys, ValuesValuesA
list_item_87 = ListItem(List=sort_list_36.Keys, Index=0, Wrap=True)
list_item_88 = ListItem(List=sort_list_36.Keys, Index="-1", Wrap=True)
subtraction_24 = Subtraction(A=list_item_87, B=list_item_88)
absolute_6 = Absolute(Value=subtraction_24)  # -> flatten(Result)
mass_addition_3 = MassAddition(Input=absolute_6)  # -> Result, PartialResults
cull_index_23 = CullIndex(List=mass_addition_3.PartialResults, Indices="-1", Wrap=True)
merge_42 = Merge(Data1=flatten("0"), Data2=flatten(cull_index_23))  # -> flatten(Result)
list_item_89 = ListItem(List=flatten(list_item_87), Index=0, Wrap=True)
addition_20 = Addition(A=flatten(list_item_89), B=merge_42)
construct_point_10 = ConstructPoint(XCoordinate=0, YCoordinate=addition_20, ZCoordinate=0)
brep_join_3 = BrepJoin(Breps=curve_39)  # -> flatten(Breps), Closed
xy_plane_7 = XYPlane(Origin=construct_point_10)
scale_nu_5 = ScaleNU(Geometry=brep_join_3.Breps, Plane=xy_plane_7, ScaleX=1, ScaleY=Slider(0.05, range=0..1), ScaleZ=1)  # -> Geometry, Transform
curve_44 = Curve(scale_nu_5.Geometry)

# ---- group: Sort packed rubble by row
surface_19 = Surface(surface_17)
area_21 = Area(Geometry=surface_19)  # -> Area, Centroid
construct_domain_14 = ConstructDomain(DomainStart=list_item_79, DomainEnd=list_item_80)  # -> flatten(Domain)
deconstruct_26 = Deconstruct(Point=area_21.Centroid)  # -> XComponent, YComponent, ZComponent
includes_7 = Includes(Value=deconstruct_26.YComponent, Domain=graft(construct_domain_14))  # -> Includes, Deviation
simplify_tree_7 = SimplifyTree(Tree=includes_7.Includes, Front=False)
member_index_10 = MemberIndex(Set=simplify_tree_7, Member=Toggle(True))  # -> Index, flatten(Count)
partition_list_20 = PartitionList(List=flatten(surface_19), Size=member_index_10.Count)

surface_20 = Surface(surface_18)
area_22 = Area(Geometry=surface_20)  # -> Area, Centroid
construct_domain_15 = ConstructDomain(DomainStart=list_item_83, DomainEnd=list_item_84)  # -> flatten(Domain)
deconstruct_27 = Deconstruct(Point=area_22.Centroid)  # -> XComponent, YComponent, ZComponent
includes_8 = Includes(Value=deconstruct_27.YComponent, Domain=graft(construct_domain_15))  # -> Includes, Deviation
simplify_tree_8 = SimplifyTree(Tree=includes_8.Includes, Front=False)
member_index_11 = MemberIndex(Set=simplify_tree_8, Member=Toggle(True))  # -> Index, flatten(Count)
partition_list_21 = PartitionList(List=flatten(surface_20), Size=member_index_11.Count)

surface_21 = Surface(surface_16)
area_23 = Area(Geometry=surface_21)  # -> Area, Centroid
construct_domain_16 = ConstructDomain(DomainStart=list_item_87, DomainEnd=list_item_88)  # -> flatten(Domain)
deconstruct_28 = Deconstruct(Point=area_23.Centroid)  # -> XComponent, YComponent, ZComponent
includes_9 = Includes(Value=deconstruct_28.YComponent, Domain=graft(construct_domain_16))  # -> Includes, Deviation
simplify_tree_9 = SimplifyTree(Tree=includes_9.Includes, Front=False)
member_index_12 = MemberIndex(Set=simplify_tree_9, Member=Toggle(True))  # -> Index, flatten(Count)
partition_list_22 = PartitionList(List=flatten(surface_21), Size=member_index_12.Count)

# ---- group: Scaled down rubble
curve_45 = Curve(curve_41)
explode_17 = Explode(Curve=curve_45, Recursive=True)  # -> Segments, Vertices
length_3 = Length(Curve=explode_17.Segments)
sort_list_37 = SortList(Keys=length_3, ValuesValuesA=explode_17.Segments)  # -> Keys, ValuesValuesA
list_item_90 = ListItem(List=sort_list_37.ValuesValuesA, Index="-1", Wrap=True)
unit_x_22 = UnitX(Factor=expr("-x", 1))
end_points = EndPoints(Curve=list_item_90)  # -> Start, End
orient_direction = OrientDirection(
    Geometry=curve_45,
    PointA=flatten(end_points.Start),
    DirectionA=flatten(list_item_90),
    PointB=flatten(end_points.Start),
    DirectionB=flatten(unit_x_22))  # -> Geometry, Transform
mirror_12 = Mirror(Geometry=orient_direction.Geometry, Plane=PlaneYZ(0, 0, 0))  # -> Geometry, Transform
merge_43 = Merge(Data1=orient_direction.Geometry, Data2=mirror_12.Geometry)
list_length_16 = ListLength(List=merge_43)  # -> expr("x-1", Length)
construct_domain_17 = ConstructDomain(DomainStart=0, DomainEnd=list_length_16)
random_6 = Random(Range=construct_domain_17, Number=Slider(300, range=0..1000), Seed=Slider(100, range=0..100))
integer = Integer(random_6)
list_item_91 = ListItem(List=merge_43, Index=integer, Wrap=True)
area_24 = Area(Geometry=list_item_91)  # -> Area, Centroid
scale_5 = Scale(Geometry=list_item_91, Center=area_24.Centroid, Factor=scale_for_scaled_down_rubble_pieces)  # -> Geometry, Transform

# ---- group: Defining void geometries
merge_44 = Merge(Data1=graft(curve_42), Data2=partition_list_20)
simplify_tree_10 = SimplifyTree(Tree=merge_44, Front=False)
brep_join_4 = BrepJoin(Breps=flatten(curve_38))  # -> Breps, Closed
solid_union = SolidUnion(Breps=simplify_tree_10)
solid_difference = SolidDifference(BrepsA=brep_join_4.Breps, BrepsB=flatten(solid_union))

merge_45 = Merge(Data1=graft(curve_43), Data2=partition_list_21)
simplify_tree_11 = SimplifyTree(Tree=merge_45, Front=False)
brep_join_5 = BrepJoin(Breps=flatten(curve_40))  # -> Breps, Closed
solid_union_2 = SolidUnion(Breps=simplify_tree_11)
solid_difference_2 = SolidDifference(BrepsA=brep_join_5.Breps, BrepsB=flatten(solid_union_2))

merge_46 = Merge(Data1=graft(curve_44), Data2=partition_list_22)
simplify_tree_12 = SimplifyTree(Tree=merge_46, Front=False)
brep_join_6 = BrepJoin(Breps=flatten(curve_39))  # -> Breps, Closed
solid_union_3 = SolidUnion(Breps=simplify_tree_12)
solid_difference_3 = SolidDifference(BrepsA=brep_join_6.Breps, BrepsB=flatten(solid_union_3))

# ----
brep = Brep([solid_difference, solid_difference_2, solid_difference_3])
area_25 = Area(Geometry=brep)  # -> Area, Centroid
sort_list_38 = SortList(Keys=area_25.Area, ValuesValuesA=brep)  # -> Keys, ValuesValuesA
reverse_list_2 = ReverseList(List=sort_list_38.ValuesValuesA)

# ---- group: OPENNEST
crv_2 = Curve(reverse_list_2)
sheets = Sheets(Gap=Slider(0, range=0..100), Rows=Slider(1, range=1..20), Copies=Slider(1, range=1..1000), Polylines=graft(crv_2))  # -> Sheets, Polylines

# ----
data_dam = DataDam(DataMainWall=curve_38, BufferDelay=10000000, BufferMode=0)

# ----
# Structural Verification
# Find start and end points
surface_22 = Surface(data_dam)
surface_23 = Surface()
surface_24 = Surface()
explode_18 = Explode(Curve=flatten(surface_22), Recursive=True)  # -> Segments, flatten(Vertices)
deconstruct_29 = Deconstruct(Point=explode_18.Vertices)  # -> XComponent, YComponent, ZComponent
sort_list_39 = SortList(Keys=deconstruct_29.YComponent)  # -> Keys, ValuesValuesA
sort_list_40 = SortList(Keys=deconstruct_29.YComponent)  # -> Keys, ValuesValuesA
brep_join_7 = BrepJoin(Breps=surface_22)  # -> flatten(Breps), Closed
list_item_92 = ListItem(List=sort_list_39.Keys, Index="-1", Wrap=True)
list_item_93 = ListItem(List=sort_list_40.Keys, Index=0, Wrap=True)
member_index_13 = MemberIndex(Set=deconstruct_29.YComponent, Member=list_item_93)  # -> Index, Count
member_index_14 = MemberIndex(Set=deconstruct_29.YComponent, Member=list_item_92)  # -> Index, Count
list_item_94 = ListItem(List=explode_18.Vertices, Index=member_index_13.Index, Wrap=True)
list_item_95 = ListItem(List=explode_18.Vertices, Index=member_index_14.Index, Wrap=True)
sort_duplicate_values_13 = SortDuplicateValues(ValueList=list_item_94)  # -> UniqueValues, Indices
sort_duplicate_values_14 = SortDuplicateValues(ValueList=list_item_95)  # -> UniqueValues, Indices
sort_points_2 = SortPoints(Points=sort_duplicate_values_13.UniqueValues)  # -> Points, Indices
sort_points_3 = SortPoints(Points=sort_duplicate_values_14.UniqueValues)  # -> Points, Indices
list_length_17 = ListLength(List=sort_points_2.Points)
split_list_5 = SplitList(List=sort_points_3.Points, Index=list_length_17)  # -> ListA, ListB
point_9 = Point(sort_points_2.Points)
point_10 = Point(split_list_5.ListA)

# ----
# Checking for collisions
surface_25 = Surface(boundary_surfaces_4)

# ----
# Moving points
line_13 = Line(StartPoint=point_9, EndPoint=point_10)
split_with_breps = SplitWithBreps(Curve=line_13, Brep=flatten(brep_join_7.Breps))  # -> Curve, Points
divide_curve = DivideCurve(Curve=split_with_breps.Curve, Count=divisions_between_rows, Kinks=False)  # -> Points, Tangents, Parameters
multiplication_40 = Multiplication(A=gene_pool, B=multiplication_37)
merge_47 = Merge(Data1=flatten("0"), Data2=flatten(multiplication_40), Data3=flatten("0"))
unit_x_23 = UnitX(Factor=merge_47)

simplify_tree_13 = SimplifyTree(Tree=divide_curve.Points, Front=False)
trim_tree_10 = TrimTree(Tree=simplify_tree_13, Depth=1)

point_11 = Point(trim_tree_10)
tree_statistics_24 = TreeStatistics(Tree=point_11)  # -> Paths, Length, Count
list_item_96 = ListItem(List=tree_statistics_24.Paths, Index=shortest_path_to_test, Wrap=True)
tree_branch_14 = TreeBranch(Tree=point_11, Path=list_item_96, MaintainPaths=True)
list_length_18 = ListLength(List=tree_branch_14)  # -> expr("x-2", Length)
move_35 = Move(Geometry=tree_branch_14, Motion=unit_x_23)  # -> Geometry, Transform
removeduplicatepts = RemoveDuplicatePts(Points=move_35.Geometry, Tolerance=0.01)
polyline_13 = PolyLine(Vertices=removeduplicatepts, Closed=False)
length_4 = Length(Curve=polyline_13)
shortest_path_length = Panel(length_4)

required_number_of_fitness_sliders = Panel(list_length_18)

curve_46 = Curve(polyline_13)

stream_filter_23 = StreamFilter(Gate=type_of_rubble, Stream0=duplicate_data, Stream1=curve_45, Stream2=scale_5.Geometry)  # -> flatten(Stream)
list_item_97 = ListItem(List=reverse_list_2, Index=0, Wrap=True)

# ---- group: NESTGEO
curve_47 = Curve(stream_filter_23)
nest_geo_2 = Nest_geo(Outlines=curve_47, Simplify="0", Hull=Toggle(False), Copies="1")  # -> Nest_geo, Borders
curve_48 = Curve(nest_geo_2.Borders)

# ---- group: OPENNEST
opennest2 = OpenNest2(Sheets=sheets.Sheets, Geometry=nest_geo_2.Nest_geo, Options=options, Iterations=Slider(1, range=0..10), Run=pack_voids)  # -> Sheets, Borders, AllGeo, Transforms, SheetId, SheetTxt, Attributes

# ----
curve_49 = Curve(opennest2.AllGeo)
surface_26 = Surface(curve_49)
flip = Flip(Surface=surface_26, Guide=list_item_77)  # -> Surface, Result
custom_preview_5 = CustomPreview(Geometry=flip.Surface, Material=ColourSwatch(SwatchColor=RGB(28, 28, 28)))

curve_50 = Curve(nest_geo_2.Borders)
surface_27 = Surface(flip.Surface)

surface_28 = Surface(flip.Surface)
merge_48 = Merge(Data1=flatten(surface_25), Data2=flatten(surface_28))  # -> flatten(Result)
surface_29 = Surface(merge_48)
offset_curve = OffsetCurve(Curve=surface_29, Distance=Slider(-2, range=-20..-1), Corners=1)
surface_30 = Surface(offset_curve)
collision_one_many = CollisionOneMany(Collider=polyline_13, Obstacles=surface_30)  # -> flatten(Collision), flatten(Index)
dispatch_14 = Dispatch(List=flatten(surface_30), DispatchPattern=collision_one_many.Collision)  # -> ListA, ListB
surface_split_9 = SurfaceSplit(Surface=dispatch_14.ListA, Curves=polyline_13)
simplify_tree_14 = SimplifyTree(Tree=surface_split_9, Front=False)
area_26 = Area(Geometry=simplify_tree_14)  # -> Area, Centroid
sort_list_41 = SortList(Keys=area_26.Area, ValuesValuesA=simplify_tree_14)  # -> Keys, ValuesValuesA
list_item_98 = ListItem(List=sort_list_41.Keys, Index=0, Wrap=True)
list_item_99 = ListItem(List=sort_list_41.ValuesValuesA, Index=0, Wrap=True)
mass_addition_4 = MassAddition(Input=flatten(list_item_98))  # -> Result, PartialResults
replace_nulls = ReplaceNulls(Items=mass_addition_4.Result, Replacements="0")  # -> Items, Count
multiplication_41 = Multiplication(A=replace_nulls.Items, B="1000")

addition_21 = Addition(A=length_4, B=multiplication_41)
length_with_negative_score = Panel(addition_21)

surface_31 = Surface(list_item_99)

addition_22 = Addition(A=length_4, B=multiplication_41)
length_with_negative_score_2 = Panel(addition_22)
