# Grasshopper definition 01_ROBOTSCRIPT.gh (Grasshopper 1.0.8)
# plug-ins: RhinoCodePluginGH, Robots, Bifocals

geometry = Geometry([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])
number = Number([69, 48, 136, 29, 11, 95, 99, 51, 56, 153, 55, 34, 166, 127])

# ----
# Internalised Input
data = Data([69, 48, 136, 24, 96, 108, 170, 71, 161, 182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])
panel = Panel(data)

# ----
# Activate Bifocals
geometry_2 = Geometry([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])
number_2 = Number([170, 71, 161, 182, 141, 158, 91, 86, 140, 151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])

geometry_3 = Geometry([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])
number_3 = Number([24, 96, 108, 76, 19, 100, 14, 52, 75, 181, 85, 115, 33, 160])

max_stone_number_per_row = Slider(2, range=1..10)
number_of_case_rows = Slider(10, range=0..20)
casing_width = Slider(52, range=0..100)

# ----
# Robot Program Input
# Casing
stone_thickness = Slider(50, range=0..100)
prototype_rotation = Slider(180, range=-180..180)
data_dam = DataDam(
    DataWall_Stone_Curves=geometry_2,
    DataWall_Stone_Numbers=number_2,
    DataRight_Butress_Curves=geometry,
    DataRight_Buttress_Numbers=number,
    DataLeft_Buttress_Curves=geometry_3,
    DataLeft_Buttress_Numbers=number_3,
    DataCorrect_Assembly_Order=panel,
    BufferDelay=10000000,
    BufferMode=0)  # -> DataWall_Stone_Curves, DataWall_Stone_Numbers, DataRight_Butress_Curves, DataRight_Buttress_Numbers, DataLeft_Buttress_Curves, DataLeft_Buttress_Numbers, DataCorrect_Assembly_Order

# ----
# Orient Stones to Table
# Wall
# right buttress
# left buttress
cluster = Cluster_8(content=data_dam.DataWall_Stone_Curves, geometry=data_dam.DataWall_Stone_Curves, factor=stone_thickness)  # -> flipped, geometry_2, geometry_3, plane
bounding_box = BoundingBox(Content=cluster.geometry_2, Plane=PlaneXY(0, 0, 0), UnionBox=True)  # -> Box, Box_2
deconstruct_brep = DeconstructBrep(Brep=bounding_box.Box)  # -> Faces, Edges, Vertices
list_item = ListItem(List=deconstruct_brep.Vertices, Index=0, Wrap=True)  # -> Item, Item1
xz_plane = XZPlane(Origin=list_item.Item1)
xz_plane_2 = XZPlane(Origin=list_item.Item)
cluster_2 = Cluster_9(geometry=data_dam.DataRight_Butress_Curves, target=xz_plane, content=data_dam.DataRight_Butress_Curves)
cluster_3 = Cluster_10(
    geometry_2=data_dam.DataLeft_Buttress_Curves,
    geometry=xz_plane_2,
    content=data_dam.DataLeft_Buttress_Curves,
    factor=stone_thickness)

# ----
# Resort into Assembly Order
merge = Merge(
    Data1=data_dam.DataWall_Stone_Numbers,
    Data2=data_dam.DataRight_Buttress_Numbers,
    Data3=data_dam.DataLeft_Buttress_Numbers)  # -> flatten(Result)
merge_2 = Merge(Data1=cluster_2, Data2=cluster.geometry_3, Data3=cluster_3)  # -> flatten(Result)
panel_2 = Panel(merge)
python_3_script = Python3Script(x=data_dam.DataCorrect_Assembly_Order, y=panel_2)  # -> out, a; inputs x: list, y: list
# ---------- python_3_script: Python ----------
# Initialize an empty list to store indices
indices = []

# Loop through each element in List A
for item in y:
    # Find the index of the current item in List x and add it to the indices list
    index_in_x = x.index(item)
    indices.append(index_in_x)

# Output the list of indices
a = indices
# ---------- end python_3_script ----------
sort_list = SortList(Keys=python_3_script.a, ValuesValuesA=merge_2)  # -> Keys, ValuesValuesA

# ----
# Rotate Prototype into Position
cluster_4 = Cluster_5(geometry=sort_list.ValuesValuesA, angle=degrees(prototype_rotation), content=sort_list.ValuesValuesA)

# ----
# Correct row alteration numbers for Assembly order
number_slider = Slider(40, range=0..70)
number_slider_2 = Slider(7, range=0..10)
panel_3 = Panel(data_dam.DataCorrect_Assembly_Order)
series = Series(Start=number_slider, Step=1, Count=number_slider_2)
cull_index = CullIndex(List=panel_3, Indices=series, Wrap=True)
list_item_2 = ListItem(List=panel_3, Index=series, Wrap=True)
subtraction = Subtraction(A=number_slider, B=Slider(4, range=0..10))
duplicate_data = DuplicateData(Data=subtraction, Number=number_slider_2, Order=True)
insert_items = InsertItems(List=cull_index, Item=list_item_2, Indices=duplicate_data, Wrap=True)

# ----
# Correct row alternation for Assembly order
number_slider_3 = Slider(40, range=0..70)
number_slider_4 = Slider(7, range=0..10)
series_2 = Series(Start=number_slider_3, Step=1, Count=number_slider_4)
cull_index_2 = CullIndex(List=cluster_4, Indices=series_2, Wrap=True)
list_item_3 = ListItem(List=cluster_4, Index=series_2, Wrap=True)
curve = Curve(cull_index_2)
subtraction_2 = Subtraction(A=number_slider_3, B=Slider(4, range=0..10))
duplicate_data_2 = DuplicateData(Data=subtraction_2, Number=number_slider_4, Order=True)
insert_items_2 = InsertItems(List=cull_index_2, Item=list_item_3, Indices=duplicate_data_2, Wrap=True)

number_slider_5 = Slider(60, range=0..70)
number_slider_6 = Slider(7, range=0..10)
series_3 = Series(Start=number_slider_5, Step=1, Count=number_slider_6)
cull_index_3 = CullIndex(List=insert_items_2, Indices=series_3, Wrap=True)
list_item_4 = ListItem(List=insert_items_2, Index=series_3, Wrap=True)
curve_2 = Curve(cull_index_3)
subtraction_3 = Subtraction(A=number_slider_5, B=Slider(3, range=0..10))
duplicate_data_3 = DuplicateData(Data=subtraction_3, Number=number_slider_6, Order=True)
insert_items_3 = InsertItems(List=cull_index_3, Item=list_item_4, Indices=duplicate_data_3, Wrap=True)

number_slider_7 = Slider(60, range=0..70)
number_slider_8 = Slider(7, range=0..10)
series_4 = Series(Start=number_slider_7, Step=1, Count=number_slider_8)
cull_index_4 = CullIndex(List=insert_items, Indices=series_4, Wrap=True)
list_item_5 = ListItem(List=insert_items, Index=series_4, Wrap=True)
subtraction_4 = Subtraction(A=number_slider_7, B=Slider(3, range=0..10))
duplicate_data_4 = DuplicateData(Data=subtraction_4, Number=number_slider_8, Order=True)
insert_items_4 = InsertItems(List=cull_index_4, Item=list_item_5, Indices=duplicate_data_4, Wrap=True)

# ----
# Simplify Shape
surface = Surface(insert_items_3)
simplification_threshhold = Slider(8, range=0..100)
deconstruct_brep_2 = DeconstructBrep(Brep=surface)  # -> Faces, Edges, Vertices
python_3_script_2 = Python3Script(segments=deconstruct_brep_2.Edges, threshold=simplification_threshhold)  # -> out, vertices; inputs segments: list of Line, threshold: Int32
# ---------- python_3_script_2: Python ----------
import System
import Rhino
import Grasshopper

import rhinoscriptsyntax as rs
import ghpythonlib.components as gh

curves = []
for i in range(len(segments)):
    length = gh.Length(segments[i])
    if length > threshold:
        scaled = gh.Scale(segments[i], gh.CurveMiddle(segments[i]), 2)['geometry']
        curves.append(scaled)
    else:
        continue


curve_r = len(curves)-1

vertices = []
for i in range(1,len(curves)):
    inter_p = gh.CurveXCurve(curves[i-1], curves[i])['points']
    vertices.append(inter_p)

end_p = gh.CurveXCurve(curves[0], curves[curve_r])['points']
vertices.append(end_p)



#new_outline = gh.PolyLine(vertices, close=True)
# ---------- end python_3_script_2 ----------
polyline = PolyLine(Vertices=python_3_script_2.vertices, Closed=True)
boundary_surfaces = BoundarySurfaces(Edges=polyline)  # -> flatten(Surfaces)
md_slider = MDSlider(SliderMode=0, slider_value=Point(0.5, 0.5, 0.5), x_domain=Domain(0, 1), y_domain=Domain(0, 1), z_domain=Domain(0, 1))
surface_2 = Surface(boundary_surfaces)
evaluate_surface = EvaluateSurface(Surface=reparameterize(surface_2), Point=md_slider)  # -> Point, Normal, UDirection, VDirection, Frame
amplitude = Amplitude(Vector=evaluate_surface.Normal, Amplitude=Slider(50, range=0..100))
extrude = Extrude(Base=surface_2, Direction=amplitude)  # -> flatten(Extrusion)

# ----
# Placement in Casing
scale_line_up = Slider(1.7, range=0..5)
guide_crv = Curve(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)
cluster_5 = Cluster(
    list_3=extrude,
    geometry=guide_crv,
    curve=guide_crv,
    count_2=max_stone_number_per_row,
    factor=scale_line_up,
    count=number_of_case_rows,
    A=max_stone_number_per_row,
    factor_2=casing_width,
    x_axis=guide_crv)  # -> length, list, unit_vector, list_2, list_4, unit_vector_2
base_plate_thickness = Slider(2, range=0..10)
unit_z = UnitZ(Factor=base_plate_thickness)
move = Move(Geometry=cluster_5.list_4, Motion=unit_z)  # -> Geometry, Transform

move_to_the_side = Slider(25, range=0..50)
casing_height = Slider(25, range=0..50)
plate_thickness = Slider(2, range=0..50)
over_extension = Slider(1.05, range=0..5)

# ----
# Orient stones in casing
# Table Base
# Find largest bottom side face
curve_3 = Curve(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)
cluster_6 = Cluster_2(edges=curve_3, brep=extrude)  # -> surfaces, frame
orient = Orient(Geometry=extrude, Source=flatten(cluster_6.frame), Target=move.Geometry)  # -> Geometry, Transform

# ----
# Perpendicular Long Sides
# Separations
# Groove Tongue
cluster_7 = Cluster_11(
    geometry=guide_crv,
    direction=cluster_5.unit_vector,
    factor_4=plate_thickness,
    factor_3=casing_height,
    count=number_of_case_rows,
    factor=move_to_the_side,
    factor_2=over_extension)  # -> extrusion, geometry_2, unit_vector_2, unit_vector
cluster_8 = Cluster_12(amplitude=plate_thickness, curve=cluster_7.geometry_2, amplitude_2=plate_thickness, factor=casing_height)
cluster_9 = Cluster_13(breps_a_2=cluster_8, breps_a=cluster_8, breps_b=cluster_7.extrusion, breps_a_3=cluster_7.extrusion)  # -> result, result_2

# ----
# Small Stabilizers
cluster_10 = Cluster_14(motion_2=cluster_7.unit_vector_2, curve=cluster_7.geometry_2, motion=cluster_7.unit_vector, factor=plate_thickness)  # -> geometry, panel
cluster_11 = Cluster_15(breps_a=cluster_10.geometry, breps_a_2=cluster_10.geometry, list=cluster_9.result_2, indices=cluster_10.panel)  # -> result, result_2
solid_difference = SolidDifference(BrepsA=graft(cluster_10.geometry), BrepsB=cluster_11.result)

# ----
# Top Faces Placing
# Top Edge
# Choose Face
# Top Face
deconstruct_brep_3 = DeconstructBrep(Brep=extrude)  # -> Faces, Edges, Vertices
cluster_12 = Cluster_4(values_a=deconstruct_brep_3.Faces, geometry=deconstruct_brep_3.Faces, geometry_2=cluster_6.surfaces)  # -> i, geometry_3
cluster_13 = Cluster_3(curve=deconstruct_brep_3.Edges, surface=cluster_12.geometry_3, values_a=deconstruct_brep_3.Edges)
python_3_script_3 = Python3Script(
    curve=cluster_13,
    faces=deconstruct_brep_3.Faces,
    top_face=cluster_12.i,
    thresh_width=Slider(30, range=10..100),
    thresh_angle=Slider(7, range=0..45))  # -> out, adjacent_faces, face_01, face_02, check_edge; inputs curve: list of Curve, faces: list of Surface, top_face: list of Surface, thresh_width: Int32, thresh_angle: Int32
# ---------- python_3_script_3: Python ----------
# Filename: find_adjacent_faces.py
import rhinoscriptsyntax as rs
import ghpythonlib.components as gh
from typing import List, Tuple

def get_endpoints(curve) -> Tuple:
    """Get the endpoints of a given curve.

    Args:
        curve (object): Curve to get endpoints from.

    Returns:
        Tuple: Endpoints as a tuple (point1, point2).
    """
    return gh.EndPoints(curve)

def is_edge_equivalent(curve, edge) -> bool:
    """Check if a curve is equivalent to an edge by comparing endpoints.

    Args:
        curve (object): The main curve to check.
        edge (object): Edge to compare with the curve.

    Returns:
        bool: True if endpoints match, otherwise False.
    """
    curve_points = get_endpoints(curve)
    edge_points = get_endpoints(edge)
    return (curve_points[0] == edge_points[0] and curve_points[1] == edge_points[1]) or \
           (curve_points[0] == edge_points[1] and curve_points[1] == edge_points[0])

def find_adjacent_faces(curve, faces: List[object]) -> List[object]:
    """Identify faces adjacent to a specified curve in a multi-face geometry.

    Args:
        curve (object): The main curve to check against faces.
        faces (List[object]): List of face objects from the Brep.

    Returns:
        List[object]: Faces that are adjacent to the curve.
    """
    adjacent_faces = []
    p1, p2 = get_endpoints(curve)

    for face in faces:
        face_edges = gh.DeconstructBrep(face)['edges']
        
        for edge in face_edges:
            if is_edge_equivalent(curve, edge):
                adjacent_faces.append(face)
                break  # Stop further checks for this face once an edge is found

    return adjacent_faces

adjacent_faces = find_adjacent_faces(curve, faces)

face_01 = adjacent_faces[0]
face_02 = adjacent_faces[1]

edges = gh.DeconstructBrep(top_face)['edges']

for i in range(2):
    length = gh.Length(edges[i])
    if length != 50:
        width = length
        check_edge = edges[i]  
        x_ = abs(gh.DeconstructVector(check_edge)['x_component'])
        y_ = abs(gh.DeconstructVector(check_edge)['y_component'])
        if y_ == 0:
            angle = gh.Degrees(gh.Angle(check_edge, gh.UnitX(1))['angle'])
        elif x_ == 0:
            angle = gh.Degrees(gh.Angle(check_edge, gh.UnitY(1))['angle'])
        else:
            continue
    else:
        continue


if width >= thresh_width and angle <= thresh_angle:
    face_01 = top_face
    face_02 = top_face
# ---------- end python_3_script_3 ----------

# ----
# Base_plate
# Casing
number_slider_9 = Slider(1.05, range=0..2)
base_plate_thickness_2 = Slider(2, range=0..10)
cluster_14 = Cluster_7(
    scale_x=number_slider_9,
    scale_y=Slider(1.2, range=0..2),
    breps=[cluster_9.result, cluster_9.result_2],
    factor=base_plate_thickness_2)
cluster_15 = Cluster_16(
    breps_a_4=cluster_9.result_2,
    breps_b_3=cluster_11.result_2,
    breps_a=cluster_9.result_2,
    breps_b=cluster_14,
    breps_a_5=cluster_9.result,
    breps_a_3=cluster_14,
    breps_a_6=solid_difference,
    curve=cluster_7.geometry_2,
    breps_a_2=cluster_9.result,
    breps_b_2=cluster_14)  # -> result_2, result, result_3

brep = Brep(cluster_15.result)
brep_2 = Brep(cluster_15.result_3)
brep_3 = Brep(cluster_15.result_2)
brep_4 = Brep(solid_difference)

custom_preview = CustomPreview(Geometry=[brep, brep_2, brep_4, brep_3], Material=ColourSwatch(SwatchColor=RGBA(184, 183, 183, 184)))

# ----
# Markings
cull_index_5 = CullIndex(List=reverse(cluster_15.result_2), Indices=0, Wrap=True)  # -> reverse(List)
number_slider_10 = Slider(23, range=0..100)
dispatch = Dispatch(List=cull_index_5, DispatchPattern=[True, False])  # -> ListA, ListB
point = Point(cluster_5.list)
point_2 = Point(cluster_5.list_2)
brep_closest_point = BrepClosestPoint(Point=point, Brep=graft(dispatch.ListA))  # -> Point, Normal, Distance
brep_closest_point_2 = BrepClosestPoint(Point=point_2, Brep=graft(dispatch.ListB))  # -> Point, Normal, Distance
unit_z_2 = UnitZ(Factor=expr("-x", number_slider_10))
move_2 = Move(Geometry=brep_closest_point.Point, Motion=cluster_7.unit_vector)  # -> Geometry, Transform
move_3 = Move(Geometry=brep_closest_point_2.Point, Motion=cluster_7.unit_vector)  # -> Geometry, Transform
line_sdl = LineSDL(Start=move_2.Geometry, Direction=unit_z_2, Length=number_slider_10)
line_sdl_2 = LineSDL(Start=move_3.Geometry, Direction=unit_z_2, Length=number_slider_10)
curve_4 = Curve(flatten([line_sdl, line_sdl_2]))

# ----
# Lasercut Orientation
number_slider_11 = Slider(50, range=1..1000)
volume = Volume(Geometry=flatten(cluster_15.result))  # -> Volume, Centroid
volume_2 = Volume(Geometry=flatten(solid_difference))  # -> Volume, Centroid
volume_3 = Volume(Geometry=cluster_15.result_2)  # -> Volume, Centroid
merge_3 = Merge(Data1=cluster_15.result_2, Data2=flatten(cluster_15.result), Data3=flatten(solid_difference))  # -> flatten(Result)
xz_plane_3 = XZPlane(Origin=volume_3.Centroid)
list_length = ListLength(List=merge_3)
yz_plane = YZPlane(Origin=volume_2.Centroid)
yz_plane_2 = YZPlane(Origin=volume.Centroid)
point_3 = Point(<point referenced from the Rhino model>)
unit_y = UnitY(Factor=number_slider_11)
xy_plane = XYPlane(Origin=point_3)
merge_4 = Merge(Data1=xz_plane_3, Data2=yz_plane_2, Data3=yz_plane)  # -> flatten(Result)
linear_array = LinearArray(Geometry=xy_plane, Direction=unit_y, Count=list_length)  # -> Geometry, Transform
orient_2 = Orient(Geometry=merge_3, Source=merge_4, Target=linear_array.Geometry)  # -> Geometry, Transform

group_number = Slider(0, range=0..10)
multiplication = Multiplication(A=cluster_5.length, B=group_number)
series_5 = Series(Start=multiplication, Step=1, Count=cluster_5.length)

# ----
# Stone Numbers Placement
# Place Stones - Group
list_item_6 = ListItem(List=extrude, Index=series_5, Wrap=True)
area = Area(Geometry=list_item_6)  # -> Area, Centroid
panel_4 = Panel(insert_items_4)
list_item_7 = ListItem(List=panel_4, Index=series_5, Wrap=True)
move_4 = Move(Geometry=area.Centroid, Motion=Vector(0, 0, 10))  # -> Geometry, Transform
text_tag = TextTag(Location=move_4.Geometry, Text=list_item_7, Colour=RGB(255, 254, 68))
list_item_8 = ListItem(List=extrude, Index=series_5, Wrap=True)

# ----
# Pick Stone Numbers - Group
volume_4 = Volume(Geometry=orient.Geometry)  # -> Volume, Centroid
list_item_9 = ListItem(List=flatten(panel_4), Index=series_5, Wrap=True)
list_item_10 = ListItem(List=flatten(volume_4.Centroid), Index=series_5, Wrap=True)
text_tag_2 = TextTag(Location=list_item_10, Text=list_item_9, Colour=RGB(255, 254, 68))

# ----
# All Stones Placed
brep_5 = Brep(extrude)

# ----
# Pick Stones - Group
list_item_11 = ListItem(List=orient.Geometry, Index=series_5, Wrap=True)

# ----
# View Stones
colour_swatch = ColourSwatch(SwatchColor=RGB(36, 79, 133))
custom_preview_2 = CustomPreview(Geometry=[list_item_8, list_item_11], Material=colour_swatch)

# ----
# Close Gripper
boolean_toggle = BooleanToggle(True)
wait = Wait(Time=1)
wait_2 = Wait(Time=1)
set_do_close_gripper = SetDO(DO="8", Value=boolean_toggle)
merge_5 = Merge(Data1=wait, Data2=set_do_close_gripper, Data3=wait_2)
panel_5 = Panel(merge_5)
group_command_close_gripper = GroupCommand(Commands=merge_5)
panel_6 = Panel(group_command_close_gripper)

# ---- group: "Open Gripper" Program
# Open Gripper
boolean_toggle_2 = BooleanToggle(False)
wait_3 = Wait(Time=1)
wait_4 = Wait(Time=1)
set_do_open_gripper = SetDO(DO="8", Value=boolean_toggle_2)
merge_6 = Merge(Data1=wait_3, Data2=set_do_open_gripper, Data3=wait_4)
panel_7 = Panel(merge_6)
group_command_open_gripper = GroupCommand(Commands=merge_6)
panel_8 = Panel(group_command_open_gripper)

# ----
# Waiting Time for Mortar Application
number_slider_12 = Slider(3, range=0..120)
wait_5 = Wait(Time=number_slider_12)
panel_9 = Panel(wait_5)

# ----
# Pause the Robot
# Wait for Confirmation
panel_10 = Panel("popup(\"press CONTINUE to start the Program\", title=\"Start_Confirmation\", warning=False, blocking=True)")
custom_command = CustomCommand(Name="Start_Confirmation", Manufacturer="UR", Code=panel_10)
# Filter used and left over pieces
command_parameter = CommandParameter(custom_command)

# ---- group: Define the Tool
point_4 = Point(<point referenced from the Rhino model>)
xy_plane_2 = XYPlane(Origin=point_4)
rotate_plane = RotatePlane(Plane=xy_plane_2, Angle=degrees(90))
brep_6 = Brep(<brep referenced from the Rhino model>)
create_tool = CreateTool(Name="Gripper", TCP=rotate_plane, Weight="2.08", Mesh=brep_6)  # -> Tool, TCP

# ---- group: Load the robot
robots_library = RobotsLibrary({"TUDelft-LAMA-UR5 (missing)": "TUDelft-LAMA-UR5"}, selected="TUDelft-LAMA-UR5 (missing)", Type=0)
load_robot_system = LoadRobotSystem(Name=robots_library, Base=PlaneXY(0, 0, 0))

# ---- group: Find the PLACE PLANES points on the design
# PLACE PLANES
# Find medium plane
cluster_16 = Cluster_6(
    brep_a=python_3_script_3.face_01,
    brep_b=python_3_script_3.face_02,
    surface_2=python_3_script_3.face_01,
    surface=python_3_script_3.face_02)
inverse_transform = InverseTransform(Transform=orient.Transform)

# ---- group: Find the PICK PLANES on the brick station
# Avoid collision with casing
# PICK PLANES
# (PICK) APPROACH & RETRACT PLANES
transform = Transform(Geometry=cluster_16, Transform=graft(orient.Transform))
python_3_script_4 = Python3Script(planes=transform, cut_height=casing_height)  # -> out, updated_planes, angle, p_1, p_2, c_surface; inputs planes: list of Plane, cut_height: Int32
# ---------- python_3_script_4: Python ----------
# Filename: plane_cut_check.py
import rhinoscriptsyntax as rs
import ghpythonlib.components as gh
import math
from typing import Any

# Parameters
depth = 35
width = 23


def move_plane_if_cut(plane: Any, depth: float, width: float, cut_height: float, ) -> Any:
    """Checks if an object created fro m a base plane is intersected by a cut plane at `cut_height`.
    If an intersection occurs, moves the original plane up by the depth of the cut.

    Args:
        plane (Any): The base plane to start from.
        depth (float): The depth of the object created from the plane.
        width (float): The width of the created object.
        cut_height (float): The Z-height of the cut plane (XY plane) to check for intersection.

    Returns:
        Any: The modified plane, moved if an intersection occurs.
    """
    # Decompose the initial plane
    origin = gh.DeconstructPlane(plane)['origin']
    normal = gh.DeconstructPlane(plane)['origin']
    # Create offset plane
    b_plane = gh.PlaneOffset(plane, depth)
    b_origin = gh.DeconstructPlane(b_plane)['origin']
    axis = gh.DeconstructPlane(b_plane)['y-axis']
    
    # Define rectangle points
    p_1 = gh.Move(b_origin, gh.Amplitude(gh.UnitVector(axis), (width / 2)))['geometry']
    p_2 = gh.Move(b_origin, gh.Amplitude(gh.Reverse(axis), (width / 2)))['geometry']
    
    # Create surface from points
    c_surface = gh.BoundarySurfaces(gh.Rectangle3Pt(p_1, p_2, origin)['rectangle'])
    
    #get bottom two points
    z_p_1 = gh.Deconstruct(p_1)['z_component']
    z_p_2 = gh.Deconstruct(p_2)['z_component']

    #get angle of the plane normal 
    v1 = gh.Amplitude(gh.UnitVector(gh.DeconstructPlane(plane)['z-axis']), 25)
    v2 = gh.UnitZ(25)
    angle = gh.Angle(v1, v2, gh.XZPlane(origin))['angle']

    if z_p_1 <= cut_height or z_p_2 <= cut_height:
        a = cut_height - z_p_1
        b = (a/math.cos(angle))
        new_plane = gh.PlaneOffset(plane, b)
        return new_plane
    elif z_p_1 <= cut_height and z_p_2 <= cut_height:
        a = cut_height - z_p_1
        b = (a/math.cos(angle))
        new_plane = gh.PlaneOffset(plane, b)
        return new_plane
    elif z_p_1 == cut_height == z_p_2:
        new_plane = gh.PlaneOffset(plane, -5)
        return new_plane
    else:
        return plane
        print('no collision found!')


updated_planes = move_plane_if_cut(planes, depth, width, cut_height)


"""
    # Define XY plane at the cut height
    cut_plane = gh.ConstructPlane(rs.CreatePoint(0, 0, cut_height), gh.UnitX(1), gh.UnitY(1))
    
    # Check for intersection
    intersection = gh.BrepXPlane(c_surface, cut_plane)['curves']
    

    # If intersection occurs, move the original plane up by the depth
    if intersection:
        new_plane = gh.Move(plane, (0, 0, depth))['geometry']
        return new_plane
    else:
        return plane  # Return the original plane if no intersection
"""
# ---------- end python_3_script_4 ----------
unit_z_3 = UnitZ(Factor=Slider(5, range=0..500))
move_5 = Move(Geometry=python_3_script_4.updated_planes, Motion=unit_z_3)  # -> Geometry, Transform
flip_plane = FlipPlane(Plane=move_5.Geometry, ReverseX=False, ReverseY=False, SwapAxes=True)
unit_z_4 = UnitZ(Factor=Slider(150, range=0..500))
move_6 = Move(Geometry=flip_plane, Motion=unit_z_4)  # -> Geometry, Transform

# ---- group: Find the PLACE PLANES points on the design (continued)
transform_2 = Transform(Geometry=move_5.Geometry, Transform=graft(inverse_transform))
flip_plane_2 = FlipPlane(Plane=transform_2, ReverseX=False, ReverseY=False, SwapAxes=True)

# ---- group: Find the (PLACE) APPROACH & RETRACT points on the brick station
# (PLACE) APPROACH & RETRACT PLANES
# MOVE TABLE DOWN every second refill time
table_move = Slider(-190, range=-500..0)
lower_down_the_table = Python3Script(planes=flatten(flip_plane_2), slots=cluster_5.length, move_down=table_move)  # -> out, graft(planes), indices; inputs planes: list of Plane, slots: Int32, move_down: Int32
# ---------- lower_down_the_table: Python ----------
import System
import Rhino
import Grasshopper

import rhinoscriptsyntax as rs
import ghpythonlib.components as gh


rounds = round(len(planes)/(slots*2))

indices = []

for i in range(1, rounds):
    start = slots*i*2
    indices.append(start)
    index = gh.Series((start), 1, (len(planes) - (start)))
    items = gh.ListItem(planes, index, wrap=True)
    moved_items = gh.Move(items, gh.UnitZ(move_down))['geometry']
    planes = gh.ReplaceItems(planes, moved_items, index, wrap=False)
# ---------- end lower_down_the_table ----------
panel_11 = Panel(lower_down_the_table.indices)
unit_z_5 = UnitZ(Factor=Slider(110, range=0..500))
move_7 = Move(Geometry=lower_down_the_table.planes, Motion=unit_z_5)  # -> Geometry, Transform

# ----
# Pick Planes - Group
list_item_12 = ListItem(List=flatten(python_3_script_4.updated_planes), Index=series_5, Wrap=True)

# ----
# Mortar Attachment Point
number_slider_13 = Slider(-90, range=-180..180)
point_5 = Point(Point(-0.005594335797, -920.1199902, 552))
xz_plane_4 = XZPlane(Origin=point_5)
rotate = Rotate(Geometry=xz_plane_4, Angle=degrees(number_slider_13), Plane=xz_plane_4)  # -> Geometry, Transform
list_length_2 = ListLength(List=flatten(flip_plane))
repeat_data = RepeatData(Data=rotate.Geometry, Length=list_length_2)  # -> graft(Data)

# ---- group: Define the Home Position
# HOME POSITION
# Pause_Point
number_slider_14 = Slider(650, range=-500..1000)
construct_point = ConstructPoint(XCoordinate=Slider(-41, range=-500..500), YCoordinate=Slider(-435, range=-500..500), ZCoordinate=number_slider_14)
xz_plane_5 = XZPlane(Origin=construct_point)
rotate_2 = Rotate(Geometry=xz_plane_5, Angle=degrees(Slider(-90, range=-180..180)), Plane=xz_plane_5)  # -> Geometry, Transform
repeat_data_2 = RepeatData(Data=rotate_2.Geometry, Length=list_length_2)  # -> graft(Data)

# ----
# Pause the Robot
# Wait for Confirmation
length_of_weave_commands = Slider(8, range=0..10)
panel_12 = Panel(cluster_5.length)
python_3_script_5 = Python3Script(planes=flatten(flip_plane), loop_planes=length_of_weave_commands, slots=panel_12)  # -> out, indices; inputs planes: list of Plane, loop_planes: Int32, slots: Int32
# ---------- python_3_script_5: Python ----------
import System
import Rhino
import Grasshopper

import rhinoscriptsyntax as rs
import ghpythonlib.components as gh


rounds = round(len(planes)/slots)

indices = []

for i in range(1, rounds):
    start = slots*i*loop_planes
    indices.append(start)
# ---------- end python_3_script_5 ----------
panel_13 = Panel(python_3_script_5.indices)

# ---- group: Weave the planes in the correct order.
weave = Weave(
    Pattern=[0, 1, 2, 3, 4, 5, 6, 7],
    Stream0=move_6.Geometry,
    Stream1=flip_plane,
    Stream2=move_6.Geometry,
    Stream3=repeat_data,
    Stream4=move_7.Geometry,
    Stream5=lower_down_the_table.planes,
    Stream6=move_7.Geometry,
    Stream7=repeat_data_2,
    NullGaps=False)  # -> flatten(Weave)

# ---- group: Add the Home Position at the beginning and end of the list of targets
merge_7 = Merge(Data1=rotate_2.Geometry, Data2=weave, Data3=rotate_2.Geometry)

# ----
# Pause the Robot
# Wait for Confirmation
insert_items_5 = InsertItems(List=merge_7, Item=xz_plane_5, Indices=expr("x+1", python_3_script_5.indices), Wrap=True)

# ---- group: Create the list of movement types (Linear or Joint) in correct order
panel_14 = Panel("""Joint
Linear
Linear
Joint
Joint
Linear
Linear
Joint""")
list_length_3 = ListLength(List=weave)
duplicate_data_5 = DuplicateData(Data=panel_14, Number=expr("x/7", list_length_3), Order=True)
panel_15 = Panel("Joint")

# ----
# Pause the Robot
# Wait for Confirmation
insert_items_6 = InsertItems(List=duplicate_data_5, Item=panel_15, Indices=python_3_script_5.indices, Wrap=True)

# ---- group: Create the list of movement types (Linear or Joint) in correct order (continued)
list_length_4 = ListLength(List=insert_items_6)
merge_8 = Merge(Data1=0, Data2=list_length_4)  # -> flatten(Result)
insert_items_7 = InsertItems(List=insert_items_6, Item=panel_15, Indices=merge_8, Wrap=True)
panel_16 = Panel(insert_items_7)

# ---- group: Create the list of I/O commands (Gripper Open & Close) in correct order
merge_9 = Merge(Data1=group_command_close_gripper, Data2=wait_5, Data3=group_command_open_gripper)
insert_items_8 = InsertItems(List=group_command_open_gripper, Indices=0, Wrap=True)
insert_items_9 = InsertItems(List=merge_9, Indices=[1, 2, 3, 3, 3], Wrap=True)
panel_17 = Panel(insert_items_9)
panel_18 = Panel(insert_items_8)
repeat_data_3 = RepeatData(Data=insert_items_9, Length=list_length_3)
panel_19 = Panel(repeat_data_3)
merge_10 = Merge(Data1=insert_items_8, Data2=repeat_data_3)  # -> flatten(Result)

# ----
insert_items_10 = InsertItems(List=merge_10, Item=command_parameter, Indices=expr("x+1", python_3_script_5.indices), Wrap=True)

# ---- group: Define the targets and their variables
flag_fields = FlagFields({"Shoulder": 1, "Elbow": 2, "Wrist": 4}, selected="Shoulder")
speed_mm_s = Slider(90, range=0..100)
create_target = CreateTarget(
    Plane=insert_items_5,
    RobConf=flag_fields,
    Motion=insert_items_7,
    Tool=create_tool.Tool,
    Speed=speed_mm_s,
    Command=insert_items_10,
    IsCartesian=True)

# ----
# Control Segment
bwd = Button()
fwd = Button()
ghpython_script = GhPythonScript(x=fwd, y=bwd)  # -> out, a
# ---------- ghpython_script: Python ----------
if "count" not in globals():
     count = 0

if x:
    count += 1

if y:
    count -= 1

a = count
# ---------- end ghpython_script ----------
list_item_13 = ListItem(List=insert_items_5, Index=ghpython_script.a, Wrap=True)
panel_20 = Panel(ghpython_script.a)
index = Slider(266, range=0..600)
panel_21 = Panel(insert_items_10)
list_item_14 = ListItem(List=flatten(insert_items_5), Index=index, Wrap=True)

# ---- group: Create the robot program
# With this component the robot program is created. Read out any errors and warnings. And analyze the generated code when unexpected behaviour occurs.
create_program = CreateProgram(Name="UR5", RobotSystem=load_robot_system, Targets=create_target, StepSize=1)  # -> Program, Code, Duration, Warnings, Errors

# ---- group: Simulate the robot program
# Simulation
number_slider_15 = Slider(0, range=0..1)
program_simulation = ProgramSimulation(Program=create_program.Program, Time=number_slider_15, Normalized=True)  # -> SystemMeshes, JointRotations, Plane, Index, Time, Program, Errors
simple_trail = SimpleTrail(Program=program_simulation.Program, Length=500, MechanicalGroup=0)
custom_preview_3 = CustomPreview(Geometry=program_simulation.SystemMeshes, Material=ColourSwatch(SwatchColor=RGBA(79, 76, 114, 205)))

# ---- group: Connect and control the robot
dam = DataDam(DataA=create_program.Program, BufferDelay=10000000, BufferMode=0)
# Note 1: Component can be slow (up to 50s) when no connection is found, leave disabled when not in use. And remember to use Data dam when in use
# Note 2: When running, the program can be stopped by giving any movement input on the tablet.
# Note 3: Safety first! Make sure a group member is responsible to check for collisions and stop the robot when needed.
button = Button()
# This component establishes a connection with the robot over local LAN. Make sure you are connected to the ethernet cable (or adapter). If it doesnt work also disable your wifi connection to eduroam.
remote_connection = RemoteConnection(Program=dam, IP="192.168.1.198", Upload=Toggle(False), Play=Button(), Pause=button)

# ==== cluster Cluster
curve = ClusterInput()
curve_middle = CurveMiddle(Curve=curve)
geometry = ClusterInput()
factor = ClusterInput()
scale = Scale(Geometry=geometry, Center=curve_middle, Factor=factor)  # -> Geometry, Transform
factor_2 = ClusterInput()
unit_y = UnitY(Factor=expr("-x", factor_2))
count = ClusterInput()
unit_vector = ClusterOutput(unit_y)
linear_array = LinearArray(Geometry=scale.Geometry, Direction=unit_y, Count=count)  # -> Geometry, Transform
dispatch = Dispatch(List=linear_array.Geometry, DispatchPattern=[True, False])  # -> ListA, ListB
A = ClusterInput()
subtraction = Subtraction(A=A, B="1")
count_2 = ClusterInput()
divide_curve = DivideCurve(Curve=dispatch.ListA, Count=expr("x+1", count_2), Kinks=False)  # -> Points, Tangents, Parameters
divide_curve_2 = DivideCurve(Curve=dispatch.ListB, Count=expr("x+1", subtraction), Kinks=False)  # -> Points, Tangents, Parameters
number_slider = Slider(0, range=0..100)
cull_index = CullIndex(List=divide_curve.Points, Indices=number_slider, Wrap=True)
cull_index_2 = CullIndex(List=divide_curve_2.Points, Indices=number_slider, Wrap=True)
cull_index_3 = CullIndex(List=reverse(cull_index), Indices=number_slider, Wrap=True)
cull_index_4 = CullIndex(List=reverse(cull_index_2), Indices=number_slider, Wrap=True)
list = ClusterOutput(cull_index_3)
list_2 = ClusterOutput(cull_index_4)
list_item = ListItem(List=cull_index_3, Index=0, Wrap=True)  # -> Item, Item1
weave = Weave(Pattern=[0, 1, 2], Stream0=list_item.Item, Stream1=list_item.Item1, Stream2=cull_index_4, NullGaps=False)  # -> flatten(Weave)
list_3 = ClusterInput()
list_length = ListLength(List=weave)
list_length_2 = ListLength(List=list_3)
unit_y_2 = UnitY(Factor=expr("1", -1))
length = ClusterOutput(list_length)
panel = Panel(list_length_2)
division = Division(A=list_length_2, B=list_length)
x_axis = ClusterInput()
unit_vector_2 = ClusterOutput(unit_y_2)
round = Round(Number=division)  # -> Nearest, Floor, Ceiling
construct_plane = ConstructPlane(Origin=weave, XAxis=x_axis, YAxis=unit_y_2)
panel_2 = Panel(list_length)
multiplication = Multiplication(A=list_length, B=round.Ceiling)
panel_3 = Panel(round.Ceiling)
repeat_data = RepeatData(Data=construct_plane, Length=multiplication)
list_length_3 = ListLength(List=repeat_data)
subtraction_2 = Subtraction(A=list_length_3, B=list_length_2)
series = Series(Start=list_length_2, Step=1, Count=subtraction_2)
panel_4 = Panel(subtraction_2)
cull_index_5 = CullIndex(List=repeat_data, Indices=series, Wrap=True)
list_4 = ClusterOutput(cull_index_5)

# ==== cluster Cluster_2
brep = ClusterInput()
edges = ClusterInput()
deconstruct_brep = DeconstructBrep(Brep=brep)  # -> Faces, Edges, Vertices
boundary_surfaces = BoundarySurfaces(Edges=edges)
python_3_script = Python3Script(object_faces=deconstruct_brep.Faces)  # -> out, face_list; inputs object_faces: list of Surface
# ---------- python_3_script: Python ----------
import System
import Rhino
import Grasshopper

import rhinoscriptsyntax as rs
import ghpythonlib.components as gh


face_list = []
for face in object_faces:
    edges = gh.DeconstructBrep(face)['edges']
    for i in range(3):
        length = gh.Length(edges[i])
        if length == 50.0:
            face_list.append(face)
        else:
            continue

"""
    u_ = gh.Dimensions(face)['u_dimension']
    v_ = gh.Dimensions(face)['v_dimension']
    if u_== 50.0 or v_ ==50.00:
        face_list.append(face)
    else:
        continue
"""
# ---------- end python_3_script ----------
surfaces = ClusterOutput(boundary_surfaces)
area = Area(Geometry=python_3_script.face_list)  # -> Area, Centroid
surface_closest_point = SurfaceClosestPoint(Point=area.Centroid, Surface=boundary_surfaces)  # -> Point, UVPoint, Distance
sort_list = SortList(Keys=surface_closest_point.Distance, ValuesValuesA=python_3_script.face_list)  # -> Keys, ValuesValuesA
list_item = ListItem(List=sort_list.ValuesValuesA, Index=0, Wrap=True)  # -> Item, Item1, Item2
python_3_script_2 = Python3Script(face_1=flatten(list_item.Item), face_2=flatten(list_item.Item1))  # -> out, face; inputs face_1: list of Surface, face_2: list of Surface, face_3: list of Surface
# ---------- python_3_script_2: Python ----------
import System
import Rhino
import Grasshopper

import rhinoscriptsyntax as rs
import ghpythonlib.components as gh

area_1 = []

for face in face_1:
    area = gh.Area(face)['area']
    area_1.append(area)

area_2 = []

for face in face_2:
    area = gh.Area(face)['area']
    area_2.append(area)

"""
area_3 = []

for face in face_3:
    area = gh.Area(face)['area']
    area_3.append(area)
"""
_face = []

for i in range(len(face_1)):
    max_area = max(area_1[i], area_2[i]) #area_3[i]
    if max_area == area_1[i]:
        _face.append(face_1[i])
    elif max_area == area_2[i]:
        _face.append(face_2[i])
    else:
        print(f"Error at number{i}")
    """
    elif max_area == area_3[i]:
        _face.append(face_3[i])
    """
# ---------- end python_3_script_2 ----------
md_slider = MDSlider(SliderMode=0, slider_value=Point(0.5, 0.5, 0.5), x_domain=Domain(0, 1), y_domain=Domain(0, 1), z_domain=Domain(0, 1))
surface = Surface(graft(python_3_script_2.face))
evaluate_surface = EvaluateSurface(Surface=reparameterize(surface), Point=md_slider)  # -> Point, Normal, UDirection, VDirection, flatten(Frame)
frame = ClusterOutput(evaluate_surface.Frame)

# ==== cluster Cluster_3
curve = ClusterInput()
curve_middle = CurveMiddle(Curve=curve)
surface = ClusterInput()
surface_closest_point = SurfaceClosestPoint(Point=curve_middle, Surface=surface)  # -> Point, UVPoint, Distance
values_a = ClusterInput()
sort_list = SortList(Keys=surface_closest_point.Distance, ValuesValuesA=values_a)  # -> Keys, ValuesValuesA
list_item = ListItem(List=sort_list.ValuesValuesA, Index=0, Wrap=True)
i = ClusterOutput(list_item)

# ==== cluster Cluster_4
unit_z = UnitZ(Factor=Slider(750, range=0..1000))
geometry = ClusterInput()
geometry_2 = ClusterInput()
area = Area(Geometry=geometry)  # -> Area, Centroid
move = Move(Geometry=geometry_2, Motion=unit_z)  # -> Geometry, Transform
surface_closest_point = SurfaceClosestPoint(Point=area.Centroid, Surface=move.Geometry)  # -> Point, UVPoint, Distance
geometry_3 = ClusterOutput(move.Geometry)
values_a = ClusterInput()
sort_list = SortList(Keys=surface_closest_point.Distance, ValuesValuesA=values_a)  # -> Keys, ValuesValuesA
panel = Panel(surface_closest_point.Distance)
list_item = ListItem(List=sort_list.ValuesValuesA, Index=0, Wrap=True)  # -> Item, Item1
i = ClusterOutput(list_item.Item)

# ==== cluster Cluster_5
content = ClusterInput()
bounding_box = BoundingBox(Content=content, Plane=PlaneXY(0, 0, 0), UnionBox=True)  # -> Box, Box_2
volume = Volume(Geometry=bounding_box.Box)  # -> Volume, Centroid
xy_plane = XYPlane(Origin=volume.Centroid)
geometry = ClusterInput()
angle = ClusterInput()
rotate = Rotate(Geometry=geometry, Angle=degrees(angle), Plane=xy_plane)  # -> Geometry, Transform
geometry_2 = ClusterOutput(rotate.Geometry)

# ==== cluster Cluster_6
md_slider = MDSlider(SliderMode=0, slider_value=Point(0.5, 0.5, 0.5), x_domain=Domain(0, 1), y_domain=Domain(0, 1), z_domain=Domain(0, 1))
surface = ClusterInput()
evaluate_surface = EvaluateSurface(Surface=reparameterize(surface), Point=md_slider)  # -> Point, Normal, UDirection, VDirection, Frame
surface_2 = ClusterInput()
evaluate_surface_2 = EvaluateSurface(Surface=reparameterize(surface_2), Point=md_slider)  # -> Point, Normal, UDirection, VDirection, Frame
brep_a = ClusterInput()
brep_b = ClusterInput()
brep_brep = BrepBrep(BrepA=brep_a, BrepB=brep_b)  # -> Curves, Points
deconstruct_vector = DeconstructVector(Vector=evaluate_surface_2.Normal)  # -> XComponent, YComponent, ZComponent
deconstruct_vector_2 = DeconstructVector(Vector=evaluate_surface.Normal)  # -> XComponent, YComponent, ZComponent
polygon_center = PolygonCenter(Polyline=brep_brep.Curves)  # -> CenterV, CenterE, CenterA
addition = Addition(A=deconstruct_vector.XComponent, B=deconstruct_vector_2.XComponent)
addition_2 = Addition(A=deconstruct_vector.YComponent, B=deconstruct_vector_2.YComponent)
addition_3 = Addition(A=deconstruct_vector.ZComponent, B=deconstruct_vector_2.ZComponent)
vector_xyz = VectorXYZ(XComponent=addition, YComponent=addition_2, ZComponent=addition_3)  # -> Vector, Length
adjust_plane = AdjustPlane(Plane=evaluate_surface_2.Frame, Normal=vector_xyz.Vector)
plane_origin = PlaneOrigin(Base=adjust_plane, Origin=polygon_center.CenterV)
plane = ClusterOutput(plane_origin)

# ==== cluster Cluster_7
breps = ClusterInput()
brep_join = BrepJoin(Breps=flatten(breps))  # -> Breps, Closed
xy_plane = XYPlane(Origin=Point(0, 0, 0))
bounding_box = BoundingBox(Content=brep_join.Breps, Plane=xy_plane, UnionBox=True)  # -> Box, Box_2
deconstruct_brep = DeconstructBrep(Brep=bounding_box.Box)  # -> Faces, Edges, Vertices
area = Area(Geometry=deconstruct_brep.Faces)  # -> Area, Centroid
surface = Surface(<surface referenced from the Rhino model>)
surface_closest_point = SurfaceClosestPoint(Point=area.Centroid, Surface=surface)  # -> Point, UVPoint, Distance
sort_list = SortList(Keys=surface_closest_point.Distance, ValuesValuesA=deconstruct_brep.Faces)  # -> Keys, ValuesValuesA
list_item = ListItem(List=sort_list.ValuesValuesA, Index=0, Wrap=True)
area_2 = Area(Geometry=list_item)  # -> Area, Centroid
xy_plane_2 = XYPlane(Origin=area_2.Centroid)
scale_x = ClusterInput()
scale_y = ClusterInput()
factor = ClusterInput()
scale_nu = ScaleNU(Geometry=list_item, Plane=xy_plane_2, ScaleX=scale_x, ScaleY=scale_y, ScaleZ=1)  # -> Geometry, Transform
unit_z = UnitZ(Factor=factor)
extrude = Extrude(Base=scale_nu.Geometry, Direction=unit_z)
extrusion = ClusterOutput(extrude)

# ==== cluster Cluster_8
content = ClusterInput()
bounding_box = BoundingBox(Content=content, Plane=PlaneXY(0, 0, 0), UnionBox=True)  # -> Box, Box_2
deconstruct_brep = DeconstructBrep(Brep=bounding_box.Box)  # -> Faces, Edges, Vertices
point = Point(Point(2477.841024, 0, -95))
curve_closest_point = CurveClosestPoint(Point=point, Curve=deconstruct_brep.Edges)  # -> Point, Parameter, Distance
sort_list = SortList(Keys=curve_closest_point.Distance, ValuesValuesA=deconstruct_brep.Edges)  # -> Keys, ValuesValuesA
point_2 = Point(Point(315, 0, -45))
list_item = ListItem(List=sort_list.ValuesValuesA, Index=0, Wrap=True)
yz_plane = YZPlane(Origin=point_2)
curve_middle = CurveMiddle(Curve=list_item)
flip_plane = FlipPlane(Plane=yz_plane, FlipX=True, FlipY=False, FlipZ=False)  # -> Flipped, ResultBoolean
xy_plane = XYPlane(Origin=curve_middle)
geometry = ClusterInput()
flipped = ClusterOutput(flip_plane.Flipped)
plane = ClusterOutput(xy_plane)
orient = Orient(Geometry=geometry, Source=xy_plane, Target=flip_plane.Flipped)  # -> Geometry, Transform
panel = Panel(ClusterInput())
area = Area(Geometry=orient.Geometry)  # -> Area, Centroid
factor = ClusterInput()
geometry_2 = ClusterOutput(orient.Geometry)
unit_x = UnitX(Factor=factor)
text_tag = TextTag(Location=area.Centroid, Text=panel)
move = Move(Geometry=orient.Geometry, Motion=unit_x)  # -> Geometry, Transform
geometry_3 = ClusterOutput(move.Geometry)

# ==== cluster Cluster_9
content = ClusterInput()
bounding_box = BoundingBox(Content=content, Plane=PlaneXY(0, 0, 0), UnionBox=True)  # -> Box, Box_2
deconstruct_brep = DeconstructBrep(Brep=bounding_box.Box)  # -> Faces, Edges, Vertices
md_slider = MDSlider(SliderMode=0, slider_value=Point(0.5, 0.5, 0.5), x_domain=Domain(0, 1), y_domain=Domain(0, 1), z_domain=Domain(0, 1))
list_item = ListItem(List=deconstruct_brep.Vertices, Index=0, Wrap=True)
evaluate_surface = EvaluateSurface(Surface=bounding_box.Box, Point=md_slider)  # -> Point, Normal, UDirection, VDirection, Frame
plane_origin = PlaneOrigin(Base=evaluate_surface.Frame, Origin=list_item)
geometry = ClusterInput()
target = ClusterInput()
orient = Orient(Geometry=geometry, Source=plane_origin, Target=target)  # -> Geometry, Transform
geometry_2 = ClusterOutput(orient.Geometry)

# ==== cluster Cluster_10
content = ClusterInput()
bounding_box = BoundingBox(Content=content, Plane=PlaneXY(0, 0, 0), UnionBox=True)  # -> Box, Box_2
deconstruct_brep = DeconstructBrep(Brep=bounding_box.Box)  # -> Faces, Edges, Vertices
md_slider = MDSlider(SliderMode=0, slider_value=Point(0.5, 0.5, 0.5), x_domain=Domain(0, 1), y_domain=Domain(0, 1), z_domain=Domain(0, 1))
list_item = ListItem(List=deconstruct_brep.Vertices, Index=0, Wrap=True)
evaluate_surface = EvaluateSurface(Surface=bounding_box.Box, Point=md_slider)  # -> Point, Normal, UDirection, VDirection, Frame
plane_origin = PlaneOrigin(Base=evaluate_surface.Frame, Origin=list_item)
factor = ClusterInput()
unit_y = UnitY(Factor=factor)
geometry = ClusterInput()
move = Move(Geometry=geometry, Motion=unit_y)  # -> Geometry, Transform
geometry_2 = ClusterInput()
orient = Orient(Geometry=geometry_2, Source=plane_origin, Target=move.Geometry)  # -> Geometry, Transform
geometry_3 = ClusterOutput(orient.Geometry)

# ==== cluster Cluster_11
factor = ClusterInput()
unit_y = UnitY(Factor=factor)
geometry = ClusterInput()
move = Move(Geometry=geometry, Motion=unit_y)  # -> Geometry, Transform
direction = ClusterInput()
count = ClusterInput()
linear_array = LinearArray(Geometry=move.Geometry, Direction=direction, Count=expr("x+1", count))  # -> Geometry, Transform
geometry_2 = ClusterOutput(linear_array.Geometry)
curve_middle = CurveMiddle(Curve=linear_array.Geometry)
factor_2 = ClusterInput()
scale = Scale(Geometry=linear_array.Geometry, Center=curve_middle, Factor=factor_2)  # -> Geometry, Transform
factor_3 = ClusterInput()
unit_z = UnitZ(Factor=factor_3)
end_points = EndPoints(Curve=scale.Geometry)  # -> Start, End
unit_vector = ClusterOutput(unit_z)
move_2 = Move(Geometry=end_points.Start, Motion=unit_z)  # -> Geometry, Transform
rectangle_3pt = Rectangle3Pt(PointA=end_points.Start, PointB=end_points.End, PointC=move_2.Geometry)  # -> Rectangle, Length
factor_4 = ClusterInput()
unit_y_2 = UnitY(Factor=factor_4)
boundary_surfaces = BoundarySurfaces(Edges=rectangle_3pt.Rectangle)
extrude = Extrude(Base=boundary_surfaces, Direction=unit_y_2)
unit_vector_2 = ClusterOutput(unit_y_2)
extrusion = ClusterOutput(extrude)

# ==== cluster Cluster_12
curve = ClusterInput()
factor = ClusterInput()
amplitude = ClusterInput()
amplitude_2 = ClusterInput()

end_points = EndPoints(Curve=curve)  # -> Start, End
list_item = ListItem(List=end_points.End, Index=0, Wrap=True)
list_item_2 = ListItem(List=end_points.Start, Index=0, Wrap=True)
list_item_3 = ListItem(List=reverse(end_points.Start), Index=0, Wrap=True)
list_item_4 = ListItem(List=reverse(end_points.End), Index=0, Wrap=True)
line = Line(StartPoint=list_item_2, EndPoint=list_item_3)
line_2 = Line(StartPoint=list_item, EndPoint=list_item_4)
curve_middle = CurveMiddle(Curve=line)
curve_middle_2 = CurveMiddle(Curve=line_2)
scale = Scale(Geometry=line, Center=curve_middle, Factor=Slider(1.05, range=0..5))  # -> Geometry, Transform
scale_2 = Scale(Geometry=line_2, Center=curve_middle_2, Factor=Slider(1.05, range=0..5))  # -> Geometry, Transform
unit_z = UnitZ(Factor=factor)
end_points_2 = EndPoints(Curve=scale.Geometry)  # -> Start, End
end_points_3 = EndPoints(Curve=scale_2.Geometry)  # -> Start, End
move = Move(Geometry=end_points_2.Start, Motion=unit_z)  # -> Geometry, Transform
move_2 = Move(Geometry=end_points_3.Start, Motion=unit_z)  # -> Geometry, Transform
rectangle_3pt = Rectangle3Pt(PointA=end_points_2.Start, PointB=end_points_2.End, PointC=move.Geometry)  # -> Rectangle, Length
rectangle_3pt_2 = Rectangle3Pt(PointA=end_points_3.Start, PointB=end_points_3.End, PointC=move_2.Geometry)  # -> Rectangle, Length
boundary_surfaces = BoundarySurfaces(Edges=[rectangle_3pt.Rectangle, rectangle_3pt_2.Rectangle])
md_slider = MDSlider(SliderMode=0, slider_value=Point(0.5, 0.5, 0.5), x_domain=Domain(0, 1), y_domain=Domain(0, 1), z_domain=Domain(0, 1))
evaluate_surface = EvaluateSurface(Surface=reparameterize(boundary_surfaces), Point=md_slider)  # -> Point, Normal, UDirection, VDirection, Frame
amplitude_3 = Amplitude(Vector=evaluate_surface.Normal, Amplitude=amplitude)
reverse = Reverse(Vector=evaluate_surface.Normal)
amplitude_4 = Amplitude(Vector=reverse, Amplitude=expr("x/2", amplitude_2))
extrude = Extrude(Base=boundary_surfaces, Direction=amplitude_3)
move_3 = Move(Geometry=extrude, Motion=amplitude_4)  # -> Geometry, Transform

geometry = ClusterOutput(move_3.Geometry)

# ==== cluster Cluster_13
breps_a = ClusterInput()
breps_b = ClusterInput()
solid_intersection = SolidIntersection(BrepsA=breps_a, BrepsB=graft(breps_b))
volume = Volume(Geometry=solid_intersection)  # -> Volume, Centroid
xy_plane = XYPlane(Origin=volume.Centroid)
split_brep = SplitBrep(Brep=solid_intersection, Cutter=xy_plane)
cap_holes = CapHoles(Brep=split_brep)
dispatch = Dispatch(List=cap_holes, DispatchPattern=[True, False])  # -> ListA, ListB
breps_a_2 = ClusterInput()
solid_difference = SolidDifference(BrepsA=breps_a_2, BrepsB=flatten(dispatch.ListA))
result = ClusterOutput(solid_difference)
breps_a_3 = ClusterInput()
solid_difference_2 = SolidDifference(BrepsA=breps_a_3, BrepsB=flatten(dispatch.ListB))
result_2 = ClusterOutput(solid_difference_2)

# ==== cluster Cluster_14
curve = ClusterInput()
curve_middle = CurveMiddle(Curve=curve)
panel = ClusterOutput("0")
cull_index = CullIndex(List=reverse(curve_middle), Indices="0", Wrap=True)  # -> reverse(List)
dispatch = Dispatch(List=cull_index, DispatchPattern=[True, False])  # -> ListA, ListB
motion = ClusterInput()
motion_2 = ClusterInput()
move = Move(Geometry=dispatch.ListB, Motion=motion)  # -> Geometry, Transform
move_2 = Move(Geometry=dispatch.ListA, Motion=motion_2)  # -> Geometry, Transform
factor = ClusterInput()
rectangle_3pt = Rectangle3Pt(PointA=move_2.Geometry, PointB=dispatch.ListB, PointC=move.Geometry)  # -> Rectangle, Length
unit_x = UnitX(Factor=factor)
boundary_surfaces = BoundarySurfaces(Edges=rectangle_3pt.Rectangle)
extrude = Extrude(Base=boundary_surfaces, Direction=unit_x)
move_3 = Move(Geometry=extrude, Motion=expr("-x/2", unit_x))  # -> Geometry, Transform
geometry = ClusterOutput(move_3.Geometry)

# ==== cluster Cluster_15
list = ClusterInput()
indices = ClusterInput()
breps_a = ClusterInput()
breps_a_2 = ClusterInput()

cull_index = CullIndex(List=reverse(list), Indices=indices, Wrap=True)  # -> reverse(List)
dispatch = Dispatch(List=cull_index, DispatchPattern=[True, False])  # -> ListA, ListB
solid_intersection = SolidIntersection(BrepsA=graft(breps_a), BrepsB=graft(dispatch.ListA))
solid_intersection_2 = SolidIntersection(BrepsA=graft(breps_a_2), BrepsB=graft(dispatch.ListB))
volume = Volume(Geometry=solid_intersection)  # -> Volume, Centroid
volume_2 = Volume(Geometry=solid_intersection_2)  # -> Volume, Centroid
xy_plane = XYPlane(Origin=volume.Centroid)
xy_plane_2 = XYPlane(Origin=volume_2.Centroid)
split_brep = SplitBrep(Brep=solid_intersection, Cutter=xy_plane)
split_brep_2 = SplitBrep(Brep=solid_intersection_2, Cutter=xy_plane_2)
cap_holes = CapHoles(Brep=split_brep)
cap_holes_2 = CapHoles(Brep=split_brep_2)
dispatch_2 = Dispatch(List=cap_holes, DispatchPattern=[True, False])  # -> ListA, ListB
dispatch_3 = Dispatch(List=cap_holes_2, DispatchPattern=[True, False])  # -> ListA, ListB
merge = Merge(Data1=dispatch_2.ListA, Data2=dispatch_3.ListA)
merge_2 = Merge(Data1=dispatch_2.ListB, Data2=dispatch_3.ListB)

result = ClusterOutput(merge)
result_2 = ClusterOutput(merge_2)

# ==== cluster Cluster_16
curve = ClusterInput()
breps_a = ClusterInput()
breps_b = ClusterInput()
breps_a_2 = ClusterInput()
breps_b_2 = ClusterInput()
breps_a_3 = ClusterInput()
breps_a_4 = ClusterInput()
breps_a_5 = ClusterInput()
breps_a_6 = ClusterInput()
breps_b_3 = ClusterInput()

curve_2 = Curve(curve)
solid_intersection = SolidIntersection(BrepsA=breps_a, BrepsB=breps_b)
divide_curve = DivideCurve(Curve=curve_2, Count=Slider(5, range=1..15), Kinks=False)  # -> Points, Tangents, Parameters
yz_plane = YZPlane(Origin=divide_curve.Points)
plane_surface = PlaneSurface(Plane=yz_plane, XSize=Domain(-10, 10), YSize=Domain(-10, 10))
split_brep_multiple = SplitBrepMultiple(Brep=graft(solid_intersection), Cutters=plane_surface)
cap_holes = CapHoles(Brep=split_brep_multiple)
dispatch = Dispatch(List=cap_holes, DispatchPattern=[True, False])  # -> ListA, ListB
number_slider = Slider(0, range=0..100)
brep = Brep(dispatch.ListA)
brep_2 = Brep(dispatch.ListB)
cull_index = CullIndex(List=brep, Indices=number_slider, Wrap=True)
list_item = ListItem(List=brep, Index=number_slider, Wrap=True)
cull_index_2 = CullIndex(List=reverse(cull_index), Indices=number_slider, Wrap=True)
list_item_2 = ListItem(List=reverse(cull_index), Index=number_slider, Wrap=True)
solid_intersection_2 = SolidIntersection(BrepsA=graft(breps_a_2), BrepsB=breps_b_2)
solid_difference = SolidDifference(BrepsA=breps_a_3, BrepsB=flatten(cull_index_2))
merge = Merge(Data1=list_item, Data2=list_item_2, Data3=brep_2)  # -> flatten(Result)
dispatch_2 = Dispatch(List=solid_intersection_2, DispatchPattern=[True, False])  # -> ListA, ListB
brep_3 = Brep(dispatch_2.ListA)
brep_4 = Brep(dispatch_2.ListB)
solid_difference_2 = SolidDifference(BrepsA=breps_a_4, BrepsB=merge)
solid_difference_3 = SolidDifference(BrepsA=graft(breps_a_5), BrepsB=brep_3)
solid_difference_4 = SolidDifference(BrepsA=solid_difference, BrepsB=flatten(brep_4))
solid_intersection_3 = SolidIntersection(BrepsA=breps_a_6, BrepsB=solid_difference_4)
solid_difference_5 = SolidDifference(BrepsA=solid_difference_2, BrepsB=flatten(breps_b_3))
solid_difference_6 = SolidDifference(BrepsA=solid_difference_4, BrepsB=flatten(solid_intersection_3))

result = ClusterOutput(solid_difference_3)
result_2 = ClusterOutput(solid_difference_5)
result_3 = ClusterOutput(solid_difference_6)
